% Simulink data dictionary SWC_ADM_DataDictionary.sldd

VAR_ADM_stModeReq_u8 = ASAP2.Signal(StorageClass="ExportedGlobal", DataType="uint8", Min=0, Max=255, InitialValue="0")
VAR_ADM_flgDchgReq_b = ASAP2.Signal(StorageClass="ExportedGlobal", DataType="boolean", Min=0, Max=1, InitialValue="0")
VAR_ADM_flgCrash_b = ASAP2.Signal(StorageClass="ExportedGlobal", DataType="boolean", Min=0, Max=1, InitialValue="0")
VAR_ADM_L2Com_HiPrecVolt_IN = ASAP2.Signal(StorageClass="ExportedGlobal", DataType="single", Min=0, Max=1000, InitialValue="0")
VAR_ADM_L2Com_BMSVolt_IN = ASAP2.Signal(StorageClass="ExportedGlobal", DataType="single", Min=0, Max=1000, InitialValue="0")
VAR_ADM_BMSVolt_f32 = ASAP2.Signal(StorageClass="ExportedGlobal", DataType="single", Min=0, Max=1000, InitialValue="0")
VAR_ADM_BMSVoltRngErr_b = ASAP2.Signal(StorageClass="ExportedGlobal", DataType="boolean", Min=0, Max=1, InitialValue="0")
VAR_ADM_GlbDchgErr_b = ASAP2.Signal(StorageClass="ExportedGlobal", DataType="boolean", Min=0, Max=1, InitialValue="0")
VAR_ADM_HiPrecVolt_f32 = ASAP2.Signal(StorageClass="ExportedGlobal", DataType="single", Min=0, Max=1000, InitialValue="0")
VAR_ADM_VoltCmpChkErr_b = ASAP2.Signal(StorageClass="ExportedGlobal", DataType="boolean", Min=0, Max=1, InitialValue="0")
VAR_VoltCmpChkErrSt = ASAP2.Signal(StorageClass="ExportedGlobal", DataType="boolean", Min=0, Max=1, InitialValue="0")
VAR_BMSVoltRngErrSt = ASAP2.Signal(StorageClass="ExportedGlobal", DataType="boolean", Min=0, Max=1, InitialValue="0")
CAL_ADM_flgstModeReqSwt_b = iEDS_Parameter.Parameter(0, DoubleProperty=0, Int32Property=int32(0), LogicalProperty=false, OnOffStringProperty="off", ColorStringProperty="red", StorageClass="iEDS_Parameter", DataType="boolean", Min=0, Max=1)
CAL_ADM_stModeReq_u8 = iEDS_Parameter.Parameter(0, DoubleProperty=0, Int32Property=int32(0), LogicalProperty=false, OnOffStringProperty="off", ColorStringProperty="red", StorageClass="iEDS_Parameter", DataType="uint8", Min=0, Max=1)
CAL_ADM_flgDchgReqSwt_b = iEDS_Parameter.Parameter(0, DoubleProperty=0, Int32Property=int32(0), LogicalProperty=false, OnOffStringProperty="off", ColorStringProperty="red", StorageClass="iEDS_Parameter", DataType="boolean", Min=0, Max=1)
CAL_ADM_flgDchgReq_b = iEDS_Parameter.Parameter(0, DoubleProperty=0, Int32Property=int32(0), LogicalProperty=false, OnOffStringProperty="off", ColorStringProperty="red", StorageClass="iEDS_Parameter", DataType="boolean", Min=0, Max=1)
CAL_ADM_flgCrashSwt_b = iEDS_Parameter.Parameter(0, DoubleProperty=0, Int32Property=int32(0), LogicalProperty=false, OnOffStringProperty="off", ColorStringProperty="red", StorageClass="iEDS_Parameter", DataType="boolean", Min=0, Max=1)
CAL_ADM_flgCrash_b = iEDS_Parameter.Parameter(0, DoubleProperty=0, Int32Property=int32(0), LogicalProperty=false, OnOffStringProperty="off", ColorStringProperty="red", StorageClass="iEDS_Parameter", DataType="boolean", Min=0, Max=1)
CAL_ADM_L2Com_HiPrecVolt_b = iEDS_Parameter.Parameter(0, DoubleProperty=0, Int32Property=int32(0), LogicalProperty=false, OnOffStringProperty="off", ColorStringProperty="red", StorageClass="iEDS_Parameter", DataType="boolean", Min=0, Max=1)
CAL_ADM_L2Com_HiPrecVolt = iEDS_Parameter.Parameter(0, DoubleProperty=0, Int32Property=int32(0), LogicalProperty=false, OnOffStringProperty="off", ColorStringProperty="red", StorageClass="iEDS_Parameter", DataType="single", Min=0, Max=1000)
CAL_ADM_L2Com_BMSVolt_b = iEDS_Parameter.Parameter(0, DoubleProperty=0, Int32Property=int32(0), LogicalProperty=false, OnOffStringProperty="off", ColorStringProperty="red", StorageClass="iEDS_Parameter", DataType="boolean", Min=0, Max=1)
CAL_ADM_L2Com_BMSVolt = iEDS_Parameter.Parameter(0, DoubleProperty=0, Int32Property=int32(0), LogicalProperty=false, OnOffStringProperty="off", ColorStringProperty="red", StorageClass="iEDS_Parameter", DataType="single", Min=0, Max=1000)
CAL_ADM_VoltCmpChkErrst_b = iEDS_Parameter.Parameter(0, DoubleProperty=0, Int32Property=int32(0), LogicalProperty=false, OnOffStringProperty="off", ColorStringProperty="red", StorageClass="iEDS_Parameter", DataType="boolean", Min=0, Max=1)
CAL_ADM_DchgMode_u8 = iEDS_Parameter.Parameter(1, DoubleProperty=0, Int32Property=int32(0), LogicalProperty=false, OnOffStringProperty="off", ColorStringProperty="red", StorageClass="iEDS_Parameter", DataType="uint8", Min=0, Max=255)
CAL_ADM_GlbDchgThrshTime_f32 = iEDS_Parameter.Parameter(2.8, DoubleProperty=0, Int32Property=int32(0), LogicalProperty=false, OnOffStringProperty="off", ColorStringProperty="red", StorageClass="iEDS_Parameter", DataType="single", Min=0, Max=20)
CAL_ADM_GlbDchgThrshVolt_f32 = iEDS_Parameter.Parameter(60, DoubleProperty=0, Int32Property=int32(0), LogicalProperty=false, OnOffStringProperty="off", ColorStringProperty="red", StorageClass="iEDS_Parameter", DataType="single", Min=0, Max=300)
CAL_ADM_BMSUpperThr_f32 = iEDS_Parameter.Parameter(600, DoubleProperty=0, Int32Property=int32(0), LogicalProperty=false, OnOffStringProperty="off", ColorStringProperty="red", StorageClass="iEDS_Parameter", DataType="single", Min=0, Max=1000)
CAL_ADM_BMSLowerThr_f32 = iEDS_Parameter.Parameter(0, DoubleProperty=0, Int32Property=int32(0), LogicalProperty=false, OnOffStringProperty="off", ColorStringProperty="red", StorageClass="iEDS_Parameter", DataType="single", Min=0, Max=1000)
CAL_ADM_VoltAbsDiffThr_f32 = iEDS_Parameter.Parameter(10, DoubleProperty=0, Int32Property=int32(0), LogicalProperty=false, OnOffStringProperty="off", ColorStringProperty="red", StorageClass="iEDS_Parameter", DataType="single", Min=0, Max=100)
CAL_ADM_VoltAbsDiffThrPerc_f32 = iEDS_Parameter.Parameter(0.1, DoubleProperty=0, Int32Property=int32(0), LogicalProperty=false, OnOffStringProperty="off", ColorStringProperty="red", StorageClass="iEDS_Parameter", DataType="single", Min=0, Max=5)
CAL_ADM_VoltChgThr_f32 = iEDS_Parameter.Parameter(100, DoubleProperty=0, Int32Property=int32(0), LogicalProperty=false, OnOffStringProperty="off", ColorStringProperty="red", StorageClass="iEDS_Parameter", DataType="single", Min=0, Max=600)
CAL_ADM_GlbDchgErrOutCtl_b = iEDS_Parameter.Parameter(1, DoubleProperty=0, Int32Property=int32(0), LogicalProperty=false, OnOffStringProperty="off", ColorStringProperty="red", StorageClass="iEDS_Parameter", DataType="boolean", Min=0, Max=1)
CAL_ADM_GlbDchgErrRst_b = iEDS_Parameter.Parameter(0, DoubleProperty=0, Int32Property=int32(0), LogicalProperty=false, OnOffStringProperty="off", ColorStringProperty="red", StorageClass="iEDS_Parameter", DataType="boolean", Min=0, Max=1)
CAL_ADM_BMSVoltRngErrRst_b = iEDS_Parameter.Parameter(0, DoubleProperty=0, Int32Property=int32(0), LogicalProperty=false, OnOffStringProperty="off", ColorStringProperty="red", StorageClass="iEDS_Parameter", DataType="boolean", Min=0, Max=1)
CAL_ADM_BMSVoltRngErrCntThr_s16 = iEDS_Parameter.Parameter(100, DoubleProperty=0, Int32Property=int32(0), LogicalProperty=false, OnOffStringProperty="off", ColorStringProperty="red", StorageClass="iEDS_Parameter", DataType="int16", Min=0, Max=1000)
CAL_ADM_BMSVoltRngErrDebThr_s16 = iEDS_Parameter.Parameter(50, DoubleProperty=0, Int32Property=int32(0), LogicalProperty=false, OnOffStringProperty="off", ColorStringProperty="red", StorageClass="iEDS_Parameter", DataType="int16", Min=0, Max=1000)
CAL_ADM_VoltCmpChkErrRst_b = iEDS_Parameter.Parameter(0, DoubleProperty=0, Int32Property=int32(0), LogicalProperty=false, OnOffStringProperty="off", ColorStringProperty="red", StorageClass="iEDS_Parameter", DataType="boolean", Min=0, Max=1)
CAL_ADM_VoltCmpChkErrCntThr_s16 = iEDS_Parameter.Parameter(100, DoubleProperty=0, Int32Property=int32(0), LogicalProperty=false, OnOffStringProperty="off", ColorStringProperty="red", StorageClass="iEDS_Parameter", DataType="int16", Min=0, Max=1000)
CAL_ADM_VoltCmpChkErrDebThr_s16 = iEDS_Parameter.Parameter(50, DoubleProperty=0, Int32Property=int32(0), LogicalProperty=false, OnOffStringProperty="off", ColorStringProperty="red", StorageClass="iEDS_Parameter", DataType="int16", Min=0, Max=1000)
CAL_ADM_BMSrate_Change_f32 = iEDS_Parameter.Parameter(1, DoubleProperty=0, Int32Property=int32(0), LogicalProperty=false, OnOffStringProperty="off", ColorStringProperty="red", StorageClass="iEDS_Parameter", DataType="boolean", Min=0)
CAL_ADM_BMSup_Limit_f32 = iEDS_Parameter.Parameter(1, DoubleProperty=0, Int32Property=int32(0), LogicalProperty=false, OnOffStringProperty="off", ColorStringProperty="red", StorageClass="iEDS_Parameter", DataType="single", Min=0)
CAL_ADM_BMSdown_Limit_f32 = iEDS_Parameter.Parameter(1, DoubleProperty=0, Int32Property=int32(0), LogicalProperty=false, OnOffStringProperty="off", ColorStringProperty="red", StorageClass="iEDS_Parameter", DataType="single", Min=0)
float64 = Simulink.AliasType(BaseType="double")
float32 = Simulink.AliasType(BaseType="single")
sint64 = Simulink.AliasType(BaseType="int64")
sint32 = Simulink.AliasType(BaseType="int32")
sint16 = Simulink.AliasType(BaseType="int16")
sint8 = Simulink.AliasType(BaseType="int8")
uint64 = Simulink.AliasType(BaseType="uint64")
uint32 = Simulink.AliasType(BaseType="uint32")
uint16 = Simulink.AliasType(BaseType="uint16")
uint8 = Simulink.AliasType(BaseType="uint8")
boolean = Simulink.AliasType(BaseType="boolean")