% Simulink data dictionary SWC_STM_DataDictionary.sldd

VAR_STM_UintndTrqMonRslt_b = ASAP2.Signal(StorageClass="ExportedGlobal", DataType="boolean", Min=0, Max=1, InitialValue="0")
VAR_STM_UintndTrqErr_b = ASAP2.Signal(StorageClass="ExportedGlobal", DataType="boolean", Min=0, Max=1, InitialValue="0")
GLB_STM_MotorFw_u8 = iEDS_Parameter.Parameter(1, DoubleProperty=0, Int32Property=int32(0), LogicalProperty=false, OnOffStringProperty="off", ColorStringProperty="red", StorageClass="Define", DataType="uint8")
GLB_STM_MotorStop_u8 = iEDS_Parameter.Parameter(0, DoubleProperty=0, Int32Property=int32(0), LogicalProperty=false, OnOffStringProperty="off", ColorStringProperty="red", StorageClass="Define", DataType="uint8")
GLB_STM_ZeroTrq_u8 = iEDS_Parameter.Parameter(0, DoubleProperty=0, Int32Property=int32(0), LogicalProperty=false, OnOffStringProperty="off", ColorStringProperty="red", StorageClass="Define", DataType="uint8")
GLB_STM_PosvTrq_u8 = iEDS_Parameter.Parameter(1, DoubleProperty=0, Int32Property=int32(0), LogicalProperty=false, OnOffStringProperty="off", ColorStringProperty="red", StorageClass="Define", DataType="uint8")
CAL_STM_UxptTrqLim_f32 = iEDS_Parameter.Parameter(50, DoubleProperty=0, Int32Property=int32(0), LogicalProperty=false, OnOffStringProperty="off", ColorStringProperty="red", StorageClass="iEDS_Parameter", DataType="single", Min=-500, Max=500)
CAL_STM_UxptTrqMonErrRst_b = iEDS_Parameter.Parameter(0, DoubleProperty=0, Int32Property=int32(0), LogicalProperty=false, OnOffStringProperty="off", ColorStringProperty="red", StorageClass="iEDS_Parameter", DataType="boolean", Min=0, Max=1)
CAL_STM_UxptTrqMonCountTrh_s16 = iEDS_Parameter.Parameter(100, DoubleProperty=0, Int32Property=int32(0), LogicalProperty=false, OnOffStringProperty="off", ColorStringProperty="red", StorageClass="iEDS_Parameter", DataType="int16", Min=-200, Max=200)
CAL_STM_UxptTrqMonDebTrh_s16 = iEDS_Parameter.Parameter(50, DoubleProperty=0, Int32Property=int32(0), LogicalProperty=false, OnOffStringProperty="off", ColorStringProperty="red", StorageClass="iEDS_Parameter", DataType="int16", Min=-200, Max=200)
CAL_STM_SpeedCtlMode_u8 = iEDS_Parameter.Parameter(7, DoubleProperty=0, Int32Property=int32(0), LogicalProperty=false, OnOffStringProperty="off", ColorStringProperty="red", StorageClass="iEDS_Parameter", DataType="uint8", Min=0, Max=255)
CAL_STM_TrqSetRamp_f32 = iEDS_Parameter.Parameter(20, DoubleProperty=0, Int32Property=int32(0), LogicalProperty=false, OnOffStringProperty="off", ColorStringProperty="red", StorageClass="iEDS_Parameter", DataType="single", Min=0, Max=350)
float64 = Simulink.AliasType(BaseType="double")
float32 = Simulink.AliasType(BaseType="single")
sint64 = Simulink.AliasType(BaseType="int64")
sint32 = Simulink.AliasType(BaseType="int32")
sint16 = Simulink.AliasType(BaseType="int16")
sint8 = Simulink.AliasType(BaseType="int8")
uint64 = Simulink.AliasType(BaseType="uint64")
uint32 = Simulink.AliasType(BaseType="uint32")
uint16 = Simulink.AliasType(BaseType="uint16")
uint8 = Simulink.AliasType(BaseType="uint8")
boolean = Simulink.AliasType(BaseType="boolean")