% Simulink data dictionary SWC_SWD_DataDictionary.sldd

VAR_SWD_Tan_f32 = ASAP2.Signal(StorageClass="ExportedGlobal", DataType="single", Min=0, Max=1000, InitialValue="0")
VAR_SWD_AgRslv_f32 = ASAP2.Signal(StorageClass="ExportedGlobal", DataType="single", Min=-360, Max=360, InitialValue="0")
VAR_SWD_AgRslv45_f32 = ASAP2.Signal(StorageClass="ExportedGlobal", DataType="single", Min=-360, Max=360, InitialValue="0")
VAR_SWD_AgRtr_f32 = ASAP2.Signal(StorageClass="ExportedGlobal", DataType="single", Min=-360, Max=360, InitialValue="0")
VAR_SWD_AgRslvDelta_f32 = ASAP2.Signal(StorageClass="ExportedGlobal", DataType="single", Min=-10000, Max=10000, InitialValue="0")
VAR_SWD_AgRslvDelta0_f32 = ASAP2.Signal(StorageClass="ExportedGlobal", DataType="single", Min=-10000, Max=10000, InitialValue="0")
VAR_SWD_Spd_f32 = ASAP2.Signal(StorageClass="ExportedGlobal", DataType="single", Min=-24000, Max=24000, InitialValue="0")
VAR_SWD_TimecompSpd_f32 = ASAP2.Signal(StorageClass="ExportedGlobal", DataType="single", InitialValue="0")
VAR_SWD_TimecompAg_f32 = ASAP2.Signal(StorageClass="ExportedGlobal", DataType="single", InitialValue="0")
GLB_SWD_CircAge_f32 = iEDS_Parameter.Parameter(360, DoubleProperty=0, Int32Property=int32(0), LogicalProperty=false, OnOffStringProperty="off", ColorStringProperty="red", StorageClass="Define", DataType="single")
GLB_SWD_OneHalf_f32 = iEDS_Parameter.Parameter(0.5, DoubleProperty=0, Int32Property=int32(0), LogicalProperty=false, OnOffStringProperty="off", ColorStringProperty="red", StorageClass="Define", DataType="single")
GLB_SWD_MotorPole_u8 = iEDS_Parameter.Parameter(4, DoubleProperty=0, Int32Property=int32(0), LogicalProperty=false, OnOffStringProperty="off", ColorStringProperty="red", StorageClass="Define", DataType="uint8")
GLB_SWD_Sixty_f32 = iEDS_Parameter.Parameter(60, DoubleProperty=0, Int32Property=int32(0), LogicalProperty=false, OnOffStringProperty="off", ColorStringProperty="red", StorageClass="Define", DataType="single")
GLB_SWD_pi_f32 = iEDS_Parameter.Parameter(3.141592, DoubleProperty=0, Int32Property=int32(0), LogicalProperty=false, OnOffStringProperty="off", ColorStringProperty="red", StorageClass="Define", DataType="single")
CAL_SWD_RslvAgCompa_f32 = iEDS_Parameter.Parameter(0, DoubleProperty=0, Int32Property=int32(0), LogicalProperty=false, OnOffStringProperty="off", ColorStringProperty="red", StorageClass="iEDS_Parameter", DataType="single", Min=0, Max=360)
CAL_SWD_Radian_u16 = iEDS_Parameter.Parameter([0 64 128 192 256 320 384 448 512 576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 51471], DoubleProperty=0, Int32Property=int32(0), LogicalProperty=false, OnOffStringProperty="off", ColorStringProperty="red", StorageClass="iEDS_Parameter", DataType="uint16")
CAL_SWD_MotorPole_u8 = iEDS_Parameter.Parameter(4, DoubleProperty=0, Int32Property=int32(0), LogicalProperty=false, OnOffStringProperty="off", ColorStringProperty="red", StorageClass="iEDS_Parameter", DataType="uint8", Min=0, Max=255)
CAL_SWD_AgrslvCompCnt_f32 = iEDS_Parameter.Parameter(2560, DoubleProperty=0, Int32Property=int32(0), LogicalProperty=false, OnOffStringProperty="off", ColorStringProperty="red", StorageClass="iEDS_Parameter", DataType="single")
CAL_SWD_Spd_f32 = iEDS_Parameter.Parameter(0, DoubleProperty=0, Int32Property=int32(0), LogicalProperty=false, OnOffStringProperty="off", ColorStringProperty="red", StorageClass="iEDS_Parameter", DataType="single")
CAL_SWD_Agcomptimectl_b = iEDS_Parameter.Parameter(1, DoubleProperty=0, Int32Property=int32(0), LogicalProperty=false, OnOffStringProperty="off", ColorStringProperty="red", StorageClass="iEDS_Parameter", DataType="boolean")
CAL_SWD_Deltatimesel_b = iEDS_Parameter.Parameter(1, DoubleProperty=0, Int32Property=int32(0), LogicalProperty=false, OnOffStringProperty="off", ColorStringProperty="red", StorageClass="iEDS_Parameter", DataType="boolean")
float64 = Simulink.AliasType(BaseType="double")
float32 = Simulink.AliasType(BaseType="single")
sint64 = Simulink.AliasType(BaseType="int64")
sint32 = Simulink.AliasType(BaseType="int32")
sint16 = Simulink.AliasType(BaseType="int16")
sint8 = Simulink.AliasType(BaseType="int8")
uint64 = Simulink.AliasType(BaseType="uint64")
uint32 = Simulink.AliasType(BaseType="uint32")
uint16 = Simulink.AliasType(BaseType="uint16")
uint8 = Simulink.AliasType(BaseType="uint8")
boolean = Simulink.AliasType(BaseType="boolean")