test file "MILTest_TCF"
  coverage: Decision, MCDC, Condition

suite "PinputCalc"

  case "EI09_SWUT_MIL_PinputCalc_01" [baseline]
    model SWC_TCF, harness SWC_TCF_Harness_PinputCalc (for SWC_TCF/SWC_TCF_1ms_sys/PwrTrqCalcProc/PinputCalc)
    input "EI09_SWUT_MIL_PinputCalc_01" from TestCase_TCF.xlsx, mapped to L2Sampling_DycUMon, L2Sampling_DycVMon, L2Sampling_DycWMon, TRSP_iU, TRSP_iV, TRSP_iW, HVSP_DcLnkOut (active)
    baseline "EI09_SWUT_MIL_PinputCalc_01"
      TCF_Pinput: abs tol 0.1

suite "IsCalc"

  case "EI09_SWUT_MIL_IsCalc_01" [baseline]
    model SWC_TCF, harness SWC_TCF_Harness_IsCalc (for SWC_TCF/SWC_TCF_1ms_sys/PwrTrqCalcProc/IsCalc)
    input "EI09_SWUT_MIL_IsCalc_01" from TestCase_TCF.xlsx, mapped to TRSP_iU, TRSP_iV, TRSP_iW (active)
    baseline "IsCalc"
      TCF_Is: abs tol 0.1

suite "PlossClc"

  case "EI09_SWUT_MIL_PlossClc_01" [baseline]
    model SWC_TCF, harness SWC_TCF_Harness_PlossCalc (for SWC_TCF/SWC_TCF_1ms_sys/PwrTrqCalcProc/PlossCalc)
    input "EI09_SWUT_MIL_PlossCalc_01" from TestCase_TCF.xlsx, mapped to TCF_Is, HSPF_StrrTempFlt, SWD_Spd (active)
    baseline "EI09_SWUT_MIL_PlossCalc_01"
      TCF_Ploss: abs tol 0.1

  case "EI09_SWUT_MIL_PlossClc_02" [baseline]
    model SWC_TCF, harness SWC_TCF_Harness_PlossCalc (for SWC_TCF/SWC_TCF_1ms_sys/PwrTrqCalcProc/PlossCalc)
    input "EI09_SWUT_MIL_PlossCalc_02" from TestCase_TCF.xlsx, mapped to TCF_Is, HSPF_StrrTempFlt, SWD_Spd (active)
    baseline "EI09_SWUT_MIL_PlossCalc_02"
      TCF_Ploss: abs tol 0.1

  case "EI09_SWUT_MIL_PlossClc_03" [baseline]
    model SWC_TCF, harness SWC_TCF_Harness_PlossCalc (for SWC_TCF/SWC_TCF_1ms_sys/PwrTrqCalcProc/PlossCalc)
    input "EI09_SWUT_MIL_PlossCalc_03" from TestCase_TCF.xlsx, mapped to TCF_Is, HSPF_StrrTempFlt, SWD_Spd (active)
    baseline "EI09_SWUT_MIL_PlossCalc_03"
      TCF_Ploss: abs tol 0.1

  case "EI09_SWUT_MIL_PlossClc_04" [baseline]
    model SWC_TCF, harness SWC_TCF_Harness_PlossCalc (for SWC_TCF/SWC_TCF_1ms_sys/PwrTrqCalcProc/PlossCalc)
    input "EI09_SWUT_MIL_PlossCalc_04" from TestCase_TCF.xlsx, mapped to TCF_Is, HSPF_StrrTempFlt, SWD_Spd (active)
    baseline "EI09_SWUT_MIL_PlossCalc_04"
      TCF_Ploss: abs tol 0.1

  case "EI09_SWUT_MIL_PlossClc_05" [baseline]
    model SWC_TCF, harness SWC_TCF_Harness_PlossCalc (for SWC_TCF/SWC_TCF_1ms_sys/PwrTrqCalcProc/PlossCalc)
    parameter set "Parameter Set 1": CAL_TCF_flgUsePlossCompa_b = 0  % base workspace
    input "EI09_SWUT_MIL_PlossCalc_05" from TestCase_TCF.xlsx, mapped to TCF_Is, HSPF_StrrTempFlt, SWD_Spd (active)
    baseline "EI09_SWUT_MIL_PlossCalc_05"
      TCF_Ploss: abs tol 0.1

suite "PwrTrqClc"

  case "EI09_SWUT_MIL_PwrTrqClc_01" [baseline]
    model SWC_TCF, harness SWC_TCF_Harness_PwrTrqCalc (for SWC_TCF/SWC_TCF_1ms_sys/PwrTrqCalcProc/PwrTrqCalc)
    input "EI09_SWUT_MIL_PwrTrqCalc_01" from TestCase_TCF.xlsx, mapped to TCF_Pinput, TCF_Ploss, SWD_Spd (active)
    baseline "EI09_SWUT_MIL_PwrTrqCalc_01"
      TCF_PwrTrq: abs tol 0.1

  case "EI09_SWUT_MIL_PwrTrqClc_02" [baseline]
    model SWC_TCF, harness SWC_TCF_Harness_PwrTrqCalc (for SWC_TCF/SWC_TCF_1ms_sys/PwrTrqCalcProc/PwrTrqCalc)
    input "EI09_SWUT_MIL_PwrTrqCalc_02" from TestCase_TCF.xlsx, mapped to TCF_Pinput, TCF_Ploss, SWD_Spd (active)
    baseline "EI09_SWUT_MIL_PwrTrqCalc_02"
      TCF_PwrTrq: abs tol 0.1

suite "IdIqClc"

  case "EI09_SWUT_MIL_IdIqClc_01" [baseline]
    model SWC_TCF, harness SWC_TCF_Harness_IdIqCalc (for SWC_TCF/SWC_TCF_1ms_sys/CurrAgTrqCalcProc/IdIqCalc)
    input "EI09_SWUT_MIL_IdIqCalc_01" from TestCase_TCF.xlsx, mapped to TRSP_iU, TRSP_iV, TRSP_iW, SWD_AgRtr (active)
    baseline "EI09_SWUT_MIL_IdIqCalc_01"
      TCF_idAct: abs tol 0.1
      TCF_iqAct: abs tol 0.1

suite "MotorModeJdg"

  case "EI09_SWUT_MIL_MotorModeJdg_01" [baseline]
    model SWC_TCF, harness SWC_TCF_Harness_MotorModeJdg (for SWC_TCF/SWC_TCF_1ms_sys/CurrAgTrqCalcProc/MotorModeJdg)
    input "EI09_SWUT_MIL_MotorModeJdg_01" from TestCase_TCF.xlsx, mapped to TCF_CurrAgTrq, SWD_Spd (active)
    input "EI09_SWUT_MIL_MotorModeJdg_02" from TestCase_TCF.xlsx, mapped to TCF_CurrAgTrq, SWD_Spd
    input "EI09_SWUT_MIL_MotorModeJdg_03" from TestCase_TCF.xlsx, mapped to TCF_CurrAgTrq, SWD_Spd
    input "EI09_SWUT_MIL_MotorModeJdg_04" from TestCase_TCF.xlsx, mapped to TCF_CurrAgTrq, SWD_Spd
    input "EI09_SWUT_MIL_MotorModeJdg_05" from TestCase_TCF.xlsx, mapped to TCF_CurrAgTrq, SWD_Spd
    baseline "EI09_SWUT_MIL_MotorModeJdg_01"
      TCF_MotorMode: abs tol 0.1
      TCF_TrqDir: abs tol 0.1
      TCF_nDir: abs tol 0.1
    baseline "EI09_SWUT_MIL_MotorModeJdg_02"
      TCF_MotorMode: abs tol 0.1
      TCF_TrqDir: abs tol 0.1
      TCF_nDir: abs tol 0.1
    baseline "EI09_SWUT_MIL_MotorModeJdg_03"
      TCF_MotorMode: abs tol 0.1
      TCF_TrqDir: abs tol 0.1
      TCF_nDir: abs tol 0.1
    baseline "EI09_SWUT_MIL_MotorModeJdg_04"
      TCF_MotorMode: abs tol 0.1
      TCF_TrqDir: abs tol 0.1
      TCF_nDir: abs tol 0.1
    baseline "EI09_SWUT_MIL_MotorModeJdg_05"
      TCF_MotorMode: abs tol 0.1
      TCF_TrqDir: abs tol 0.1
      TCF_nDir: abs tol 0.1

  case "EI09_SWUT_MIL_MotorModeJdg_02" [baseline]
    model SWC_TCF, harness SWC_TCF_Harness_MotorModeJdg (for SWC_TCF/SWC_TCF_1ms_sys/CurrAgTrqCalcProc/MotorModeJdg)
    input "EI09_SWUT_MIL_MotorModeJdg_02" from TestCase_TCF.xlsx, mapped to TCF_CurrAgTrq, SWD_Spd (active)
    baseline "EI09_SWUT_MIL_MotorModeJdg_02"
      TCF_MotorMode: abs tol 0.1
      TCF_TrqDir: abs tol 0.1
      TCF_nDir: abs tol 0.1

  case "EI09_SWUT_MIL_MotorModeJdg_03" [baseline]
    model SWC_TCF, harness SWC_TCF_Harness_MotorModeJdg (for SWC_TCF/SWC_TCF_1ms_sys/CurrAgTrqCalcProc/MotorModeJdg)
    input "EI09_SWUT_MIL_MotorModeJdg_01" from TestCase_TCF.xlsx, mapped to TCF_CurrAgTrq, SWD_Spd
    input "EI09_SWUT_MIL_MotorModeJdg_02" from TestCase_TCF.xlsx, mapped to TCF_CurrAgTrq, SWD_Spd
    input "EI09_SWUT_MIL_MotorModeJdg_03" from TestCase_TCF.xlsx, mapped to TCF_CurrAgTrq, SWD_Spd (active)
    input "EI09_SWUT_MIL_MotorModeJdg_04" from TestCase_TCF.xlsx, mapped to TCF_CurrAgTrq, SWD_Spd
    input "EI09_SWUT_MIL_MotorModeJdg_05" from TestCase_TCF.xlsx, mapped to TCF_CurrAgTrq, SWD_Spd
    baseline "EI09_SWUT_MIL_MotorModeJdg_01"
      TCF_MotorMode: abs tol 0.1
      TCF_TrqDir: abs tol 0.1
      TCF_nDir: abs tol 0.1
    baseline "EI09_SWUT_MIL_MotorModeJdg_02"
      TCF_MotorMode: abs tol 0.1
      TCF_TrqDir: abs tol 0.1
      TCF_nDir: abs tol 0.1
    baseline "EI09_SWUT_MIL_MotorModeJdg_03"
      TCF_MotorMode: abs tol 0.1
      TCF_TrqDir: abs tol 0.1
      TCF_nDir: abs tol 0.1
    baseline "EI09_SWUT_MIL_MotorModeJdg_04"
      TCF_MotorMode: abs tol 0.1
      TCF_TrqDir: abs tol 0.1
      TCF_nDir: abs tol 0.1
    baseline "EI09_SWUT_MIL_MotorModeJdg_05"
      TCF_MotorMode: abs tol 0.1
      TCF_TrqDir: abs tol 0.1
      TCF_nDir: abs tol 0.1

  case "EI09_SWUT_MIL_MotorModeJdg_04" [baseline]
    model SWC_TCF, harness SWC_TCF_Harness_MotorModeJdg (for SWC_TCF/SWC_TCF_1ms_sys/CurrAgTrqCalcProc/MotorModeJdg)
    input "EI09_SWUT_MIL_MotorModeJdg_04" from TestCase_TCF.xlsx, mapped to TCF_CurrAgTrq, SWD_Spd (active)
    baseline "EI09_SWUT_MIL_MotorModeJdg_04"
      TCF_MotorMode: abs tol 0.1
      TCF_TrqDir: abs tol 0.1
      TCF_nDir: abs tol 0.1

  case "EI09_SWUT_MIL_MotorModeJdg_05" [baseline]
    model SWC_TCF, harness SWC_TCF_Harness_MotorModeJdg (for SWC_TCF/SWC_TCF_1ms_sys/CurrAgTrqCalcProc/MotorModeJdg)
    input "EI09_SWUT_MIL_MotorModeJdg_05" from TestCase_TCF.xlsx, mapped to TCF_CurrAgTrq, SWD_Spd (active)
    baseline "EI09_SWUT_MIL_MotorModeJdg_05"
      TCF_MotorMode: abs tol 0.1
      TCF_TrqDir: abs tol 0.1
      TCF_nDir: abs tol 0.1

  case "EI09_SWUT_MIL_MotorModeJdg_06" [baseline]
    model SWC_TCF, harness SWC_TCF_Harness_MotorModeJdg (for SWC_TCF/SWC_TCF_1ms_sys/CurrAgTrqCalcProc/MotorModeJdg)
    input "EI09_SWUT_MIL_MotorModeJdg_06" from TestCase_TCF.xlsx, mapped to TCF_CurrAgTrq, SWD_Spd (active)
    input "EI09_SWUT_MIL_MotorModeJdg_07" from TestCase_TCF.xlsx, mapped to TCF_CurrAgTrq, SWD_Spd
    input "EI09_SWUT_MIL_MotorModeJdg_08" from TestCase_TCF.xlsx, mapped to TCF_CurrAgTrq, SWD_Spd
    input "EI09_SWUT_MIL_MotorModeJdg_09" from TestCase_TCF.xlsx, mapped to TCF_CurrAgTrq, SWD_Spd
    input "EI09_SWUT_MIL_MotorModeJdg_10" from TestCase_TCF.xlsx, mapped to TCF_CurrAgTrq, SWD_Spd
    baseline "EI09_SWUT_MIL_MotorModeJdg_06"
      TCF_MotorMode: abs tol 0.1
      TCF_TrqDir: abs tol 0.1
      TCF_nDir: abs tol 0.1
    baseline "EI09_SWUT_MIL_MotorModeJdg_07"
      TCF_MotorMode: abs tol 0.1
      TCF_TrqDir: abs tol 0.1
      TCF_nDir: abs tol 0.1
    baseline "EI09_SWUT_MIL_MotorModeJdg_08"
      TCF_MotorMode: abs tol 0.1
      TCF_TrqDir: abs tol 0.1
      TCF_nDir: abs tol 0.1
    baseline "EI09_SWUT_MIL_MotorModeJdg_09"
      TCF_MotorMode: abs tol 0.1
      TCF_TrqDir: abs tol 0.1
      TCF_nDir: abs tol 0.1
    baseline "EI09_SWUT_MIL_MotorModeJdg_10"
      TCF_MotorMode: abs tol 0.1
      TCF_TrqDir: abs tol 0.1
      TCF_nDir: abs tol 0.1

  case "EI09_SWUT_MIL_MotorModeJdg_07" [baseline]
    model SWC_TCF, harness SWC_TCF_Harness_MotorModeJdg (for SWC_TCF/SWC_TCF_1ms_sys/CurrAgTrqCalcProc/MotorModeJdg)
    input "EI09_SWUT_MIL_MotorModeJdg_06" from TestCase_TCF.xlsx, mapped to TCF_CurrAgTrq, SWD_Spd
    input "EI09_SWUT_MIL_MotorModeJdg_07" from TestCase_TCF.xlsx, mapped to TCF_CurrAgTrq, SWD_Spd (active)
    input "EI09_SWUT_MIL_MotorModeJdg_08" from TestCase_TCF.xlsx, mapped to TCF_CurrAgTrq, SWD_Spd
    input "EI09_SWUT_MIL_MotorModeJdg_09" from TestCase_TCF.xlsx, mapped to TCF_CurrAgTrq, SWD_Spd
    input "EI09_SWUT_MIL_MotorModeJdg_10" from TestCase_TCF.xlsx, mapped to TCF_CurrAgTrq, SWD_Spd
    baseline "EI09_SWUT_MIL_MotorModeJdg_06"
      TCF_MotorMode: abs tol 0.1
      TCF_TrqDir: abs tol 0.1
      TCF_nDir: abs tol 0.1
    baseline "EI09_SWUT_MIL_MotorModeJdg_07"
      TCF_MotorMode: abs tol 0.1
      TCF_TrqDir: abs tol 0.1
      TCF_nDir: abs tol 0.1
    baseline "EI09_SWUT_MIL_MotorModeJdg_08"
      TCF_MotorMode: abs tol 0.1
      TCF_TrqDir: abs tol 0.1
      TCF_nDir: abs tol 0.1
    baseline "EI09_SWUT_MIL_MotorModeJdg_09"
      TCF_MotorMode: abs tol 0.1
      TCF_TrqDir: abs tol 0.1
      TCF_nDir: abs tol 0.1
    baseline "EI09_SWUT_MIL_MotorModeJdg_10"
      TCF_MotorMode: abs tol 0.1
      TCF_TrqDir: abs tol 0.1
      TCF_nDir: abs tol 0.1

  case "EI09_SWUT_MIL_MotorModeJdg_08" [baseline]
    model SWC_TCF, harness SWC_TCF_Harness_MotorModeJdg (for SWC_TCF/SWC_TCF_1ms_sys/CurrAgTrqCalcProc/MotorModeJdg)
    input "EI09_SWUT_MIL_MotorModeJdg_06" from TestCase_TCF.xlsx, mapped to TCF_CurrAgTrq, SWD_Spd
    input "EI09_SWUT_MIL_MotorModeJdg_07" from TestCase_TCF.xlsx, mapped to TCF_CurrAgTrq, SWD_Spd
    input "EI09_SWUT_MIL_MotorModeJdg_08" from TestCase_TCF.xlsx, mapped to TCF_CurrAgTrq, SWD_Spd (active)
    input "EI09_SWUT_MIL_MotorModeJdg_09" from TestCase_TCF.xlsx, mapped to TCF_CurrAgTrq, SWD_Spd
    input "EI09_SWUT_MIL_MotorModeJdg_10" from TestCase_TCF.xlsx, mapped to TCF_CurrAgTrq, SWD_Spd
    baseline "EI09_SWUT_MIL_MotorModeJdg_06"
      TCF_MotorMode: abs tol 0.1
      TCF_TrqDir: abs tol 0.1
      TCF_nDir: abs tol 0.1
    baseline "EI09_SWUT_MIL_MotorModeJdg_07"
      TCF_MotorMode: abs tol 0.1
      TCF_TrqDir: abs tol 0.1
      TCF_nDir: abs tol 0.1
    baseline "EI09_SWUT_MIL_MotorModeJdg_08"
      TCF_MotorMode: abs tol 0.1
      TCF_TrqDir: abs tol 0.1
      TCF_nDir: abs tol 0.1
    baseline "EI09_SWUT_MIL_MotorModeJdg_09"
      TCF_MotorMode: abs tol 0.1
      TCF_TrqDir: abs tol 0.1
      TCF_nDir: abs tol 0.1
    baseline "EI09_SWUT_MIL_MotorModeJdg_10"
      TCF_MotorMode: abs tol 0.1
      TCF_TrqDir: abs tol 0.1
      TCF_nDir: abs tol 0.1

  case "EI09_SWUT_MIL_MotorModeJdg_09" [baseline]
    model SWC_TCF, harness SWC_TCF_Harness_MotorModeJdg (for SWC_TCF/SWC_TCF_1ms_sys/CurrAgTrqCalcProc/MotorModeJdg)
    input "EI09_SWUT_MIL_MotorModeJdg_09" from TestCase_TCF.xlsx, mapped to TCF_CurrAgTrq, SWD_Spd (active)
    baseline "EI09_SWUT_MIL_MotorModeJdg_09"
      TCF_MotorMode: abs tol 0.1
      TCF_TrqDir: abs tol 0.1
      TCF_nDir: abs tol 0.1

  case "EI09_SWUT_MIL_MotorModeJdg_10" [baseline]
    model SWC_TCF, harness SWC_TCF_Harness_MotorModeJdg (for SWC_TCF/SWC_TCF_1ms_sys/CurrAgTrqCalcProc/MotorModeJdg)
    input "EI09_SWUT_MIL_MotorModeJdg_06" from TestCase_TCF.xlsx, mapped to TCF_CurrAgTrq, SWD_Spd
    input "EI09_SWUT_MIL_MotorModeJdg_07" from TestCase_TCF.xlsx, mapped to TCF_CurrAgTrq, SWD_Spd
    input "EI09_SWUT_MIL_MotorModeJdg_08" from TestCase_TCF.xlsx, mapped to TCF_CurrAgTrq, SWD_Spd
    input "EI09_SWUT_MIL_MotorModeJdg_09" from TestCase_TCF.xlsx, mapped to TCF_CurrAgTrq, SWD_Spd
    input "EI09_SWUT_MIL_MotorModeJdg_10" from TestCase_TCF.xlsx, mapped to TCF_CurrAgTrq, SWD_Spd (active)
    baseline "EI09_SWUT_MIL_MotorModeJdg_06"
      TCF_MotorMode: abs tol 0.1
      TCF_TrqDir: abs tol 0.1
      TCF_nDir: abs tol 0.1
    baseline "EI09_SWUT_MIL_MotorModeJdg_07"
      TCF_MotorMode: abs tol 0.1
      TCF_TrqDir: abs tol 0.1
      TCF_nDir: abs tol 0.1
    baseline "EI09_SWUT_MIL_MotorModeJdg_08"
      TCF_MotorMode: abs tol 0.1
      TCF_TrqDir: abs tol 0.1
      TCF_nDir: abs tol 0.1
    baseline "EI09_SWUT_MIL_MotorModeJdg_09"
      TCF_MotorMode: abs tol 0.1
      TCF_TrqDir: abs tol 0.1
      TCF_nDir: abs tol 0.1
    baseline "EI09_SWUT_MIL_MotorModeJdg_10"
      TCF_MotorMode: abs tol 0.1
      TCF_TrqDir: abs tol 0.1
      TCF_nDir: abs tol 0.1

  case "EI09_SWUT_MIL_MotorModeJdg_11" [baseline]
    model SWC_TCF, harness SWC_TCF_Harness_MotorModeJdg (for SWC_TCF/SWC_TCF_1ms_sys/CurrAgTrqCalcProc/MotorModeJdg)
    input "EI09_SWUT_MIL_MotorModeJdg_11" from TestCase_TCF.xlsx, mapped to TCF_CurrAgTrq, SWD_Spd (active)
    input "EI09_SWUT_MIL_MotorModeJdg_12" from TestCase_TCF.xlsx, mapped to TCF_CurrAgTrq, SWD_Spd
    input "EI09_SWUT_MIL_MotorModeJdg_13" from TestCase_TCF.xlsx, mapped to TCF_CurrAgTrq, SWD_Spd
    input "EI09_SWUT_MIL_MotorModeJdg_14" from TestCase_TCF.xlsx, mapped to TCF_CurrAgTrq, SWD_Spd
    baseline "EI09_SWUT_MIL_MotorModeJdg_11"
      TCF_MotorMode: abs tol 0.1
      TCF_TrqDir: abs tol 0.1
      TCF_nDir: abs tol 0.1
    baseline "EI09_SWUT_MIL_MotorModeJdg_12"
      TCF_MotorMode: abs tol 0.1
      TCF_TrqDir: abs tol 0.1
      TCF_nDir: abs tol 0.1
    baseline "EI09_SWUT_MIL_MotorModeJdg_13"
      TCF_MotorMode: abs tol 0.1
      TCF_TrqDir: abs tol 0.1
      TCF_nDir: abs tol 0.1
    baseline "EI09_SWUT_MIL_MotorModeJdg_14"
      TCF_MotorMode: abs tol 0.1
      TCF_TrqDir: abs tol 0.1
      TCF_nDir: abs tol 0.1

  case "EI09_SWUT_MIL_MotorModeJdg_12" [baseline]
    model SWC_TCF, harness SWC_TCF_Harness_MotorModeJdg (for SWC_TCF/SWC_TCF_1ms_sys/CurrAgTrqCalcProc/MotorModeJdg)
    input "EI09_SWUT_MIL_MotorModeJdg_12" from TestCase_TCF.xlsx, mapped to TCF_CurrAgTrq, SWD_Spd (active)
    baseline "EI09_SWUT_MIL_MotorModeJdg_12"
      TCF_MotorMode: abs tol 0.1
      TCF_TrqDir: abs tol 0.1
      TCF_nDir: abs tol 0.1

  case "EI09_SWUT_MIL_MotorModeJdg_13" [baseline]
    model SWC_TCF, harness SWC_TCF_Harness_MotorModeJdg (for SWC_TCF/SWC_TCF_1ms_sys/CurrAgTrqCalcProc/MotorModeJdg)
    input "EI09_SWUT_MIL_MotorModeJdg_11" from TestCase_TCF.xlsx, mapped to TCF_CurrAgTrq, SWD_Spd
    input "EI09_SWUT_MIL_MotorModeJdg_12" from TestCase_TCF.xlsx, mapped to TCF_CurrAgTrq, SWD_Spd
    input "EI09_SWUT_MIL_MotorModeJdg_13" from TestCase_TCF.xlsx, mapped to TCF_CurrAgTrq, SWD_Spd (active)
    input "EI09_SWUT_MIL_MotorModeJdg_14" from TestCase_TCF.xlsx, mapped to TCF_CurrAgTrq, SWD_Spd
    baseline "EI09_SWUT_MIL_MotorModeJdg_11"
      TCF_MotorMode: abs tol 0.1
      TCF_TrqDir: abs tol 0.1
      TCF_nDir: abs tol 0.1
    baseline "EI09_SWUT_MIL_MotorModeJdg_12"
      TCF_MotorMode: abs tol 0.1
      TCF_TrqDir: abs tol 0.1
      TCF_nDir: abs tol 0.1
    baseline "EI09_SWUT_MIL_MotorModeJdg_13"
      TCF_MotorMode: abs tol 0.1
      TCF_TrqDir: abs tol 0.1
      TCF_nDir: abs tol 0.1
    baseline "EI09_SWUT_MIL_MotorModeJdg_14"
      TCF_MotorMode: abs tol 0.1
      TCF_TrqDir: abs tol 0.1
      TCF_nDir: abs tol 0.1

  case "EI09_SWUT_MIL_MotorModeJdg_14" [baseline]
    model SWC_TCF, harness SWC_TCF_Harness_MotorModeJdg (for SWC_TCF/SWC_TCF_1ms_sys/CurrAgTrqCalcProc/MotorModeJdg)
    input "EI09_SWUT_MIL_MotorModeJdg_11" from TestCase_TCF.xlsx, mapped to TCF_CurrAgTrq, SWD_Spd
    input "EI09_SWUT_MIL_MotorModeJdg_12" from TestCase_TCF.xlsx, mapped to TCF_CurrAgTrq, SWD_Spd
    input "EI09_SWUT_MIL_MotorModeJdg_13" from TestCase_TCF.xlsx, mapped to TCF_CurrAgTrq, SWD_Spd
    input "EI09_SWUT_MIL_MotorModeJdg_14" from TestCase_TCF.xlsx, mapped to TCF_CurrAgTrq, SWD_Spd (active)
    baseline "EI09_SWUT_MIL_MotorModeJdg_11"
      TCF_MotorMode: abs tol 0.1
      TCF_TrqDir: abs tol 0.1
      TCF_nDir: abs tol 0.1
    baseline "EI09_SWUT_MIL_MotorModeJdg_12"
      TCF_MotorMode: abs tol 0.1
      TCF_TrqDir: abs tol 0.1
      TCF_nDir: abs tol 0.1
    baseline "EI09_SWUT_MIL_MotorModeJdg_13"
      TCF_MotorMode: abs tol 0.1
      TCF_TrqDir: abs tol 0.1
      TCF_nDir: abs tol 0.1
    baseline "EI09_SWUT_MIL_MotorModeJdg_14"
      TCF_MotorMode: abs tol 0.1
      TCF_TrqDir: abs tol 0.1
      TCF_nDir: abs tol 0.1

suite "LdSubLqClc"

  case "EI09_SWUT_MIL_LdSubLqClc_01" [baseline]
    model SWC_TCF, harness SWC_TCF_Harness_LdsubLqCalc (for SWC_TCF/SWC_TCF_1ms_sys/CurrAgTrqCalcProc/LdsubLqCalc)
    input "EI09_SWUT_MIL_LdsubLqCalc_01" from TestCase_TCF.xlsx, mapped to TCF_idAct, TCF_iqAct, TCF_MotorMode (active)
    baseline "EI09_SWUT_MIL_LdsubLqCalc_01"
      TCF_LdsubLq: abs tol 0.1

  case "EI09_SWUT_MIL_LdSubLqClc_02" [baseline]
    model SWC_TCF, harness SWC_TCF_Harness_LdsubLqCalc (for SWC_TCF/SWC_TCF_1ms_sys/CurrAgTrqCalcProc/LdsubLqCalc)
    input "EI09_SWUT_MIL_LdsubLqCalc_02" from TestCase_TCF.xlsx, mapped to TCF_idAct, TCF_iqAct, TCF_MotorMode (active)
    baseline "EI09_SWUT_MIL_LdsubLqCalc_02"
      TCF_LdsubLq: abs tol 0.1

suite "CurrAgTrqClc"

  case "EI09_SWUT_MIL_CurrAgTrqClc_01" [baseline]
    model SWC_TCF, harness SWC_TCF_Harness_CurrAgTrqCalc (for SWC_TCF/SWC_TCF_1ms_sys/CurrAgTrqCalcProc/CurrAgTrqCalc)
    input "EI09_SWUT_MIL_CurrAgTrqCalc_01" from TestCase_TCF.xlsx, mapped to TCF_LdsubLq, TCF_idAct, TCF_iqAct (active)
    baseline "EI09_SWUT_MIL_CurrAgTrqCalc_01"
      TCF_CurrAgTrq: abs tol 0.1

suite "TrqTube"

  case "EI09_SWUT_MIL_TrqTube_01" [baseline]
    model SWC_TCF, harness SWC_TCF_Harness_TrqTube (for SWC_TCF/SWC_TCF_1ms_sys/TrqBlendProc/TrqTube)
    input "EI09_SWUT_MIL_TrqTube_01" from TestCase_TCF.xlsx, mapped to TCF_PwrTrq, SWD_Spd, TCF_CurrAgTrq (active)
    baseline "EI09_SWUT_MIL_TrqTube_01"
      TCF_PwrTrq_TubeH: abs tol 0.1
      TCF_PwrTrq_TubeL: abs tol 0.1
      TCF_CurrAgTrq_TubeH: abs tol 0.1
      TCF_CurrAgTrq_TubeL: abs tol 0.1

suite "TrqBlend"

  case "EI09_SWUT_MIL_TrqBlend_01" [baseline]
    model SWC_TCF, harness SWC_TCF_Harness_TrqBlend (for SWC_TCF/SWC_TCF_1ms_sys/TrqBlendProc/TrqBlend)
    input "EI09_SWUT_MIL_TrqBlend_01" from TestCase_TCF.xlsx, mapped to TCF_PwrTrq_TubeH, TCF_PwrTrq_TubeL, TCF_CurrAgTrq_TubeH, TCF_CurrAgTrq_TubeL (active)
    input "EI09_SWUT_MIL_TrqBlend_02" from TestCase_TCF.xlsx, mapped to TCF_PwrTrq_TubeH, TCF_PwrTrq_TubeL, TCF_CurrAgTrq_TubeH, TCF_CurrAgTrq_TubeL
    input "EI09_SWUT_MIL_TrqBlend_03" from TestCase_TCF.xlsx, mapped to TCF_PwrTrq_TubeH, TCF_PwrTrq_TubeL, TCF_CurrAgTrq_TubeH, TCF_CurrAgTrq_TubeL
    input "EI09_SWUT_MIL_TrqBlend_04" from TestCase_TCF.xlsx, mapped to TCF_PwrTrq_TubeH, TCF_PwrTrq_TubeL, TCF_CurrAgTrq_TubeH, TCF_CurrAgTrq_TubeL
    input "EI09_SWUT_MIL_TrqBlend_05" from TestCase_TCF.xlsx, mapped to TCF_PwrTrq_TubeH, TCF_PwrTrq_TubeL, TCF_CurrAgTrq_TubeH, TCF_CurrAgTrq_TubeL
    input "EI09_SWUT_MIL_TrqBlend_06" from TestCase_TCF.xlsx, mapped to TCF_PwrTrq_TubeH, TCF_PwrTrq_TubeL, TCF_CurrAgTrq_TubeH, TCF_CurrAgTrq_TubeL
    baseline "EI09_SWUT_MIL_TrqBlend_01"
      TCF_BlendTrq: abs tol 0.1
      TCF_TrqCalcMonRslt: abs tol 0.1
    baseline "EI09_SWUT_MIL_TrqBlend_02"
      TCF_BlendTrq: abs tol 0.1
      TCF_TrqCalcMonRslt: abs tol 0.1
    baseline "EI09_SWUT_MIL_TrqBlend_03"
      TCF_BlendTrq: abs tol 0.1
      TCF_TrqCalcMonRslt: abs tol 0.1
    baseline "EI09_SWUT_MIL_TrqBlend_04"
      TCF_BlendTrq: abs tol 0.1
      TCF_TrqCalcMonRslt: abs tol 0.1
    baseline "EI09_SWUT_MIL_TrqBlend_05"
      TCF_BlendTrq: abs tol 0.1
      TCF_TrqCalcMonRslt: abs tol 0.1
    baseline "EI09_SWUT_MIL_TrqBlend_06"
      TCF_BlendTrq: abs tol 0.1
      TCF_TrqCalcMonRslt: abs tol 0.1

  case "EI09_SWUT_MIL_TrqBlend_02" [baseline]
    model SWC_TCF, harness SWC_TCF_Harness_TrqBlend (for SWC_TCF/SWC_TCF_1ms_sys/TrqBlendProc/TrqBlend)
    input "EI09_SWUT_MIL_TrqBlend_01" from TestCase_TCF.xlsx, mapped to TCF_PwrTrq_TubeH, TCF_PwrTrq_TubeL, TCF_CurrAgTrq_TubeH, TCF_CurrAgTrq_TubeL
    input "EI09_SWUT_MIL_TrqBlend_02" from TestCase_TCF.xlsx, mapped to TCF_PwrTrq_TubeH, TCF_PwrTrq_TubeL, TCF_CurrAgTrq_TubeH, TCF_CurrAgTrq_TubeL (active)
    input "EI09_SWUT_MIL_TrqBlend_03" from TestCase_TCF.xlsx, mapped to TCF_PwrTrq_TubeH, TCF_PwrTrq_TubeL, TCF_CurrAgTrq_TubeH, TCF_CurrAgTrq_TubeL
    input "EI09_SWUT_MIL_TrqBlend_04" from TestCase_TCF.xlsx, mapped to TCF_PwrTrq_TubeH, TCF_PwrTrq_TubeL, TCF_CurrAgTrq_TubeH, TCF_CurrAgTrq_TubeL
    input "EI09_SWUT_MIL_TrqBlend_05" from TestCase_TCF.xlsx, mapped to TCF_PwrTrq_TubeH, TCF_PwrTrq_TubeL, TCF_CurrAgTrq_TubeH, TCF_CurrAgTrq_TubeL
    input "EI09_SWUT_MIL_TrqBlend_06" from TestCase_TCF.xlsx, mapped to TCF_PwrTrq_TubeH, TCF_PwrTrq_TubeL, TCF_CurrAgTrq_TubeH, TCF_CurrAgTrq_TubeL
    baseline "EI09_SWUT_MIL_TrqBlend_01"
      TCF_BlendTrq: abs tol 0.1
      TCF_TrqCalcMonRslt: abs tol 0.1
    baseline "EI09_SWUT_MIL_TrqBlend_02"
      TCF_BlendTrq: abs tol 0.1
      TCF_TrqCalcMonRslt: abs tol 0.1
    baseline "EI09_SWUT_MIL_TrqBlend_03"
      TCF_BlendTrq: abs tol 0.1
      TCF_TrqCalcMonRslt: abs tol 0.1
    baseline "EI09_SWUT_MIL_TrqBlend_04"
      TCF_BlendTrq: abs tol 0.1
      TCF_TrqCalcMonRslt: abs tol 0.1
    baseline "EI09_SWUT_MIL_TrqBlend_05"
      TCF_BlendTrq: abs tol 0.1
      TCF_TrqCalcMonRslt: abs tol 0.1
    baseline "EI09_SWUT_MIL_TrqBlend_06"
      TCF_BlendTrq: abs tol 0.1
      TCF_TrqCalcMonRslt: abs tol 0.1

  case "EI09_SWUT_MIL_TrqBlend_03" [baseline]
    model SWC_TCF, harness SWC_TCF_Harness_TrqBlend (for SWC_TCF/SWC_TCF_1ms_sys/TrqBlendProc/TrqBlend)
    input "EI09_SWUT_MIL_TrqBlend_01" from TestCase_TCF.xlsx, mapped to TCF_PwrTrq_TubeH, TCF_PwrTrq_TubeL, TCF_CurrAgTrq_TubeH, TCF_CurrAgTrq_TubeL
    input "EI09_SWUT_MIL_TrqBlend_02" from TestCase_TCF.xlsx, mapped to TCF_PwrTrq_TubeH, TCF_PwrTrq_TubeL, TCF_CurrAgTrq_TubeH, TCF_CurrAgTrq_TubeL
    input "EI09_SWUT_MIL_TrqBlend_03" from TestCase_TCF.xlsx, mapped to TCF_PwrTrq_TubeH, TCF_PwrTrq_TubeL, TCF_CurrAgTrq_TubeH, TCF_CurrAgTrq_TubeL (active)
    input "EI09_SWUT_MIL_TrqBlend_04" from TestCase_TCF.xlsx, mapped to TCF_PwrTrq_TubeH, TCF_PwrTrq_TubeL, TCF_CurrAgTrq_TubeH, TCF_CurrAgTrq_TubeL
    input "EI09_SWUT_MIL_TrqBlend_05" from TestCase_TCF.xlsx, mapped to TCF_PwrTrq_TubeH, TCF_PwrTrq_TubeL, TCF_CurrAgTrq_TubeH, TCF_CurrAgTrq_TubeL
    input "EI09_SWUT_MIL_TrqBlend_06" from TestCase_TCF.xlsx, mapped to TCF_PwrTrq_TubeH, TCF_PwrTrq_TubeL, TCF_CurrAgTrq_TubeH, TCF_CurrAgTrq_TubeL
    baseline "EI09_SWUT_MIL_TrqBlend_01"
      TCF_BlendTrq: abs tol 0.1
      TCF_TrqCalcMonRslt: abs tol 0.1
    baseline "EI09_SWUT_MIL_TrqBlend_02"
      TCF_BlendTrq: abs tol 0.1
      TCF_TrqCalcMonRslt: abs tol 0.1
    baseline "EI09_SWUT_MIL_TrqBlend_03"
      TCF_BlendTrq: abs tol 0.1
      TCF_TrqCalcMonRslt: abs tol 0.1
    baseline "EI09_SWUT_MIL_TrqBlend_04"
      TCF_BlendTrq: abs tol 0.1
      TCF_TrqCalcMonRslt: abs tol 0.1
    baseline "EI09_SWUT_MIL_TrqBlend_05"
      TCF_BlendTrq: abs tol 0.1
      TCF_TrqCalcMonRslt: abs tol 0.1
    baseline "EI09_SWUT_MIL_TrqBlend_06"
      TCF_BlendTrq: abs tol 0.1
      TCF_TrqCalcMonRslt: abs tol 0.1

  case "EI09_SWUT_MIL_TrqBlend_04" [baseline]
    model SWC_TCF, harness SWC_TCF_Harness_TrqBlend (for SWC_TCF/SWC_TCF_1ms_sys/TrqBlendProc/TrqBlend)
    input "EI09_SWUT_MIL_TrqBlend_01" from TestCase_TCF.xlsx, mapped to TCF_PwrTrq_TubeH, TCF_PwrTrq_TubeL, TCF_CurrAgTrq_TubeH, TCF_CurrAgTrq_TubeL
    input "EI09_SWUT_MIL_TrqBlend_02" from TestCase_TCF.xlsx, mapped to TCF_PwrTrq_TubeH, TCF_PwrTrq_TubeL, TCF_CurrAgTrq_TubeH, TCF_CurrAgTrq_TubeL
    input "EI09_SWUT_MIL_TrqBlend_03" from TestCase_TCF.xlsx, mapped to TCF_PwrTrq_TubeH, TCF_PwrTrq_TubeL, TCF_CurrAgTrq_TubeH, TCF_CurrAgTrq_TubeL
    input "EI09_SWUT_MIL_TrqBlend_04" from TestCase_TCF.xlsx, mapped to TCF_PwrTrq_TubeH, TCF_PwrTrq_TubeL, TCF_CurrAgTrq_TubeH, TCF_CurrAgTrq_TubeL (active)
    input "EI09_SWUT_MIL_TrqBlend_05" from TestCase_TCF.xlsx, mapped to TCF_PwrTrq_TubeH, TCF_PwrTrq_TubeL, TCF_CurrAgTrq_TubeH, TCF_CurrAgTrq_TubeL
    input "EI09_SWUT_MIL_TrqBlend_06" from TestCase_TCF.xlsx, mapped to TCF_PwrTrq_TubeH, TCF_PwrTrq_TubeL, TCF_CurrAgTrq_TubeH, TCF_CurrAgTrq_TubeL
    baseline "EI09_SWUT_MIL_TrqBlend_01"
      TCF_BlendTrq: abs tol 0.1
      TCF_TrqCalcMonRslt: abs tol 0.1
    baseline "EI09_SWUT_MIL_TrqBlend_02"
      TCF_BlendTrq: abs tol 0.1
      TCF_TrqCalcMonRslt: abs tol 0.1
    baseline "EI09_SWUT_MIL_TrqBlend_03"
      TCF_BlendTrq: abs tol 0.1
      TCF_TrqCalcMonRslt: abs tol 0.1
    baseline "EI09_SWUT_MIL_TrqBlend_04"
      TCF_BlendTrq: abs tol 0.1
      TCF_TrqCalcMonRslt: abs tol 0.1
    baseline "EI09_SWUT_MIL_TrqBlend_05"
      TCF_BlendTrq: abs tol 0.1
      TCF_TrqCalcMonRslt: abs tol 0.1
    baseline "EI09_SWUT_MIL_TrqBlend_06"
      TCF_BlendTrq: abs tol 0.1
      TCF_TrqCalcMonRslt: abs tol 0.1

  case "EI09_SWUT_MIL_TrqBlend_05" [baseline]
    model SWC_TCF, harness SWC_TCF_Harness_TrqBlend (for SWC_TCF/SWC_TCF_1ms_sys/TrqBlendProc/TrqBlend)
    input "EI09_SWUT_MIL_TrqBlend_01" from TestCase_TCF.xlsx, mapped to TCF_PwrTrq_TubeH, TCF_PwrTrq_TubeL, TCF_CurrAgTrq_TubeH, TCF_CurrAgTrq_TubeL
    input "EI09_SWUT_MIL_TrqBlend_02" from TestCase_TCF.xlsx, mapped to TCF_PwrTrq_TubeH, TCF_PwrTrq_TubeL, TCF_CurrAgTrq_TubeH, TCF_CurrAgTrq_TubeL
    input "EI09_SWUT_MIL_TrqBlend_03" from TestCase_TCF.xlsx, mapped to TCF_PwrTrq_TubeH, TCF_PwrTrq_TubeL, TCF_CurrAgTrq_TubeH, TCF_CurrAgTrq_TubeL
    input "EI09_SWUT_MIL_TrqBlend_04" from TestCase_TCF.xlsx, mapped to TCF_PwrTrq_TubeH, TCF_PwrTrq_TubeL, TCF_CurrAgTrq_TubeH, TCF_CurrAgTrq_TubeL
    input "EI09_SWUT_MIL_TrqBlend_05" from TestCase_TCF.xlsx, mapped to TCF_PwrTrq_TubeH, TCF_PwrTrq_TubeL, TCF_CurrAgTrq_TubeH, TCF_CurrAgTrq_TubeL (active)
    input "EI09_SWUT_MIL_TrqBlend_06" from TestCase_TCF.xlsx, mapped to TCF_PwrTrq_TubeH, TCF_PwrTrq_TubeL, TCF_CurrAgTrq_TubeH, TCF_CurrAgTrq_TubeL
    baseline "EI09_SWUT_MIL_TrqBlend_01"
      TCF_BlendTrq: abs tol 0.1
      TCF_TrqCalcMonRslt: abs tol 0.1
    baseline "EI09_SWUT_MIL_TrqBlend_02"
      TCF_BlendTrq: abs tol 0.1
      TCF_TrqCalcMonRslt: abs tol 0.1
    baseline "EI09_SWUT_MIL_TrqBlend_03"
      TCF_BlendTrq: abs tol 0.1
      TCF_TrqCalcMonRslt: abs tol 0.1
    baseline "EI09_SWUT_MIL_TrqBlend_04"
      TCF_BlendTrq: abs tol 0.1
      TCF_TrqCalcMonRslt: abs tol 0.1
    baseline "EI09_SWUT_MIL_TrqBlend_05"
      TCF_BlendTrq: abs tol 0.1
      TCF_TrqCalcMonRslt: abs tol 0.1
    baseline "EI09_SWUT_MIL_TrqBlend_06"
      TCF_BlendTrq: abs tol 0.1
      TCF_TrqCalcMonRslt: abs tol 0.1

  case "EI09_SWUT_MIL_TrqBlend_06" [baseline]
    model SWC_TCF, harness SWC_TCF_Harness_TrqBlend (for SWC_TCF/SWC_TCF_1ms_sys/TrqBlendProc/TrqBlend)
    input "EI09_SWUT_MIL_TrqBlend_01" from TestCase_TCF.xlsx, mapped to TCF_PwrTrq_TubeH, TCF_PwrTrq_TubeL, TCF_CurrAgTrq_TubeH, TCF_CurrAgTrq_TubeL
    input "EI09_SWUT_MIL_TrqBlend_02" from TestCase_TCF.xlsx, mapped to TCF_PwrTrq_TubeH, TCF_PwrTrq_TubeL, TCF_CurrAgTrq_TubeH, TCF_CurrAgTrq_TubeL
    input "EI09_SWUT_MIL_TrqBlend_03" from TestCase_TCF.xlsx, mapped to TCF_PwrTrq_TubeH, TCF_PwrTrq_TubeL, TCF_CurrAgTrq_TubeH, TCF_CurrAgTrq_TubeL
    input "EI09_SWUT_MIL_TrqBlend_04" from TestCase_TCF.xlsx, mapped to TCF_PwrTrq_TubeH, TCF_PwrTrq_TubeL, TCF_CurrAgTrq_TubeH, TCF_CurrAgTrq_TubeL
    input "EI09_SWUT_MIL_TrqBlend_05" from TestCase_TCF.xlsx, mapped to TCF_PwrTrq_TubeH, TCF_PwrTrq_TubeL, TCF_CurrAgTrq_TubeH, TCF_CurrAgTrq_TubeL
    input "EI09_SWUT_MIL_TrqBlend_06" from TestCase_TCF.xlsx, mapped to TCF_PwrTrq_TubeH, TCF_PwrTrq_TubeL, TCF_CurrAgTrq_TubeH, TCF_CurrAgTrq_TubeL (active)
    baseline "EI09_SWUT_MIL_TrqBlend_01"
      TCF_BlendTrq: abs tol 0.1
      TCF_TrqCalcMonRslt: abs tol 0.1
    baseline "EI09_SWUT_MIL_TrqBlend_02"
      TCF_BlendTrq: abs tol 0.1
      TCF_TrqCalcMonRslt: abs tol 0.1
    baseline "EI09_SWUT_MIL_TrqBlend_03"
      TCF_BlendTrq: abs tol 0.1
      TCF_TrqCalcMonRslt: abs tol 0.1
    baseline "EI09_SWUT_MIL_TrqBlend_04"
      TCF_BlendTrq: abs tol 0.1
      TCF_TrqCalcMonRslt: abs tol 0.1
    baseline "EI09_SWUT_MIL_TrqBlend_05"
      TCF_BlendTrq: abs tol 0.1
      TCF_TrqCalcMonRslt: abs tol 0.1
    baseline "EI09_SWUT_MIL_TrqBlend_06"
      TCF_BlendTrq: abs tol 0.1
      TCF_TrqCalcMonRslt: abs tol 0.1

suite "Debouncer"

  case "EI09_SWRS_Debouncer_01" [baseline]
    model SWC_TCF, harness SWC_TCF_Harness_Debouncer (for SWC_TCF/SWC_TCF_1ms_sys/Debouncer)
    input "EI09_SWUT_MIL_Debouncer_01" from TestCase_TCF.xlsx, mapped to BooleanIN, Rst, CountTrh, DebTrh (active)
    input "EI09_SWUT_MIL_Debouncer_02" from TestCase_TCF.xlsx, mapped to BooleanIN, Rst, CountTrh, DebTrh
    input "EI09_SWUT_MIL_Debouncer_03" from TestCase_TCF.xlsx, mapped to BooleanIN, Rst, CountTrh, DebTrh
    input "EI09_SWUT_MIL_Debouncer_04" from TestCase_TCF.xlsx, mapped to BooleanIN, Rst, CountTrh, DebTrh
    input "EI09_SWUT_MIL_Debouncer_05" from TestCase_TCF.xlsx, mapped to BooleanIN, Rst, CountTrh, DebTrh
    baseline "EI09_SWUT_MIL_Debouncer_01"
      OutLock: abs tol 0.1
      Count: abs tol 0.1
      Deb: abs tol 0.1
    baseline "EI09_SWUT_MIL_Debouncer_02"
      OutLock: abs tol 0.1
      Count: abs tol 0.1
      Deb: abs tol 0.1
    baseline "EI09_SWUT_MIL_Debouncer_03"
      OutLock: abs tol 0.1
      Count: abs tol 0.1
      Deb: abs tol 0.1
    baseline "EI09_SWUT_MIL_Debouncer_04"
      OutLock: abs tol 0.1
      Count: abs tol 0.1
      Deb: abs tol 0.1
    baseline "EI09_SWUT_MIL_Debouncer_05"
      OutLock: abs tol 0.1
      Count: abs tol 0.1
      Deb: abs tol 0.1

  case "EI09_SWRS_Debouncer_1" [baseline]
    model SWC_TCF, harness SWC_TCF_Harness_Debouncer (for SWC_TCF/SWC_TCF_1ms_sys/Debouncer)
    input "EI09_SWUT_MIL_Debouncer_01" from TestCase_TCF.xlsx, mapped to BooleanIN, Rst, CountTrh, DebTrh
    input "EI09_SWUT_MIL_Debouncer_02" from TestCase_TCF.xlsx, mapped to BooleanIN, Rst, CountTrh, DebTrh (active)
    input "EI09_SWUT_MIL_Debouncer_03" from TestCase_TCF.xlsx, mapped to BooleanIN, Rst, CountTrh, DebTrh
    input "EI09_SWUT_MIL_Debouncer_04" from TestCase_TCF.xlsx, mapped to BooleanIN, Rst, CountTrh, DebTrh
    input "EI09_SWUT_MIL_Debouncer_05" from TestCase_TCF.xlsx, mapped to BooleanIN, Rst, CountTrh, DebTrh
    baseline "EI09_SWUT_MIL_Debouncer_01"
      OutLock: abs tol 0.1
      Count: abs tol 0.1
      Deb: abs tol 0.1
    baseline "EI09_SWUT_MIL_Debouncer_02"
      OutLock: abs tol 0.1
      Count: abs tol 0.1
      Deb: abs tol 0.1
    baseline "EI09_SWUT_MIL_Debouncer_03"
      OutLock: abs tol 0.1
      Count: abs tol 0.1
      Deb: abs tol 0.1
    baseline "EI09_SWUT_MIL_Debouncer_04"
      OutLock: abs tol 0.1
      Count: abs tol 0.1
      Deb: abs tol 0.1
    baseline "EI09_SWUT_MIL_Debouncer_05"
      OutLock: abs tol 0.1
      Count: abs tol 0.1
      Deb: abs tol 0.1

  case "EI09_SWRS_Debouncer_2" [baseline]
    model SWC_TCF, harness SWC_TCF_Harness_Debouncer (for SWC_TCF/SWC_TCF_1ms_sys/Debouncer)
    input "EI09_SWUT_MIL_Debouncer_01" from TestCase_TCF.xlsx, mapped to BooleanIN, Rst, CountTrh, DebTrh
    input "EI09_SWUT_MIL_Debouncer_02" from TestCase_TCF.xlsx, mapped to BooleanIN, Rst, CountTrh, DebTrh
    input "EI09_SWUT_MIL_Debouncer_03" from TestCase_TCF.xlsx, mapped to BooleanIN, Rst, CountTrh, DebTrh (active)
    input "EI09_SWUT_MIL_Debouncer_04" from TestCase_TCF.xlsx, mapped to BooleanIN, Rst, CountTrh, DebTrh
    input "EI09_SWUT_MIL_Debouncer_05" from TestCase_TCF.xlsx, mapped to BooleanIN, Rst, CountTrh, DebTrh
    baseline "EI09_SWUT_MIL_Debouncer_01"
      OutLock: abs tol 0.1
      Count: abs tol 0.1
      Deb: abs tol 0.1
    baseline "EI09_SWUT_MIL_Debouncer_02"
      OutLock: abs tol 0.1
      Count: abs tol 0.1
      Deb: abs tol 0.1
    baseline "EI09_SWUT_MIL_Debouncer_03"
      OutLock: abs tol 0.1
      Count: abs tol 0.1
      Deb: abs tol 0.1
    baseline "EI09_SWUT_MIL_Debouncer_04"
      OutLock: abs tol 0.1
      Count: abs tol 0.1
      Deb: abs tol 0.1
    baseline "EI09_SWUT_MIL_Debouncer_05"
      OutLock: abs tol 0.1
      Count: abs tol 0.1
      Deb: abs tol 0.1

  case "EI09_SWRS_Debouncer_3" [baseline]
    model SWC_TCF, harness SWC_TCF_Harness_Debouncer (for SWC_TCF/SWC_TCF_1ms_sys/Debouncer)
    input "EI09_SWUT_MIL_Debouncer_01" from TestCase_TCF.xlsx, mapped to BooleanIN, Rst, CountTrh, DebTrh
    input "EI09_SWUT_MIL_Debouncer_02" from TestCase_TCF.xlsx, mapped to BooleanIN, Rst, CountTrh, DebTrh
    input "EI09_SWUT_MIL_Debouncer_03" from TestCase_TCF.xlsx, mapped to BooleanIN, Rst, CountTrh, DebTrh
    input "EI09_SWUT_MIL_Debouncer_04" from TestCase_TCF.xlsx, mapped to BooleanIN, Rst, CountTrh, DebTrh (active)
    input "EI09_SWUT_MIL_Debouncer_05" from TestCase_TCF.xlsx, mapped to BooleanIN, Rst, CountTrh, DebTrh
    baseline "EI09_SWUT_MIL_Debouncer_01"
      OutLock: abs tol 0.1
      Count: abs tol 0.1
      Deb: abs tol 0.1
    baseline "EI09_SWUT_MIL_Debouncer_02"
      OutLock: abs tol 0.1
      Count: abs tol 0.1
      Deb: abs tol 0.1
    baseline "EI09_SWUT_MIL_Debouncer_03"
      OutLock: abs tol 0.1
      Count: abs tol 0.1
      Deb: abs tol 0.1
    baseline "EI09_SWUT_MIL_Debouncer_04"
      OutLock: abs tol 0.1
      Count: abs tol 0.1
      Deb: abs tol 0.1
    baseline "EI09_SWUT_MIL_Debouncer_05"
      OutLock: abs tol 0.1
      Count: abs tol 0.1
      Deb: abs tol 0.1

  case "EI09_SWRS_Debouncer_4" [baseline]
    model SWC_TCF, harness SWC_TCF_Harness_Debouncer (for SWC_TCF/SWC_TCF_1ms_sys/Debouncer)
    input "EI09_SWUT_MIL_Debouncer_01" from TestCase_TCF.xlsx, mapped to BooleanIN, Rst, CountTrh, DebTrh
    input "EI09_SWUT_MIL_Debouncer_02" from TestCase_TCF.xlsx, mapped to BooleanIN, Rst, CountTrh, DebTrh
    input "EI09_SWUT_MIL_Debouncer_03" from TestCase_TCF.xlsx, mapped to BooleanIN, Rst, CountTrh, DebTrh
    input "EI09_SWUT_MIL_Debouncer_04" from TestCase_TCF.xlsx, mapped to BooleanIN, Rst, CountTrh, DebTrh
    input "EI09_SWUT_MIL_Debouncer_05" from TestCase_TCF.xlsx, mapped to BooleanIN, Rst, CountTrh, DebTrh (active)
    baseline "EI09_SWUT_MIL_Debouncer_01"
      OutLock: abs tol 0.1
      Count: abs tol 0.1
      Deb: abs tol 0.1
    baseline "EI09_SWUT_MIL_Debouncer_02"
      OutLock: abs tol 0.1
      Count: abs tol 0.1
      Deb: abs tol 0.1
    baseline "EI09_SWUT_MIL_Debouncer_03"
      OutLock: abs tol 0.1
      Count: abs tol 0.1
      Deb: abs tol 0.1
    baseline "EI09_SWUT_MIL_Debouncer_04"
      OutLock: abs tol 0.1
      Count: abs tol 0.1
      Deb: abs tol 0.1
    baseline "EI09_SWUT_MIL_Debouncer_05"
      OutLock: abs tol 0.1
      Count: abs tol 0.1
      Deb: abs tol 0.1

suite "TrqCalcEnable"

  case "TrqCalEnable" [baseline]
    model SWC_TCF, harness SWC_TCF_Harness_TrqCalcEnable (for SWC_TCF/SWC_TCF_1ms_sys/TrqCalcEnable)
    input "EI09_SWUT_MIL_TrqCalcEnable_01" from TestCase_TCF.xlsx, mapped to L2Com_ModeReq (active)
    baseline "EI09_SWUT_MIL_TrqCalcEnable_01"
      Enable: abs tol 0.1