% Simulink data dictionary SWC_FRP_DataDictionary.sldd

VAR_FRP_FaultReact_b = ASAP2.Signal(StorageClass="ExportedGlobal", DataType="boolean", InitialValue="0")
VAR_FRP_FaultInfo_u32 = ASAP2.Signal(StorageClass="ExportedGlobal", DataType="uint32", InitialValue="0")
VAR_FRP_ShutoffReq_b = ASAP2.Signal(StorageClass="ExportedGlobal", DataType="boolean", InitialValue="0")
CAL_FRP_BMSVoltRngErrOutCtl_b = iEDS_Parameter.Parameter(1, DoubleProperty=0, Int32Property=int32(0), LogicalProperty=false, OnOffStringProperty="off", ColorStringProperty="red", StorageClass="iEDS_Parameter", DataType="boolean")
CAL_FRP_CurrRngErrOutCtl_b = iEDS_Parameter.Parameter(1, DoubleProperty=0, Int32Property=int32(0), LogicalProperty=false, OnOffStringProperty="off", ColorStringProperty="red", StorageClass="iEDS_Parameter", DataType="boolean")
CAL_FRP_CurrSumErrOutCtl_b = iEDS_Parameter.Parameter(1, DoubleProperty=0, Int32Property=int32(0), LogicalProperty=false, OnOffStringProperty="off", ColorStringProperty="red", StorageClass="iEDS_Parameter", DataType="boolean")
CAL_FRP_RslvRngErrOutCtl_b = iEDS_Parameter.Parameter(1, DoubleProperty=0, Int32Property=int32(0), LogicalProperty=false, OnOffStringProperty="off", ColorStringProperty="red", StorageClass="iEDS_Parameter", DataType="boolean")
CAL_FRP_RslvSqrtErrOutCtl_b = iEDS_Parameter.Parameter(1, DoubleProperty=0, Int32Property=int32(0), LogicalProperty=false, OnOffStringProperty="off", ColorStringProperty="red", StorageClass="iEDS_Parameter", DataType="boolean")
CAL_FRP_RslvExciRngErrOutCtl_b = iEDS_Parameter.Parameter(1, DoubleProperty=0, Int32Property=int32(0), LogicalProperty=false, OnOffStringProperty="off", ColorStringProperty="red", StorageClass="iEDS_Parameter", DataType="boolean")
CAL_FRP_RslvSensVolRngErrOutCtl_b = iEDS_Parameter.Parameter(1, DoubleProperty=0, Int32Property=int32(0), LogicalProperty=false, OnOffStringProperty="off", ColorStringProperty="red", StorageClass="iEDS_Parameter", DataType="boolean")
CAL_FRP_iPhasSensVolRngErrOutCtl_b = iEDS_Parameter.Parameter(1, DoubleProperty=0, Int32Property=int32(0), LogicalProperty=false, OnOffStringProperty="off", ColorStringProperty="red", StorageClass="iEDS_Parameter", DataType="boolean")
CAL_FRP_TrqCalcErrOutCtl_b = iEDS_Parameter.Parameter(1, DoubleProperty=0, Int32Property=int32(0), LogicalProperty=false, OnOffStringProperty="off", ColorStringProperty="red", StorageClass="iEDS_Parameter", DataType="boolean")
CAL_FRP_UintndSpdErrOutCtl_b = iEDS_Parameter.Parameter(1, DoubleProperty=0, Int32Property=int32(0), LogicalProperty=false, OnOffStringProperty="off", ColorStringProperty="red", StorageClass="iEDS_Parameter", DataType="boolean")
CAL_FRP_UintndTrqErrOutCtl_b = iEDS_Parameter.Parameter(1, DoubleProperty=0, Int32Property=int32(0), LogicalProperty=false, OnOffStringProperty="off", ColorStringProperty="red", StorageClass="iEDS_Parameter", DataType="boolean")
CAL_FRP_ModeReqRngErrOutCtl_b = iEDS_Parameter.Parameter(1, DoubleProperty=0, Int32Property=int32(0), LogicalProperty=false, OnOffStringProperty="off", ColorStringProperty="red", StorageClass="iEDS_Parameter", DataType="boolean")
CAL_FRP_NSetPRngErrOutCtl_b = iEDS_Parameter.Parameter(1, DoubleProperty=0, Int32Property=int32(0), LogicalProperty=false, OnOffStringProperty="off", ColorStringProperty="red", StorageClass="iEDS_Parameter", DataType="boolean")
CAL_FRP_TrqSetPRngErrOutCtl_b = iEDS_Parameter.Parameter(1, DoubleProperty=0, Int32Property=int32(0), LogicalProperty=false, OnOffStringProperty="off", ColorStringProperty="red", StorageClass="iEDS_Parameter", DataType="boolean")
CAL_FRP_OffsetRngErrrOutCtl_b = iEDS_Parameter.Parameter(1, DoubleProperty=0, Int32Property=int32(0), LogicalProperty=false, OnOffStringProperty="off", ColorStringProperty="red", StorageClass="iEDS_Parameter", DataType="boolean")
CAL_FRP_FaultReactCtl_b = iEDS_Parameter.Parameter(1, DoubleProperty=0, Int32Property=int32(0), LogicalProperty=false, OnOffStringProperty="off", ColorStringProperty="red", StorageClass="iEDS_Parameter", DataType="boolean")
CAL_FRP_VoltCmpChkErrOutCtl_b = iEDS_Parameter.Parameter(1, DoubleProperty=0, Int32Property=int32(0), LogicalProperty=false, OnOffStringProperty="off", ColorStringProperty="red", StorageClass="iEDS_Parameter", DataType="boolean")
CAL_FRP_UBRVoltRngErrOutCtl_b = iEDS_Parameter.Parameter(1, DoubleProperty=0, Int32Property=int32(0), LogicalProperty=false, OnOffStringProperty="off", ColorStringProperty="red", StorageClass="iEDS_Parameter", DataType="boolean")
CAL_FRP_18VHSVoltRngErrOutCtl_b = iEDS_Parameter.Parameter(1, DoubleProperty=0, Int32Property=int32(0), LogicalProperty=false, OnOffStringProperty="off", ColorStringProperty="red", StorageClass="iEDS_Parameter", DataType="boolean")
CAL_FRP_3V3CPLDVoltRngErrOutCtl_b = iEDS_Parameter.Parameter(1, DoubleProperty=0, Int32Property=int32(0), LogicalProperty=false, OnOffStringProperty="off", ColorStringProperty="red", StorageClass="iEDS_Parameter", DataType="boolean")
CAL_FRP_1V8CPLDVoltRngErrOutCtl_b = iEDS_Parameter.Parameter(1, DoubleProperty=0, Int32Property=int32(0), LogicalProperty=false, OnOffStringProperty="off", ColorStringProperty="red", StorageClass="iEDS_Parameter", DataType="boolean")
float64 = Simulink.AliasType(BaseType="double")
float32 = Simulink.AliasType(BaseType="single")
sint64 = Simulink.AliasType(BaseType="int64")
sint32 = Simulink.AliasType(BaseType="int32")
sint16 = Simulink.AliasType(BaseType="int16")
sint8 = Simulink.AliasType(BaseType="int8")
uint64 = Simulink.AliasType(BaseType="uint64")
uint32 = Simulink.AliasType(BaseType="uint32")
uint16 = Simulink.AliasType(BaseType="uint16")
uint8 = Simulink.AliasType(BaseType="uint8")
boolean = Simulink.AliasType(BaseType="boolean")