% Simulink data dictionary SWC_TCF_DataDictionary.sldd

VAR_TCF_PwrInputNoflt_f32 = ASAP2.Signal(StorageClass="ExportedGlobal", DataType="single", Min=-200000, Max=200000, InitialValue="0")
VAR_TCF_PwrInputflt_f32 = ASAP2.Signal(StorageClass="ExportedGlobal", DataType="single", Min=-200000, Max=200000, InitialValue="0")
VAR_TCF_IsNoflt_f32 = ASAP2.Signal(StorageClass="ExportedGlobal", DataType="single", Min=-1200, Max=1200, InitialValue="0")
VAR_TCF_Isflt_f32 = ASAP2.Signal(StorageClass="ExportedGlobal", DataType="single", Min=-1200, Max=1200, InitialValue="0")
VAR_TCF_Ploss_f32 = ASAP2.Signal(StorageClass="ExportedGlobal", DataType="single", Min=-200000, Max=200000, InitialValue="0")
VAR_TCF_PwrTrqNoflt_f32 = ASAP2.Signal(StorageClass="ExportedGlobal", DataType="single", Min=-500, Max=500, InitialValue="0")
VAR_TCF_PwrTrqfltcomp_f32 = ASAP2.Signal(StorageClass="ExportedGlobal", DataType="single", Min=-500, Max=500, InitialValue="0")
VAR_TCF_PwrTrqflt_f32 = ASAP2.Signal(StorageClass="ExportedGlobal", DataType="single", Min=-500, Max=500, InitialValue="0")
VAR_TCF_idAct_f32 = ASAP2.Signal(StorageClass="ExportedGlobal", DataType="single", Min=-1200, Max=1200, InitialValue="0")
VAR_TCF_iqAct_f32 = ASAP2.Signal(StorageClass="ExportedGlobal", DataType="single", Min=-1200, Max=1200, InitialValue="0")
VAR_TCF_MotorMode_u8 = ASAP2.Signal(StorageClass="ExportedGlobal", DataType="uint8", Min=0, Max=255, InitialValue="0")
VAR_TCF_TrqDir_u8 = ASAP2.Signal(StorageClass="ExportedGlobal", DataType="uint8", Min=0, Max=255, InitialValue="0")
VAR_TCF_nDir_u8 = ASAP2.Signal(StorageClass="ExportedGlobal", DataType="uint8", Min=0, Max=255, InitialValue="0")
VAR_TCF_LdsubLq_f32 = ASAP2.Signal(StorageClass="ExportedGlobal", DataType="single", Min=-1, Max=1, InitialValue="0")
VAR_TCF_CurrAgTrqNoflt_f32 = ASAP2.Signal(StorageClass="ExportedGlobal", DataType="single", Min=-500, Max=500, InitialValue="0")
VAR_TCF_PwrTrqTubeH1_f32 = ASAP2.Signal(StorageClass="ExportedGlobal", DataType="single", Min=-500, Max=500, InitialValue="0")
VAR_TCF_PwrTrqTubeL1_f32 = ASAP2.Signal(StorageClass="ExportedGlobal", DataType="single", Min=-500, Max=500, InitialValue="0")
VAR_TCF_CurrAgTrqTubeH1_f32 = ASAP2.Signal(StorageClass="ExportedGlobal", DataType="single", Min=-500, Max=500, InitialValue="0")
VAR_TCF_CurrAgTrqTubeL1_f32 = ASAP2.Signal(StorageClass="ExportedGlobal", DataType="single", Min=-500, Max=500, InitialValue="0")
VAR_TCF_BlendTrq_f32 = ASAP2.Signal(StorageClass="ExportedGlobal", DataType="single", Min=-500, Max=500, InitialValue="0")
VAR_TCF_TrqCalcMonRslt_b = ASAP2.Signal(StorageClass="ExportedGlobal", DataType="boolean", Min=0, Max=1, InitialValue="0")
VAR_TCF_TrqCalcErr_b = ASAP2.Signal(StorageClass="ExportedGlobal", DataType="boolean", Min=0, Max=1, InitialValue="0")
VAR_L2Sampling_DycUMon_f32 = ASAP2.Signal(StorageClass="ExportedGlobal", DataType="single", Min=0, Max=1, InitialValue="0")
VAR_L2Sampling_DycVMon_f32 = ASAP2.Signal(StorageClass="ExportedGlobal", DataType="single", Min=0, Max=1, InitialValue="0")
VAR_L2Sampling_DycWMon_f32 = ASAP2.Signal(StorageClass="ExportedGlobal", DataType="single", Min=0, Max=1, InitialValue="0")
VAR_HSPF_StrrTempFlt_f32 = ASAP2.Signal(StorageClass="ExportedGlobal", DataType="single", Min=0, Max=1, InitialValue="0")
VAR_TCF_CurrAgTrqflt_f32 = ASAP2.Signal(StorageClass="ExportedGlobal", DataType="single", Min=-500, Max=500, InitialValue="0")
VAR_TCF_iaAct_f32 = ASAP2.Signal(StorageClass="ExportedGlobal", DataType="single", Min=-1200, Max=1200, InitialValue="0")
VAR_TCF_ibAct_f32 = ASAP2.Signal(StorageClass="ExportedGlobal", DataType="single", Min=-1200, Max=1200, InitialValue="0")
VAR_TCF_PwrTrqCompCof_f32 = ASAP2.Signal(StorageClass="ExportedGlobal", DataType="single", Min=-1200, Max=1200, InitialValue="0")
GLB_TCF_CircAge_f32 = iEDS_Parameter.Parameter(360, DoubleProperty=0, Int32Property=int32(0), LogicalProperty=false, OnOffStringProperty="off", ColorStringProperty="red", StorageClass="Define", DataType="single")
GLB_TCF_MotorStop_u8 = iEDS_Parameter.Parameter(0, DoubleProperty=0, Int32Property=int32(0), LogicalProperty=false, OnOffStringProperty="off", ColorStringProperty="red", StorageClass="Define", DataType="uint8")
GLB_TCF_MotorFw_u8 = iEDS_Parameter.Parameter(1, DoubleProperty=0, Int32Property=int32(0), LogicalProperty=false, OnOffStringProperty="off", ColorStringProperty="red", StorageClass="Define", DataType="uint8")
GLB_TCF_MotorBw_u8 = iEDS_Parameter.Parameter(2, DoubleProperty=0, Int32Property=int32(0), LogicalProperty=false, OnOffStringProperty="off", ColorStringProperty="red", StorageClass="Define", DataType="uint8")
GLB_TCF_ZeroTrq_u8 = iEDS_Parameter.Parameter(0, DoubleProperty=0, Int32Property=int32(0), LogicalProperty=false, OnOffStringProperty="off", ColorStringProperty="red", StorageClass="Define", DataType="uint8")
GLB_TCF_PosvTrq_u8 = iEDS_Parameter.Parameter(1, DoubleProperty=0, Int32Property=int32(0), LogicalProperty=false, OnOffStringProperty="off", ColorStringProperty="red", StorageClass="Define", DataType="uint8")
GLB_TCF_NegvTrq_u8 = iEDS_Parameter.Parameter(2, DoubleProperty=0, Int32Property=int32(0), LogicalProperty=false, OnOffStringProperty="off", ColorStringProperty="red", StorageClass="Define", DataType="uint8")
GLB_TCF_FwELect_u8 = iEDS_Parameter.Parameter(1, DoubleProperty=0, Int32Property=int32(0), LogicalProperty=false, OnOffStringProperty="off", ColorStringProperty="red", StorageClass="Define", DataType="uint8")
GLB_TCF_BwGene_u8 = iEDS_Parameter.Parameter(2, DoubleProperty=0, Int32Property=int32(0), LogicalProperty=false, OnOffStringProperty="off", ColorStringProperty="red", StorageClass="Define", DataType="uint8")
GLB_TCF_DigtValue_u16 = iEDS_Parameter.Parameter(4096, DoubleProperty=0, Int32Property=int32(0), LogicalProperty=false, OnOffStringProperty="off", ColorStringProperty="red", StorageClass="Define", DataType="uint16")
GLB_TCF_BwELect_u8 = iEDS_Parameter.Parameter(3, DoubleProperty=0, Int32Property=int32(0), LogicalProperty=false, OnOffStringProperty="off", ColorStringProperty="red", StorageClass="Define", DataType="uint8")
GLB_TCF_FwGene_u8 = iEDS_Parameter.Parameter(4, DoubleProperty=0, Int32Property=int32(0), LogicalProperty=false, OnOffStringProperty="off", ColorStringProperty="red", StorageClass="Define", DataType="uint8")
GLB_TCF_Sixty_f32 = iEDS_Parameter.Parameter(60, DoubleProperty=0, Int32Property=int32(0), LogicalProperty=false, OnOffStringProperty="off", ColorStringProperty="red", StorageClass="Define", DataType="single")
GLB_TCF_MotorPole_u8 = iEDS_Parameter.Parameter(4, DoubleProperty=0, Int32Property=int32(0), LogicalProperty=false, OnOffStringProperty="off", ColorStringProperty="red", StorageClass="Define", DataType="uint8")
Tbl_sin_table = iEDS_Parameter.Parameter([0 0.001534355 0.003068706 0.00460305 0.006137383 0.007671702 0.009206002 0.010740281 0.012274535 0.01380876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 0], DoubleProperty=0, Int32Property=int32(0), LogicalProperty=false, OnOffStringProperty="off", ColorStringProperty="red", DataType="single")
Tbl_cos_table = iEDS_Parameter.Parameter([1 0.999998823 0.999995292 0.999989406 0.999981166 0.999970572 0.999957624 0.999942322 0.999924665 0.999904655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 1], DoubleProperty=0, Int32Property=int32(0), LogicalProperty=false, OnOffStringProperty="off", ColorStringProperty="red", DataType="single")
CAL_TCF_TrqCalcMonErrRst_b = iEDS_Parameter.Parameter(0, DoubleProperty=0, Int32Property=int32(0), LogicalProperty=false, OnOffStringProperty="off", ColorStringProperty="red", StorageClass="iEDS_Parameter", DataType="boolean", Min=0, Max=1)
CAL_TCF_TrqCalcMonCountTrh_s16 = iEDS_Parameter.Parameter(100, DoubleProperty=0, Int32Property=int32(0), LogicalProperty=false, OnOffStringProperty="off", ColorStringProperty="red", StorageClass="iEDS_Parameter", DataType="int16", Min=-200, Max=200)
CAL_TCF_TrqCalcMonDebTrh_s16 = iEDS_Parameter.Parameter(50, DoubleProperty=0, Int32Property=int32(0), LogicalProperty=false, OnOffStringProperty="off", ColorStringProperty="red", StorageClass="iEDS_Parameter", DataType="int16", Min=-200, Max=200)

CAL_TCF_PwrLossCAz_af32 = iEDS_Parameter.Parameter([1 90 346 370 416 512 691 797 1046 1175 1313 1451 2687 1826 1788 1513
 52 154 334 408 503 616 756 888 1064 1228 1361 1495 2252 1805 1855 1692
 107 222 348 464 594 718 835 982 1111 1293 1425 1554 1976 1826 1941 1878
 164 293 387 537 690 820 926 1080 1182 1372 1504 1631 1835 1884 2047 2074
 226 370 449 624 792 925 1031 1185 1276 1465 1600 1726 1807 1977 2175 2281
 292 453 532 726 902 1033 1147 1296 1390 1572 1712 1839 1872 2104 2326 2503
 364 542 633 841 1019 1148 1275 1415 1522 1694 1842 1973 2011 2262 2500 2740
 443 639 752 968 1145 1270 1415 1544 1671 1831 1990 2126 2209 2449 2700 2995
 530 744 885 1106 1280 1402 1565 1683 1834 1983 2156 2301 2451 2664 2925 3269
 625 859 1032 1255 1426 1543 1727 1834 2010 2150 2340 2496 2723 2905 3176 3564
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 ], DoubleProperty=0, Int32Property=int32(0), LogicalProperty=false, OnOffStringProperty="off", ColorStringProperty="red", StorageClass="iEDS_Parameter", DataType="single")

CAL_TCF_IsPwrLosCAx_af32 = iEDS_Parameter.Parameter([0 20 40 60 80 100 120 140 160 180 200 220 240 260 280 300 320 340 360 380 400 420 440 460 480 500 520 540 560 580 600 620 640 660 680], DoubleProperty=0, Int32Property=int32(0), LogicalProperty=false, OnOffStringProperty="off", ColorStringProperty="red", StorageClass="iEDS_Parameter", DataType="single")
CAL_TCF_NPwrLosCAy_af32 = iEDS_Parameter.Parameter([0 500 1500 2500 3500 4500 5500 6500 7500 8500 9500 10500 11500 12500 13500 14500], DoubleProperty=0, Int32Property=int32(0), LogicalProperty=false, OnOffStringProperty="off", ColorStringProperty="red", StorageClass="iEDS_Parameter", DataType="single")
CAL_TCF_TempStrPlossFact_f32 = iEDS_Parameter.Parameter(0.00312, DoubleProperty=0, Int32Property=int32(0), LogicalProperty=false, OnOffStringProperty="off", ColorStringProperty="red", StorageClass="iEDS_Parameter", DataType="single", Min=-1, Max=1)
CAL_TCF_TempStrMax_f32 = iEDS_Parameter.Parameter(180, DoubleProperty=0, Int32Property=int32(0), LogicalProperty=false, OnOffStringProperty="off", ColorStringProperty="red", StorageClass="iEDS_Parameter", DataType="single", Min=-200, Max=200)
CAL_TCF_TempStrMin_f32 = iEDS_Parameter.Parameter(-30, DoubleProperty=0, Int32Property=int32(0), LogicalProperty=false, OnOffStringProperty="off", ColorStringProperty="red", StorageClass="iEDS_Parameter", DataType="single", Min=-200, Max=200)
CAL_TCF_flgUsePlossCompa_b = iEDS_Parameter.Parameter(1, DoubleProperty=0, Int32Property=int32(0), LogicalProperty=false, OnOffStringProperty="off", ColorStringProperty="red", StorageClass="iEDS_Parameter", DataType="boolean", Min=0, Max=1)
CAL_TCF_PwrCompaIsCAy_af32 = iEDS_Parameter.Parameter([0 30 60 90 120 150 180 210 240 270 300 330 360 390 420 450 480 510 540 570 600 630 660 690 720], DoubleProperty=0, Int32Property=int32(0), LogicalProperty=false, OnOffStringProperty="off", ColorStringProperty="red", StorageClass="iEDS_Parameter", DataType="single")
CAL_TCF_PwrCompaSpdCAx_af32 = iEDS_Parameter.Parameter([0 500 1000 1500 2000 2500 3000 3500 4000 4500 5000 5500 6000 6500 7000 7500 8000 8500 9000 9500 10000 10500 11000 11500 12000 12500 13000 13500 14000 14500 15000 15500 16000], DoubleProperty=0, Int32Property=int32(0), LogicalProperty=false, OnOffStringProperty="off", ColorStringProperty="red", StorageClass="iEDS_Parameter", DataType="single")

TCF_PwrCompaGenCAz_af32 = iEDS_Parameter.Parameter([1 1 1.18 1.17 1.07 1.1 1.14 1.06 1.06 1.03 1.05 1.03 1.03 1.05 1.03 1.01 1.04 1.04 1.01 1.01 1.05 1.01 1.1 1 1
 1 1 1.19 1.08 1.07 1.11 1.14 1.06 1.06 1.03 1.04 1.02 1.03 1.05 1.03 1.01 1.04 1.04 1.01 1.02 1.04 1.01 1.09 1 1
 1 1 1.19 1.08 1.08 1.12 1.05 1.07 1.06 1.03 1.04 1.02 1.03 1.04 1.03 1.01 1.04 1.04 1.01 1.03 1.04 1.01 1.08 1 1
 1 1 1.2 1.08 1.09 1.12 1.05 1.07 1.05 1.04 1.04 1.02 1.03 1.04 1.03 1.01 1.04 1.03 1.01 1.03 1.03 1.01 1.08 1 1
 1 1 1.2 1.08 1.09 1.13 1.05 1.07 1.05 1.04 1.03 1.02 1.05 1.04 1.03 1.01 1.04 1.03 1.01 1.04 1.02 1.01 1.07 1 1
 1 1 1.21 1.08 1.1 1.14 1.06 1.08 1.05 1.04 1.03 1.02 1.05 1.04 1.02 1.08 1.04 1.02 1.01 1.04 1.02 1.01 1.06 1 1
 1 1 1.21 1.08 1.1 1.14 1.06 1.08 1.04 1.04 1.03 1.02 1.04 1.04 1.02 1.08 1.04 1.02 1.02 1.04 1.02 1.01 1.06 1 1
 1 1 1.21 1.08 1.11 1.14 1.06 1.08 1.04 1.04 1.03 1.02 1.04 1.03 1.02 1.07 1.04 1.01 1.03 1.04 1.02 1.04 1.05 1 1
 1 1 1.21 1.09 1.11 1.14 1.07 1.08 1.04 1.04 1.02 1.02 1.04 1.03 1.02 1.07 1.03 1.01 1.04 1.04 1.02 1.05 1.04 1 0.96
 1 1 1.06 1.09 1.12 1.14 1.07 1.08 1.04 1.04 1.02 1.02 1.04 1.03 1.02 1.06 1.03 1.01 1.04 1.04 1.02 1.05 1.03 1 0.99
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 ], DoubleProperty=0, Int32Property=int32(0), LogicalProperty=false, OnOffStringProperty="off", ColorStringProperty="red", DataType="single")

CAL_TCF_PwrCompaElectCAz_af32 = iEDS_Parameter.Parameter([1 1 1 1 1 1 1 1 1 1 1 1 1 1 1 1 1 1 1 1 1 1 1 1 1
 1 1 1 1 1 1 1 1 1 1 1 1 1 1 1 1 1 1 1 1 1 1 1 1 1
 1.03 1.01 1 0.99 0.98 0.97 0.96 0.95 0.94 0.93 0.92 0.91 0.9 0.9 0.89 0.88 0.88 0.87 0.87 0.86 0.86 0.86 0.86 0.85 0.85
 0.99 0.99 0.98 0.97 0.97 0.96 0.95 0.95 0.94 0.93 0.93 0.92 0.92 0.91 0.9 0.9 0.89 0.89 0.88 0.88 0.88 0.87 0.87 0.86 0.86
 1 0.99 0.99 0.98 0.97 0.97 0.96 0.95 0.95 0.94 0.94 0.93 0.93 0.92 0.92 0.91 0.91 0.9 0.9 0.89 0.89 0.88 0.88 0.88 0.88
 1 1 0.99 0.99 0.98 0.98 0.97 0.97 0.96 0.95 0.95 0.94 0.94 0.93 0.93 0.93 0.92 0.92 0.91 0.91 0.9 0.9 0.89 0.89 0.89
 1.07 1.05 1.04 1.03 1.01 1 0.99 0.98 0.97 0.96 0.95 0.94 0.94 0.93 0.92 0.92 0.92 0.91 0.91 0.91 0.91 0.91 0.91 0.91 0.91
 1.06 1.04 1.03 1.02 1.01 1 0.99 0.98 0.97 0.96 0.95 0.95 0.94 0.94 0.93 0.93 0.92 0.92 0.92 0.92 0.92 0.92 0.92 0.92 0.92
 1 1 0.99 0.99 0.98 0.98 0.97 0.97 0.96 0.96 0.96 0.95 0.95 0.95 0.95 0.94 0.94 0.94 0.94 0.94 0.94 0.94 0.94 0.94 0.94
 1.05 1.04 1.03 1.02 1.01 1 1 0.99 0.98 0.98 0.97 0.97 0.97 0.96 0.96 0.96 0.96 0.96 0.96 0.96 0.96 0.96 0.96 0.96 0.96
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 ], DoubleProperty=0, Int32Property=int32(0), LogicalProperty=false, OnOffStringProperty="off", ColorStringProperty="red", StorageClass="iEDS_Parameter", DataType="single")

CAL_TCF_PwrTrqCalcSpdThrH_f32 = iEDS_Parameter.Parameter(1100, DoubleProperty=0, Int32Property=int32(0), LogicalProperty=false, OnOffStringProperty="off", ColorStringProperty="red", StorageClass="iEDS_Parameter", DataType="single")
CAL_TCF_PwrTrqCalcSpdThrL_f32 = iEDS_Parameter.Parameter(1000, DoubleProperty=0, Int32Property=int32(0), LogicalProperty=false, OnOffStringProperty="off", ColorStringProperty="red", StorageClass="iEDS_Parameter", DataType="single")
CAL_TCF_PwrTrqCompEn_b = iEDS_Parameter.Parameter(0, DoubleProperty=0, Int32Property=int32(0), LogicalProperty=false, OnOffStringProperty="off", ColorStringProperty="red", StorageClass="iEDS_Parameter", DataType="boolean")
CAL_TCF_LoSpdDirStop_f32 = iEDS_Parameter.Parameter(-10, DoubleProperty=0, Int32Property=int32(0), LogicalProperty=false, OnOffStringProperty="off", ColorStringProperty="red", StorageClass="iEDS_Parameter", DataType="single", Min=-25000, Max=25000)
CAL_TCF_HiSpdDirStop_f32 = iEDS_Parameter.Parameter(10, DoubleProperty=0, Int32Property=int32(0), LogicalProperty=false, OnOffStringProperty="off", ColorStringProperty="red", StorageClass="iEDS_Parameter", DataType="single", Min=-25000, Max=25000)
CAL_TCF_LoTrqDirStop_f32 = iEDS_Parameter.Parameter(-3, DoubleProperty=0, Int32Property=int32(0), LogicalProperty=false, OnOffStringProperty="off", ColorStringProperty="red", StorageClass="iEDS_Parameter", DataType="single", Min=-500, Max=500)
CAL_TCF_HiTrqDirStop_f32 = iEDS_Parameter.Parameter(3, DoubleProperty=0, Int32Property=int32(0), LogicalProperty=false, OnOffStringProperty="off", ColorStringProperty="red", StorageClass="iEDS_Parameter", DataType="single", Min=-500, Max=500)

CAL_TCF_LdSubLqCAzMot_af32 = iEDS_Parameter.Parameter([-0.000220739 -0.000220739 -0.000244207 -0.000247531 -0.000250855 -0.000233007 -0.00020873 -0.000178889 -0.000141954 -0.000108923 -8.15315e-05 -4.729e-05 -1.41975e-05 -3.03244e-05 4.95807e-05
 -0.000229336 -0.000229336 -0.000244207 -0.000247531 -0.000250855 -0.000233007 -0.00020873 -0.000178889 -0.000141954 -0.000108923 -8.15315e-05 -4.729e-05 -1.41975e-05 -3.03244e-05 4.95807e-05
 -0.000237934 -0.000237934 -0.000241111 -0.000252222 -0.000263333 -0.000241765 -0.000218889 -0.000187333 -0.000156437 -0.00013202 -0.000106577 -8.28455e-05 -5.51852e-05 -4.90058e-05 -1.1761e-05
 -0.000246531 -0.000246531 -0.000264815 -0.000273868 -0.000267379 -0.000244336 -0.000223898 -0.000195185 -0.000169285 -0.000149663 -0.000127277 -0.000105194 -8.95062e-05 -6.76871e-05 -5.44025e-05
 -0.000255128 -0.000255128 -0.000255128 -0.0002651 -0.000266963 -0.000243816 -0.000222161 -0.000199744 -0.000175995 -0.000154895 -0.000133853 -0.00011848 -0.000100427 -8.63684e-05 -7.22545e-05
 -0.000263725 -0.000263725 -0.000257843 -0.000263725 -0.000257692 -0.000244694 -0.000223109 -0.000202941 -0.000180223 -0.000159447 -0.000139984 -0.000124558 -0.000107298 -9.46579e-05 -8.13356e-05
 -0.000242593 -0.000242593 -0.000256349 -0.000258466 -0.000255006 -0.00024057 -0.00022294 -0.000203016 -0.000180651 -0.000161785 -0.000143779 -0.000127158 -0.00011261 -9.93035e-05 -8.68074e-05
 -0.000248222 -0.000248222 -0.000255333 -0.000257111 -0.000250103 -0.000238157 -0.000220286 -0.000201733 -0.000181862 -0.000162566 -0.000145459 -0.00012974 -0.000116519 -0.000102735 -9.06541e-05
 -0.000238889 -0.000238889 -0.000251149 -0.000252299 -0.000246552 -0.000233705 -0.000218363 -0.000200345 -0.000180163 -0.000164699 -0.000147297 -0.00013245 -0.000118327 -0.000105454 -9.31143e-05
 -0.000245286 -0.000245286 -0.00025101 -0.000249214 -0.000243473 -0.000231224 -0.000215224 -0.000196667 -0.00017992 -0.000161111 -0.000145141 -0.00012896 -0.000117452 -0.000104319 -9.25958e-05
 -0.000259309 -0.000259309 -0.000248198 -0.000246797 -0.000236556 -0.00022504 -0.000211476 -0.000195946 -0.000178487 -0.000161439 -0.00014552 -0.000132487 -0.000118969 -0.000105451 -9.20772e-05
 -0.000239431 -0.000239431 -0.000241057 -0.000238979 -0.000234115 -0.000222692 -0.000207491 -0.000193577 -0.000177054 -0.000161826 -0.000146155 -0.000131757 -0.000120009 -0.000107773 -9.15587e-05
 -0.000239136 -0.000239136 -0.000237407 -0.000234198 -0.00022641 -0.000216405 -0.000204744 -0.000189852 -0.000174725 -0.000160909 -0.000145976 -0.000132331 -0.000119877 -0.000110095 -9.10402e-05
 -0.000235488 -0.000235488 -0.000237075 -0.000232842 -0.000221272 -0.000212145 -0.000200826 -0.000187551 -0.000173598 -0.000159318 -0.000145459 -0.000132147 -0.000119744 -0.000112417 -9.05217e-05
 -0.00023239 -0.00023239 -0.000227358 -0.000222257 -0.000216425 -0.000207788 -0.000195702 -0.000183711 -0.000170147 -0.000157871 -0.000144941 -0.000131963 -0.000119612 -0.000114739 -9.00032e-05
 -0.000235575 -0.000235575 -0.000227193 -0.000215107 -0.000211583 -0.00020129 -0.00019088 -0.000179357 -0.000167282 -0.000156425 -0.000144424 -0.00013178 -0.000119479 -0.000117061 -8.94846e-05
 -0.000221038 -0.000221038 -0.000219945 -0.000210716 -0.000204435 -0.000195966 -0.00018617 -0.000175003 -0.000164416 -0.000154978 -0.000143907 -0.000131596 -0.000119347 -0.000119383 -8.89661e-05
 -0.000232222 -0.000232222 -0.000214103 -0.000204017 -0.000197286 -0.000190642 -0.000181459 -0.000170649 -0.00016155 -0.000153532 -0.00014339 -0.000131413 -0.000119214 -0.000121705 -8.84476e-05], DoubleProperty=0, Int32Property=int32(0), LogicalProperty=false, OnOffStringProperty="off", ColorStringProperty="red", StorageClass="iEDS_Parameter", DataType="single")

CAL_TCF_LdSubLqCAzGen_af32 = iEDS_Parameter.Parameter([-0.000220739 -0.000220739 -0.000244207 -0.000247531 -0.000250855 -0.000233007 -0.00020873 -0.000178889 -0.000141954 -0.000108923 -8.15315e-05 -4.729e-05 -1.41975e-05 -3.03244e-05 4.95807e-05
 -0.000512963 -0.000512963 -0.000438889 -0.000389506 -0.000374786 -0.000337582 -0.000298677 -0.000256667 -0.000216667 -0.000176263 -0.000141592 -0.000102846 -6.7284e-05 -3.07256e-05 7.65199e-06
 -0.00043 -0.00043 -0.000383333 -0.000344815 -0.000327436 -0.000302549 -0.000269683 -0.000234 -0.000203563 -0.000173434 -0.000142613 -0.000116992 -9e-05 -6.53741e-05 -4.06918e-05
 -0.000374691 -0.000374691 -0.000327778 -0.000319136 -0.000302991 -0.000282462 -0.00025388 -0.000224815 -0.000196743 -0.00017211 -0.000149299 -0.000127778 -0.000108436 -8.9607e-05 -7.18728e-05
 -0.000349145 -0.000349145 -0.000324359 -0.000304986 -0.000290631 -0.000271719 -0.000247192 -0.000220769 -0.000195889 -0.000172378 -0.000151871 -0.000132864 -0.000116097 -9.91889e-05 -8.43493e-05
 -0.000325817 -0.000325817 -0.000310784 -0.000296405 -0.000287858 -0.000264879 -0.000242717 -0.000218235 -0.000195098 -0.000173113 -0.000153498 -0.000135557 -0.000118192 -0.000103461 -9.11395e-05
 -0.000314021 -0.000314021 -0.000297619 -0.000284921 -0.000273321 -0.000251307 -0.000236924 -0.000213492 -0.000192693 -0.000170924 -0.00015236 -0.00013645 -0.000121076 -0.00010643 -9.4145e-05
 -0.000299333 -0.000299333 -0.000288667 -0.000277852 -0.000265487 -0.000250314 -0.000232349 -0.0002124 -0.000191747 -0.000172263 -0.000155009 -0.00013852 -0.000121852 -0.000110354 -9.75723e-05
 -0.000290613 -0.000290613 -0.000279885 -0.00026954 -0.000258046 -0.000244523 -0.000227668 -0.00020977 -0.000190666 -0.000171839 -0.000154753 -0.000139319 -0.000124457 -0.000111201 -9.97289e-05
 -0.000284007 -0.000284007 -0.000271212 -0.000263244 -0.000252797 -0.000239542 -0.000224122 -0.000207172 -0.000190369 -0.000171671 -0.000155378 -0.000139677 -0.000125533 -0.00011308 -0.000102125
 -0.000263814 -0.000263814 -0.000271622 -0.000255806 -0.000244872 -0.000233519 -0.000219198 -0.000203514 -0.000187496 -0.000170584 -0.000154651 -0.000139629 -0.000126476 -0.000114368 -0.000104521
 -0.000243496 -0.000243496 -0.000254878 -0.000248013 -0.000239118 -0.000227714 -0.000214266 -0.00019878 -0.000184202 -0.000168354 -0.000153735 -0.000139788 -0.00012579 -0.000114659 -0.000106917
 -0.000260123 -0.000260123 -0.000249259 -0.000239547 -0.000231823 -0.000221416 -0.000208624 -0.00019563 -0.000181239 -0.000166633 -0.000152583 -0.000139286 -0.000126461 -0.000116946 -0.000109313
 -0.000254762 -0.000254762 -0.000239116 -0.000232842 -0.000224411 -0.000215546 -0.000204389 -0.000191905 -0.000178525 -0.00016478 -0.000151618 -0.000138618 -0.000124418 -0.000118234 -0.000111709
 -0.00023239 -0.00023239 -0.000236792 -0.000225402 -0.000217634 -0.000209267 -0.000198547 -0.000187358 -0.00017481 -0.000162064 -0.000150277 -0.000138283 -0.000123732 -0.000119523 -0.000114106
 -0.000210234 -0.000210234 -0.000212573 -0.000212508 -0.000208659 -0.000201978 -0.000192133 -0.000184386 -0.000172121 -0.000161075 -0.000149124 -0.000137782 -0.000123046 -0.000120812 -0.000116502
 -0.000201002 -0.000201002 -0.000204098 -0.000204948 -0.000200862 -0.000194519 -0.000190593 -0.000181413 -0.000169433 -0.000159223 -0.000147971 -0.00013728 -0.00012236 -0.0001221 -0.000118898
 -0.000189487 -0.000189487 -0.000195641 -0.00019661 -0.00019071 -0.000187399 -0.000179304 -0.000178441 -0.000166744 -0.00015737 -0.000146818 -0.000136779 -0.000121674 -0.000123389 -0.000121294], DoubleProperty=0, Int32Property=int32(0), LogicalProperty=false, OnOffStringProperty="off", ColorStringProperty="red", StorageClass="iEDS_Parameter", DataType="single")

CAL_TCF_LdSubLqIdCAx_af32 = iEDS_Parameter.Parameter([0 30 50 90 130 170 210 250 290 330 370 410 450 490 530 570 610 650], DoubleProperty=0, Int32Property=int32(0), LogicalProperty=false, OnOffStringProperty="off", ColorStringProperty="red", StorageClass="iEDS_Parameter", DataType="single")
CAL_TCF_LdSubLqIqCAy_af32 = iEDS_Parameter.Parameter([0 30 50 90 130 170 210 250 290 330 370 410 450 490 530], DoubleProperty=0, Int32Property=int32(0), LogicalProperty=false, OnOffStringProperty="off", ColorStringProperty="red", StorageClass="iEDS_Parameter", DataType="single")
CAL_TCF_MotorPole_u8 = iEDS_Parameter.Parameter(4, DoubleProperty=0, Int32Property=int32(0), LogicalProperty=false, OnOffStringProperty="off", ColorStringProperty="red", StorageClass="iEDS_Parameter", DataType="uint8", Min=0, Max=255)
CAL_TCF_Psi_f32 = iEDS_Parameter.Parameter(0.0485, DoubleProperty=0, Int32Property=int32(0), LogicalProperty=false, OnOffStringProperty="off", ColorStringProperty="red", StorageClass="iEDS_Parameter", DataType="single", Min=0, Max=10)
CAL_TCF_CurrTrqCutOffFrq_f32 = iEDS_Parameter.Parameter(5, DoubleProperty=0, Int32Property=int32(0), LogicalProperty=false, OnOffStringProperty="off", ColorStringProperty="red", StorageClass="iEDS_Parameter", DataType="single")
CAL_TCF_PwrTrqTubeCAy_af32 = iEDS_Parameter.Parameter([50 50 50 50 50 50 45 40 35 30 25 20 20 20 20 20 20 20], DoubleProperty=0, Int32Property=int32(0), LogicalProperty=false, OnOffStringProperty="off", ColorStringProperty="red", StorageClass="iEDS_Parameter", DataType="single")
CAL_TCF_AgTrqTubeCAy_af32 = iEDS_Parameter.Parameter([30 30 30 30 35 35 35 35 35 40 45 50 50 50 50 50 50 50], DoubleProperty=0, Int32Property=int32(0), LogicalProperty=false, OnOffStringProperty="off", ColorStringProperty="red", StorageClass="iEDS_Parameter", DataType="single")
CAL_TCF_TrqTubeNCAx_af32 = iEDS_Parameter.Parameter([0 1000 2000 3000 4000 5000 6000 7000 8000 9000 10000 11000 12000 13000 14000 15000 16000 17000], DoubleProperty=0, Int32Property=int32(0), LogicalProperty=false, OnOffStringProperty="off", ColorStringProperty="red", StorageClass="iEDS_Parameter", DataType="single")
CAL_TCF_TrqInvalid_s16 = iEDS_Parameter.Parameter(32767, DoubleProperty=0, Int32Property=int32(0), LogicalProperty=false, OnOffStringProperty="off", ColorStringProperty="red", StorageClass="iEDS_Parameter", DataType="int16", Min=-32767, Max=32767)
CAL_TCF_SpeedCtlMode_u8 = iEDS_Parameter.Parameter(7, DoubleProperty=0, Int32Property=int32(0), LogicalProperty=false, OnOffStringProperty="off", ColorStringProperty="red", StorageClass="iEDS_Parameter", DataType="uint8", Min=0, Max=255)
PRV_CalFltFrq_1ms = iEDS_Parameter.Parameter(1000, DoubleProperty=0, Int32Property=int32(0), LogicalProperty=false, OnOffStringProperty="off", ColorStringProperty="red", StorageClass="iEDS_Parameter", DataType="uint16")
PRV_IsCalFltFrq_1ms = iEDS_Parameter.Parameter(1000, DoubleProperty=0, Int32Property=int32(0), LogicalProperty=false, OnOffStringProperty="off", ColorStringProperty="red", StorageClass="iEDS_Parameter", DataType="uint16")
PRV_PwrCalFltFrq_1ms = iEDS_Parameter.Parameter(1000, DoubleProperty=0, Int32Property=int32(0), LogicalProperty=false, OnOffStringProperty="off", ColorStringProperty="red", StorageClass="iEDS_Parameter", DataType="uint16")
CAL_TCF_IsCutOffFrq_f32 = iEDS_Parameter.Parameter(20, DoubleProperty=0, Int32Property=int32(0), LogicalProperty=false, OnOffStringProperty="off", ColorStringProperty="red", StorageClass="iEDS_Parameter", DataType="single")
CAL_TCF_PwrInputCutOffFrq_f32 = iEDS_Parameter.Parameter(50, DoubleProperty=0, Int32Property=int32(0), LogicalProperty=false, OnOffStringProperty="off", ColorStringProperty="red", StorageClass="iEDS_Parameter", DataType="single")
CAL_TCF_PwrTrqCutOffFrq_f32 = iEDS_Parameter.Parameter(50, DoubleProperty=0, Int32Property=int32(0), LogicalProperty=false, OnOffStringProperty="off", ColorStringProperty="red", StorageClass="iEDS_Parameter", DataType="single")
float64 = Simulink.AliasType(BaseType="double")
float32 = Simulink.AliasType(BaseType="single")
sint64 = Simulink.AliasType(BaseType="int64")
sint32 = Simulink.AliasType(BaseType="int32")
sint16 = Simulink.AliasType(BaseType="int16")
sint8 = Simulink.AliasType(BaseType="int8")
uint64 = Simulink.AliasType(BaseType="uint64")
uint32 = Simulink.AliasType(BaseType="uint32")
uint16 = Simulink.AliasType(BaseType="uint16")
uint8 = Simulink.AliasType(BaseType="uint8")
boolean = Simulink.AliasType(BaseType="boolean")