test file "MILTest_TRSP"
  coverage: Decision, MCDC, Condition

suite "RngChk"

  case "EI09_SWUT_MIL_RngChk_01" [baseline]
    model SWC_TRSP, harness SWC_TRSP_Harness_RngChk (for SWC_TRSP/SWC_TRSP_100us_sys/CurrChk/RngChk)
    input "EI09_SWUT_MIL_RngChk_01" from TestCase_TRSP.xlsx, mapped to TRSP_RngChkVal, TRSP_HiTrh, TRSP_LoTrh (active)
    input "EI09_SWUT_MIL_RngChk_02" from TestCase_TRSP.xlsx, mapped to TRSP_RngChkVal, TRSP_HiTrh, TRSP_LoTrh
    input "EI09_SWUT_MIL_RngChk_03" from TestCase_TRSP.xlsx, mapped to TRSP_RngChkVal, TRSP_HiTrh, TRSP_LoTrh
    input "EI09_SWUT_MIL_RngChk_04" from TestCase_TRSP.xlsx, mapped to TRSP_RngChkVal, TRSP_HiTrh, TRSP_LoTrh
    input "EI09_SWUT_MIL_RngChk_05" from TestCase_TRSP.xlsx, mapped to TRSP_RngChkVal, TRSP_HiTrh, TRSP_LoTrh
    baseline "EI09_SWUT_MIL_RngChk_01"
      TRSP_RngChkRslt: abs tol 1
    baseline "EI09_SWUT_MIL_RngChk_02"
      TRSP_RngChkRslt: abs tol 1
    baseline "EI09_SWUT_MIL_RngChk_03"
      TRSP_RngChkRslt: abs tol 1
    baseline "EI09_SWUT_MIL_RngChk_04"
      TRSP_RngChkRslt: abs tol 1
    baseline "EI09_SWUT_MIL_RngChk_05"
      TRSP_RngChkRslt: abs tol 1

  case "EI09_SWUT_MIL_RngChk_02" [baseline]
    model SWC_TRSP, harness SWC_TRSP_Harness_RngChk (for SWC_TRSP/SWC_TRSP_100us_sys/CurrChk/RngChk)
    input "EI09_SWUT_MIL_RngChk_01" from TestCase_TRSP.xlsx, mapped to TRSP_RngChkVal, TRSP_HiTrh, TRSP_LoTrh
    input "EI09_SWUT_MIL_RngChk_02" from TestCase_TRSP.xlsx, mapped to TRSP_RngChkVal, TRSP_HiTrh, TRSP_LoTrh (active)
    input "EI09_SWUT_MIL_RngChk_03" from TestCase_TRSP.xlsx, mapped to TRSP_RngChkVal, TRSP_HiTrh, TRSP_LoTrh
    input "EI09_SWUT_MIL_RngChk_04" from TestCase_TRSP.xlsx, mapped to TRSP_RngChkVal, TRSP_HiTrh, TRSP_LoTrh
    input "EI09_SWUT_MIL_RngChk_05" from TestCase_TRSP.xlsx, mapped to TRSP_RngChkVal, TRSP_HiTrh, TRSP_LoTrh
    baseline "EI09_SWUT_MIL_RngChk_02"
      TRSP_RngChkRslt: abs tol 1

  case "EI09_SWUT_MIL_RngChk_03" [baseline]
    model SWC_TRSP, harness SWC_TRSP_Harness_RngChk (for SWC_TRSP/SWC_TRSP_100us_sys/CurrChk/RngChk)
    input "EI09_SWUT_MIL_RngChk_01" from TestCase_TRSP.xlsx, mapped to TRSP_RngChkVal, TRSP_HiTrh, TRSP_LoTrh
    input "EI09_SWUT_MIL_RngChk_02" from TestCase_TRSP.xlsx, mapped to TRSP_RngChkVal, TRSP_HiTrh, TRSP_LoTrh
    input "EI09_SWUT_MIL_RngChk_03" from TestCase_TRSP.xlsx, mapped to TRSP_RngChkVal, TRSP_HiTrh, TRSP_LoTrh (active)
    input "EI09_SWUT_MIL_RngChk_04" from TestCase_TRSP.xlsx, mapped to TRSP_RngChkVal, TRSP_HiTrh, TRSP_LoTrh
    input "EI09_SWUT_MIL_RngChk_05" from TestCase_TRSP.xlsx, mapped to TRSP_RngChkVal, TRSP_HiTrh, TRSP_LoTrh
    baseline "EI09_SWUT_MIL_RngChk_01"
      TRSP_RngChkRslt: abs tol 1
    baseline "EI09_SWUT_MIL_RngChk_02"
      TRSP_RngChkRslt: abs tol 1
    baseline "EI09_SWUT_MIL_RngChk_03"
      TRSP_RngChkRslt: abs tol 1
    baseline "EI09_SWUT_MIL_RngChk_04"
      TRSP_RngChkRslt: abs tol 1
    baseline "EI09_SWUT_MIL_RngChk_05"
      TRSP_RngChkRslt: abs tol 1

  case "EI09_SWUT_MIL_RngChk_04" [baseline]
    model SWC_TRSP, harness SWC_TRSP_Harness_RngChk (for SWC_TRSP/SWC_TRSP_100us_sys/CurrChk/RngChk)
    input "EI09_SWUT_MIL_RngChk_01" from TestCase_TRSP.xlsx, mapped to TRSP_RngChkVal, TRSP_HiTrh, TRSP_LoTrh
    input "EI09_SWUT_MIL_RngChk_02" from TestCase_TRSP.xlsx, mapped to TRSP_RngChkVal, TRSP_HiTrh, TRSP_LoTrh
    input "EI09_SWUT_MIL_RngChk_03" from TestCase_TRSP.xlsx, mapped to TRSP_RngChkVal, TRSP_HiTrh, TRSP_LoTrh
    input "EI09_SWUT_MIL_RngChk_04" from TestCase_TRSP.xlsx, mapped to TRSP_RngChkVal, TRSP_HiTrh, TRSP_LoTrh (active)
    input "EI09_SWUT_MIL_RngChk_05" from TestCase_TRSP.xlsx, mapped to TRSP_RngChkVal, TRSP_HiTrh, TRSP_LoTrh
    baseline "EI09_SWUT_MIL_RngChk_01"
      TRSP_RngChkRslt: abs tol 1
    baseline "EI09_SWUT_MIL_RngChk_02"
      TRSP_RngChkRslt: abs tol 1
    baseline "EI09_SWUT_MIL_RngChk_03"
      TRSP_RngChkRslt: abs tol 1
    baseline "EI09_SWUT_MIL_RngChk_04"
      TRSP_RngChkRslt: abs tol 1
    baseline "EI09_SWUT_MIL_RngChk_05"
      TRSP_RngChkRslt: abs tol 1

  case "EI09_SWUT_MIL_RngChk_05" [baseline]
    model SWC_TRSP, harness SWC_TRSP_Harness_RngChk (for SWC_TRSP/SWC_TRSP_100us_sys/CurrChk/RngChk)
    input "EI09_SWUT_MIL_RngChk_01" from TestCase_TRSP.xlsx, mapped to TRSP_RngChkVal, TRSP_HiTrh, TRSP_LoTrh
    input "EI09_SWUT_MIL_RngChk_02" from TestCase_TRSP.xlsx, mapped to TRSP_RngChkVal, TRSP_HiTrh, TRSP_LoTrh
    input "EI09_SWUT_MIL_RngChk_03" from TestCase_TRSP.xlsx, mapped to TRSP_RngChkVal, TRSP_HiTrh, TRSP_LoTrh
    input "EI09_SWUT_MIL_RngChk_04" from TestCase_TRSP.xlsx, mapped to TRSP_RngChkVal, TRSP_HiTrh, TRSP_LoTrh
    input "EI09_SWUT_MIL_RngChk_05" from TestCase_TRSP.xlsx, mapped to TRSP_RngChkVal, TRSP_HiTrh, TRSP_LoTrh (active)
    baseline "EI09_SWUT_MIL_RngChk_01"
      TRSP_RngChkRslt: abs tol 1
    baseline "EI09_SWUT_MIL_RngChk_02"
      TRSP_RngChkRslt: abs tol 1
    baseline "EI09_SWUT_MIL_RngChk_03"
      TRSP_RngChkRslt: abs tol 1
    baseline "EI09_SWUT_MIL_RngChk_04"
      TRSP_RngChkRslt: abs tol 1
    baseline "EI09_SWUT_MIL_RngChk_05"
      TRSP_RngChkRslt: abs tol 1

suite "CurrSumChk"

  case "EI09_SWUT_MIL_CurrSumChk_01" [baseline]
    model SWC_TRSP, harness SWC_TRSP_Harness_CurrSumChk (for SWC_TRSP/SWC_TRSP_100us_sys/CurrChk/CurrSumChk)
    input "EI09_SWUT_MIL_CurrSumChk_01" from TestCase_TRSP.xlsx, mapped to TRSP_iU, TRSP_iV, TRSP_iW (active)
    input "EI09_SWUT_MIL_CurrSumChk_02" from TestCase_TRSP.xlsx, mapped to TRSP_iU, TRSP_iV, TRSP_iW
    input "EI09_SWUT_MIL_CurrSumChk_03" from TestCase_TRSP.xlsx, mapped to TRSP_iU, TRSP_iV, TRSP_iW
    input "EI09_SWUT_MIL_CurrSumChk_04" from TestCase_TRSP.xlsx, mapped to TRSP_iU, TRSP_iV, TRSP_iW
    input "EI09_SWUT_MIL_CurrSumChk_05" from TestCase_TRSP.xlsx, mapped to TRSP_iU, TRSP_iV, TRSP_iW
    baseline "EI09_SWUT_MIL_CurrSumChk_01"
      TRSP_CurrSumChkRslt: abs tol 1
    baseline "EI09_SWUT_MIL_CurrSumChk_02"
      TRSP_CurrSumChkRslt: abs tol 1
    baseline "EI09_SWUT_MIL_CurrSumChk_03"
      TRSP_CurrSumChkRslt: abs tol 1
    baseline "EI09_SWUT_MIL_CurrSumChk_04"
      TRSP_CurrSumChkRslt: abs tol 1
    baseline "EI09_SWUT_MIL_CurrSumChk_05"
      TRSP_CurrSumChkRslt: abs tol 1

  case "EI09_SWUT_MIL_CurrSumChk_02" [baseline]
    model SWC_TRSP, harness SWC_TRSP_Harness_CurrSumChk (for SWC_TRSP/SWC_TRSP_100us_sys/CurrChk/CurrSumChk)
    input "EI09_SWUT_MIL_CurrSumChk_01" from TestCase_TRSP.xlsx, mapped to TRSP_iU, TRSP_iV, TRSP_iW
    input "EI09_SWUT_MIL_CurrSumChk_02" from TestCase_TRSP.xlsx, mapped to TRSP_iU, TRSP_iV, TRSP_iW (active)
    input "EI09_SWUT_MIL_CurrSumChk_03" from TestCase_TRSP.xlsx, mapped to TRSP_iU, TRSP_iV, TRSP_iW
    input "EI09_SWUT_MIL_CurrSumChk_04" from TestCase_TRSP.xlsx, mapped to TRSP_iU, TRSP_iV, TRSP_iW
    input "EI09_SWUT_MIL_CurrSumChk_05" from TestCase_TRSP.xlsx, mapped to TRSP_iU, TRSP_iV, TRSP_iW
    baseline "EI09_SWUT_MIL_CurrSumChk_01"
      TRSP_CurrSumChkRslt: abs tol 1
    baseline "EI09_SWUT_MIL_CurrSumChk_02"
      TRSP_CurrSumChkRslt: abs tol 1
    baseline "EI09_SWUT_MIL_CurrSumChk_03"
      TRSP_CurrSumChkRslt: abs tol 1
    baseline "EI09_SWUT_MIL_CurrSumChk_04"
      TRSP_CurrSumChkRslt: abs tol 1
    baseline "EI09_SWUT_MIL_CurrSumChk_05"
      TRSP_CurrSumChkRslt: abs tol 1

  case "EI09_SWUT_MIL_CurrSumChk_03" [baseline]
    model SWC_TRSP, harness SWC_TRSP_Harness_CurrSumChk (for SWC_TRSP/SWC_TRSP_100us_sys/CurrChk/CurrSumChk)
    input "EI09_SWUT_MIL_CurrSumChk_01" from TestCase_TRSP.xlsx, mapped to TRSP_iU, TRSP_iV, TRSP_iW
    input "EI09_SWUT_MIL_CurrSumChk_02" from TestCase_TRSP.xlsx, mapped to TRSP_iU, TRSP_iV, TRSP_iW
    input "EI09_SWUT_MIL_CurrSumChk_03" from TestCase_TRSP.xlsx, mapped to TRSP_iU, TRSP_iV, TRSP_iW (active)
    input "EI09_SWUT_MIL_CurrSumChk_04" from TestCase_TRSP.xlsx, mapped to TRSP_iU, TRSP_iV, TRSP_iW
    input "EI09_SWUT_MIL_CurrSumChk_05" from TestCase_TRSP.xlsx, mapped to TRSP_iU, TRSP_iV, TRSP_iW
    baseline "EI09_SWUT_MIL_CurrSumChk_01"
      TRSP_CurrSumChkRslt: abs tol 1
    baseline "EI09_SWUT_MIL_CurrSumChk_02"
      TRSP_CurrSumChkRslt: abs tol 1
    baseline "EI09_SWUT_MIL_CurrSumChk_03"
      TRSP_CurrSumChkRslt: abs tol 1
    baseline "EI09_SWUT_MIL_CurrSumChk_04"
      TRSP_CurrSumChkRslt: abs tol 1
    baseline "EI09_SWUT_MIL_CurrSumChk_05"
      TRSP_CurrSumChkRslt: abs tol 1

  case "EI09_SWUT_MIL_CurrSumChk_04" [baseline]
    model SWC_TRSP, harness SWC_TRSP_Harness_CurrSumChk (for SWC_TRSP/SWC_TRSP_100us_sys/CurrChk/CurrSumChk)
    input "EI09_SWUT_MIL_CurrSumChk_01" from TestCase_TRSP.xlsx, mapped to TRSP_iU, TRSP_iV, TRSP_iW
    input "EI09_SWUT_MIL_CurrSumChk_02" from TestCase_TRSP.xlsx, mapped to TRSP_iU, TRSP_iV, TRSP_iW
    input "EI09_SWUT_MIL_CurrSumChk_03" from TestCase_TRSP.xlsx, mapped to TRSP_iU, TRSP_iV, TRSP_iW
    input "EI09_SWUT_MIL_CurrSumChk_04" from TestCase_TRSP.xlsx, mapped to TRSP_iU, TRSP_iV, TRSP_iW (active)
    input "EI09_SWUT_MIL_CurrSumChk_05" from TestCase_TRSP.xlsx, mapped to TRSP_iU, TRSP_iV, TRSP_iW
    baseline "EI09_SWUT_MIL_CurrSumChk_01"
      TRSP_CurrSumChkRslt: abs tol 1
    baseline "EI09_SWUT_MIL_CurrSumChk_02"
      TRSP_CurrSumChkRslt: abs tol 1
    baseline "EI09_SWUT_MIL_CurrSumChk_03"
      TRSP_CurrSumChkRslt: abs tol 1
    baseline "EI09_SWUT_MIL_CurrSumChk_04"
      TRSP_CurrSumChkRslt: abs tol 1
    baseline "EI09_SWUT_MIL_CurrSumChk_05"
      TRSP_CurrSumChkRslt: abs tol 1

  case "EI09_SWUT_MIL_CurrSumChk_05" [baseline]
    model SWC_TRSP, harness SWC_TRSP_Harness_CurrSumChk (for SWC_TRSP/SWC_TRSP_100us_sys/CurrChk/CurrSumChk)
    input "EI09_SWUT_MIL_CurrSumChk_01" from TestCase_TRSP.xlsx, mapped to TRSP_iU, TRSP_iV, TRSP_iW
    input "EI09_SWUT_MIL_CurrSumChk_02" from TestCase_TRSP.xlsx, mapped to TRSP_iU, TRSP_iV, TRSP_iW
    input "EI09_SWUT_MIL_CurrSumChk_03" from TestCase_TRSP.xlsx, mapped to TRSP_iU, TRSP_iV, TRSP_iW
    input "EI09_SWUT_MIL_CurrSumChk_04" from TestCase_TRSP.xlsx, mapped to TRSP_iU, TRSP_iV, TRSP_iW
    input "EI09_SWUT_MIL_CurrSumChk_05" from TestCase_TRSP.xlsx, mapped to TRSP_iU, TRSP_iV, TRSP_iW (active)
    baseline "EI09_SWUT_MIL_CurrSumChk_01"
      TRSP_CurrSumChkRslt: abs tol 1
    baseline "EI09_SWUT_MIL_CurrSumChk_02"
      TRSP_CurrSumChkRslt: abs tol 1
    baseline "EI09_SWUT_MIL_CurrSumChk_03"
      TRSP_CurrSumChkRslt: abs tol 1
    baseline "EI09_SWUT_MIL_CurrSumChk_04"
      TRSP_CurrSumChkRslt: abs tol 1
    baseline "EI09_SWUT_MIL_CurrSumChk_05"
      TRSP_CurrSumChkRslt: abs tol 1

suite "RslvRngChk"

  case "EI09_SWUT_MIL_RslvRngChk_01" [baseline]
    model SWC_TRSP, harness SWC_TRSP_Harness_RslvRngChk (for SWC_TRSP/SWC_TRSP_100us_sys/RslvChk/RslvRngChk)
    input "EI09_SWUT_MIL_RslvRngChk_01" from TestCase_TRSP.xlsx, mapped to L2Sampling_Rslv_VADC, TRSP_HiTrh, TRSP_LoTrh (active)
    baseline "EI09_SWUT_MIL_RslvRngChk_01"
      TRSP_RslvRngChkRslt: abs tol 1
      L2Sampling_Rslv_VADC_Max: abs tol 1
      L2Sampling_Rslv_VADC_Min: abs tol 1

  case "EI09_SWUT_MIL_RslvRngChk_02" [baseline]
    model SWC_TRSP, harness SWC_TRSP_Harness_RslvRngChk (for SWC_TRSP/SWC_TRSP_100us_sys/RslvChk/RslvRngChk)
    input "EI09_SWUT_MIL_RslvRngChk_01" from TestCase_TRSP.xlsx, mapped to VAR_L2Sampling_RslvSinP_VADC_u16 -> L2Sampling_Rslv_VADC, TRSP_HiTrh, TRSP_LoTrh
    input "EI09_SWUT_MIL_RslvRngChk_02" from TestCase_TRSP.xlsx, mapped to VAR_L2Sampling_RslvSinP_VADC_u16 -> L2Sampling_Rslv_VADC, TRSP_HiTrh, TRSP_LoTrh (active)
    input "EI09_SWUT_MIL_RslvRngChk_03" from TestCase_TRSP.xlsx, mapped to VAR_L2Sampling_RslvSinP_VADC_u16 -> L2Sampling_Rslv_VADC, TRSP_HiTrh, TRSP_LoTrh
    input "EI09_SWUT_MIL_RslvRngChk_04" from TestCase_TRSP.xlsx, mapped to VAR_L2Sampling_RslvSinP_VADC_u16 -> L2Sampling_Rslv_VADC, TRSP_HiTrh, TRSP_LoTrh
    input "EI09_SWUT_MIL_RslvRngChk_05" from TestCase_TRSP.xlsx, mapped to VAR_L2Sampling_RslvSinP_VADC_u16 -> L2Sampling_Rslv_VADC, TRSP_HiTrh, TRSP_LoTrh
    baseline "EI09_SWUT_MIL_RslvRngChk_01"
      TRSP_RslvRngChkRslt: abs tol 1
      L2Sampling_Rslv_VADC_Max: abs tol 1
      L2Sampling_Rslv_VADC_Min: abs tol 1
    baseline "EI09_SWUT_MIL_RslvRngChk_03"
      TRSP_RslvRngChkRslt: abs tol 1
      L2Sampling_Rslv_VADC_Max: abs tol 1
      L2Sampling_Rslv_VADC_Min: abs tol 1
    baseline "EI09_SWUT_MIL_RslvRngChk_04"
      TRSP_RslvRngChkRslt: abs tol 1
      L2Sampling_Rslv_VADC_Max: abs tol 1
      L2Sampling_Rslv_VADC_Min: abs tol 1
    baseline "EI09_SWUT_MIL_RslvRngChk_05"
      TRSP_RslvRngChkRslt: abs tol 1
      L2Sampling_Rslv_VADC_Max: abs tol 1
      L2Sampling_Rslv_VADC_Min: abs tol 1
    baseline "EI09_SWUT_MIL_RslvRngChk_02"
      TRSP_RslvRngChkRslt: abs tol 1
      L2Sampling_Rslv_VADC_Max: abs tol 1
      L2Sampling_Rslv_VADC_Min: abs tol 1

  case "EI09_SWUT_MIL_RslvRngChk_03" [baseline]
    model SWC_TRSP, harness SWC_TRSP_Harness_RslvRngChk (for SWC_TRSP/SWC_TRSP_100us_sys/RslvChk/RslvRngChk)
    input "EI09_SWUT_MIL_RslvRngChk_01" from TestCase_TRSP.xlsx, mapped to VAR_L2Sampling_RslvSinP_VADC_u16 -> L2Sampling_Rslv_VADC, TRSP_HiTrh, TRSP_LoTrh
    input "EI09_SWUT_MIL_RslvRngChk_02" from TestCase_TRSP.xlsx, mapped to VAR_L2Sampling_RslvSinP_VADC_u16 -> L2Sampling_Rslv_VADC, TRSP_HiTrh, TRSP_LoTrh
    input "EI09_SWUT_MIL_RslvRngChk_03" from TestCase_TRSP.xlsx, mapped to VAR_L2Sampling_RslvSinP_VADC_u16 -> L2Sampling_Rslv_VADC, TRSP_HiTrh, TRSP_LoTrh (active)
    input "EI09_SWUT_MIL_RslvRngChk_04" from TestCase_TRSP.xlsx, mapped to VAR_L2Sampling_RslvSinP_VADC_u16 -> L2Sampling_Rslv_VADC, TRSP_HiTrh, TRSP_LoTrh
    input "EI09_SWUT_MIL_RslvRngChk_05" from TestCase_TRSP.xlsx, mapped to VAR_L2Sampling_RslvSinP_VADC_u16 -> L2Sampling_Rslv_VADC, TRSP_HiTrh, TRSP_LoTrh
    baseline "EI09_SWUT_MIL_RslvRngChk_01"
      TRSP_RslvRngChkRslt: abs tol 1
      L2Sampling_Rslv_VADC_Max: abs tol 1
      L2Sampling_Rslv_VADC_Min: abs tol 1
    baseline "EI09_SWUT_MIL_RslvRngChk_02"
      TRSP_RslvRngChkRslt: abs tol 1
      L2Sampling_Rslv_VADC_Max: abs tol 1
      L2Sampling_Rslv_VADC_Min: abs tol 1
    baseline "EI09_SWUT_MIL_RslvRngChk_03"
      TRSP_RslvRngChkRslt: abs tol 1
      L2Sampling_Rslv_VADC_Max: abs tol 1
      L2Sampling_Rslv_VADC_Min: abs tol 1
    baseline "EI09_SWUT_MIL_RslvRngChk_04"
      TRSP_RslvRngChkRslt: abs tol 1
      L2Sampling_Rslv_VADC_Max: abs tol 1
      L2Sampling_Rslv_VADC_Min: abs tol 1
    baseline "EI09_SWUT_MIL_RslvRngChk_05"
      TRSP_RslvRngChkRslt: abs tol 1
      L2Sampling_Rslv_VADC_Max: abs tol 1
      L2Sampling_Rslv_VADC_Min: abs tol 1

  case "EI09_SWUT_MIL_RslvRngChk_04" [baseline]
    model SWC_TRSP, harness SWC_TRSP_Harness_RslvRngChk (for SWC_TRSP/SWC_TRSP_100us_sys/RslvChk/RslvRngChk)
    input "EI09_SWUT_MIL_RslvRngChk_01" from TestCase_TRSP.xlsx, mapped to VAR_L2Sampling_RslvSinP_VADC_u16 -> L2Sampling_Rslv_VADC, TRSP_HiTrh, TRSP_LoTrh
    input "EI09_SWUT_MIL_RslvRngChk_02" from TestCase_TRSP.xlsx, mapped to VAR_L2Sampling_RslvSinP_VADC_u16 -> L2Sampling_Rslv_VADC, TRSP_HiTrh, TRSP_LoTrh
    input "EI09_SWUT_MIL_RslvRngChk_03" from TestCase_TRSP.xlsx, mapped to VAR_L2Sampling_RslvSinP_VADC_u16 -> L2Sampling_Rslv_VADC, TRSP_HiTrh, TRSP_LoTrh
    input "EI09_SWUT_MIL_RslvRngChk_04" from TestCase_TRSP.xlsx, mapped to VAR_L2Sampling_RslvSinP_VADC_u16 -> L2Sampling_Rslv_VADC, TRSP_HiTrh, TRSP_LoTrh (active)
    input "EI09_SWUT_MIL_RslvRngChk_05" from TestCase_TRSP.xlsx, mapped to VAR_L2Sampling_RslvSinP_VADC_u16 -> L2Sampling_Rslv_VADC, TRSP_HiTrh, TRSP_LoTrh
    baseline "EI09_SWUT_MIL_RslvRngChk_01"
      TRSP_RslvRngChkRslt: abs tol 1
      L2Sampling_Rslv_VADC_Max: abs tol 1
      L2Sampling_Rslv_VADC_Min: abs tol 1
    baseline "EI09_SWUT_MIL_RslvRngChk_02"
      TRSP_RslvRngChkRslt: abs tol 1
      L2Sampling_Rslv_VADC_Max: abs tol 1
      L2Sampling_Rslv_VADC_Min: abs tol 1
    baseline "EI09_SWUT_MIL_RslvRngChk_03"
      TRSP_RslvRngChkRslt: abs tol 1
      L2Sampling_Rslv_VADC_Max: abs tol 1
      L2Sampling_Rslv_VADC_Min: abs tol 1
    baseline "EI09_SWUT_MIL_RslvRngChk_04"
      TRSP_RslvRngChkRslt: abs tol 1
      L2Sampling_Rslv_VADC_Max: abs tol 1
      L2Sampling_Rslv_VADC_Min: abs tol 1
    baseline "EI09_SWUT_MIL_RslvRngChk_05"
      TRSP_RslvRngChkRslt: abs tol 1
      L2Sampling_Rslv_VADC_Max: abs tol 1
      L2Sampling_Rslv_VADC_Min: abs tol 1

  case "EI09_SWUT_MIL_RslvRngChk_05" [baseline]
    model SWC_TRSP, harness SWC_TRSP_Harness_RslvRngChk (for SWC_TRSP/SWC_TRSP_100us_sys/RslvChk/RslvRngChk)
    input "EI09_SWUT_MIL_RslvRngChk_01" from TestCase_TRSP.xlsx, mapped to VAR_L2Sampling_RslvSinP_VADC_u16 -> L2Sampling_Rslv_VADC, TRSP_HiTrh, TRSP_LoTrh
    input "EI09_SWUT_MIL_RslvRngChk_02" from TestCase_TRSP.xlsx, mapped to VAR_L2Sampling_RslvSinP_VADC_u16 -> L2Sampling_Rslv_VADC, TRSP_HiTrh, TRSP_LoTrh
    input "EI09_SWUT_MIL_RslvRngChk_03" from TestCase_TRSP.xlsx, mapped to VAR_L2Sampling_RslvSinP_VADC_u16 -> L2Sampling_Rslv_VADC, TRSP_HiTrh, TRSP_LoTrh
    input "EI09_SWUT_MIL_RslvRngChk_04" from TestCase_TRSP.xlsx, mapped to VAR_L2Sampling_RslvSinP_VADC_u16 -> L2Sampling_Rslv_VADC, TRSP_HiTrh, TRSP_LoTrh
    input "EI09_SWUT_MIL_RslvRngChk_05" from TestCase_TRSP.xlsx, mapped to VAR_L2Sampling_RslvSinP_VADC_u16 -> L2Sampling_Rslv_VADC, TRSP_HiTrh, TRSP_LoTrh (active)
    baseline "EI09_SWUT_MIL_RslvRngChk_01"
      TRSP_RslvRngChkRslt: abs tol 1
      L2Sampling_Rslv_VADC_Max: abs tol 1
      L2Sampling_Rslv_VADC_Min: abs tol 1
    baseline "EI09_SWUT_MIL_RslvRngChk_02"
      TRSP_RslvRngChkRslt: abs tol 1
      L2Sampling_Rslv_VADC_Max: abs tol 1
      L2Sampling_Rslv_VADC_Min: abs tol 1
    baseline "EI09_SWUT_MIL_RslvRngChk_03"
      TRSP_RslvRngChkRslt: abs tol 1
      L2Sampling_Rslv_VADC_Max: abs tol 1
      L2Sampling_Rslv_VADC_Min: abs tol 1
    baseline "EI09_SWUT_MIL_RslvRngChk_04"
      TRSP_RslvRngChkRslt: abs tol 1
      L2Sampling_Rslv_VADC_Max: abs tol 1
      L2Sampling_Rslv_VADC_Min: abs tol 1
    baseline "EI09_SWUT_MIL_RslvRngChk_05"
      TRSP_RslvRngChkRslt: abs tol 1
      L2Sampling_Rslv_VADC_Max: abs tol 1
      L2Sampling_Rslv_VADC_Min: abs tol 1

suite "RslvSqrtChk"

  case "EI09_SWUT_MIL_RslvSqrtChk_01" [baseline]
    model SWC_TRSP, harness SWC_TRSP_Harness_RslvSqrtChk (for SWC_TRSP/SWC_TRSP_100us_sys/RslvChk/RslvSqrtChk)
    input "EI09_SWUT_MIL_RslvSqrtChk_01" from TestCase_TRSP.xlsx, mapped to TRSP_RslvSin, TRSP_RslvCos (active)
    input "EI09_SWUT_MIL_RslvSqrtChk_02" from TestCase_TRSP.xlsx, mapped to TRSP_RslvSin, TRSP_RslvCos
    input "EI09_SWUT_MIL_RslvSqrtChk_03" from TestCase_TRSP.xlsx, mapped to TRSP_RslvSin, TRSP_RslvCos
    input "EI09_SWUT_MIL_RslvSqrtChk_04" from TestCase_TRSP.xlsx, mapped to TRSP_RslvSin, TRSP_RslvCos
    input "EI09_SWUT_MIL_RslvSqrtChk_05" from TestCase_TRSP.xlsx, mapped to TRSP_RslvSin, TRSP_RslvCos
    baseline "EI09_SWUT_MIL_RslvSqrtChk_01"
      TRSP_RslvSqrtChkRslt: abs tol 1
    baseline "EI09_SWUT_MIL_RslvSqrtChk_02"
      TRSP_RslvSqrtChkRslt: abs tol 1
    baseline "EI09_SWUT_MIL_RslvSqrtChk_03"
      TRSP_RslvSqrtChkRslt: abs tol 1
    baseline "EI09_SWUT_MIL_RslvSqrtChk_04"
      TRSP_RslvSqrtChkRslt: abs tol 1
    baseline "EI09_SWUT_MIL_RslvSqrtChk_05"
      TRSP_RslvSqrtChkRslt: abs tol 1

  case "EI09_SWUT_MIL_RslvSqrtChk_02" [baseline]
    model SWC_TRSP, harness SWC_TRSP_Harness_RslvSqrtChk (for SWC_TRSP/SWC_TRSP_100us_sys/RslvChk/RslvSqrtChk)
    input "EI09_SWUT_MIL_RslvSqrtChk_01" from TestCase_TRSP.xlsx, mapped to TRSP_RslvSin, TRSP_RslvCos
    input "EI09_SWUT_MIL_RslvSqrtChk_02" from TestCase_TRSP.xlsx, mapped to TRSP_RslvSin, TRSP_RslvCos (active)
    input "EI09_SWUT_MIL_RslvSqrtChk_03" from TestCase_TRSP.xlsx, mapped to TRSP_RslvSin, TRSP_RslvCos
    input "EI09_SWUT_MIL_RslvSqrtChk_04" from TestCase_TRSP.xlsx, mapped to TRSP_RslvSin, TRSP_RslvCos
    input "EI09_SWUT_MIL_RslvSqrtChk_05" from TestCase_TRSP.xlsx, mapped to TRSP_RslvSin, TRSP_RslvCos
    baseline "EI09_SWUT_MIL_RslvSqrtChk_01"
      TRSP_RslvSqrtChkRslt: abs tol 1
    baseline "EI09_SWUT_MIL_RslvSqrtChk_02"
      TRSP_RslvSqrtChkRslt: abs tol 1
    baseline "EI09_SWUT_MIL_RslvSqrtChk_03"
      TRSP_RslvSqrtChkRslt: abs tol 1
    baseline "EI09_SWUT_MIL_RslvSqrtChk_04"
      TRSP_RslvSqrtChkRslt: abs tol 1
    baseline "EI09_SWUT_MIL_RslvSqrtChk_05"
      TRSP_RslvSqrtChkRslt: abs tol 1

  case "EI09_SWUT_MIL_RslvSqrtChk_03" [baseline]
    model SWC_TRSP, harness SWC_TRSP_Harness_RslvSqrtChk (for SWC_TRSP/SWC_TRSP_100us_sys/RslvChk/RslvSqrtChk)
    input "EI09_SWUT_MIL_RslvSqrtChk_01" from TestCase_TRSP.xlsx, mapped to TRSP_RslvSin, TRSP_RslvCos
    input "EI09_SWUT_MIL_RslvSqrtChk_02" from TestCase_TRSP.xlsx, mapped to TRSP_RslvSin, TRSP_RslvCos
    input "EI09_SWUT_MIL_RslvSqrtChk_03" from TestCase_TRSP.xlsx, mapped to TRSP_RslvSin, TRSP_RslvCos (active)
    input "EI09_SWUT_MIL_RslvSqrtChk_04" from TestCase_TRSP.xlsx, mapped to TRSP_RslvSin, TRSP_RslvCos
    input "EI09_SWUT_MIL_RslvSqrtChk_05" from TestCase_TRSP.xlsx, mapped to TRSP_RslvSin, TRSP_RslvCos
    baseline "EI09_SWUT_MIL_RslvSqrtChk_01"
      TRSP_RslvSqrtChkRslt: abs tol 1
    baseline "EI09_SWUT_MIL_RslvSqrtChk_02"
      TRSP_RslvSqrtChkRslt: abs tol 1
    baseline "EI09_SWUT_MIL_RslvSqrtChk_03"
      TRSP_RslvSqrtChkRslt: abs tol 1
    baseline "EI09_SWUT_MIL_RslvSqrtChk_04"
      TRSP_RslvSqrtChkRslt: abs tol 1
    baseline "EI09_SWUT_MIL_RslvSqrtChk_05"
      TRSP_RslvSqrtChkRslt: abs tol 1

  case "EI09_SWUT_MIL_RslvSqrtChk_04" [baseline]
    model SWC_TRSP, harness SWC_TRSP_Harness_RslvSqrtChk (for SWC_TRSP/SWC_TRSP_100us_sys/RslvChk/RslvSqrtChk)
    input "EI09_SWUT_MIL_RslvSqrtChk_01" from TestCase_TRSP.xlsx, mapped to TRSP_RslvSin, TRSP_RslvCos
    input "EI09_SWUT_MIL_RslvSqrtChk_02" from TestCase_TRSP.xlsx, mapped to TRSP_RslvSin, TRSP_RslvCos
    input "EI09_SWUT_MIL_RslvSqrtChk_03" from TestCase_TRSP.xlsx, mapped to TRSP_RslvSin, TRSP_RslvCos
    input "EI09_SWUT_MIL_RslvSqrtChk_04" from TestCase_TRSP.xlsx, mapped to TRSP_RslvSin, TRSP_RslvCos (active)
    input "EI09_SWUT_MIL_RslvSqrtChk_05" from TestCase_TRSP.xlsx, mapped to TRSP_RslvSin, TRSP_RslvCos
    baseline "EI09_SWUT_MIL_RslvSqrtChk_01"
      TRSP_RslvSqrtChkRslt: abs tol 1
    baseline "EI09_SWUT_MIL_RslvSqrtChk_02"
      TRSP_RslvSqrtChkRslt: abs tol 1
    baseline "EI09_SWUT_MIL_RslvSqrtChk_03"
      TRSP_RslvSqrtChkRslt: abs tol 1
    baseline "EI09_SWUT_MIL_RslvSqrtChk_04"
      TRSP_RslvSqrtChkRslt: abs tol 1
    baseline "EI09_SWUT_MIL_RslvSqrtChk_05"
      TRSP_RslvSqrtChkRslt: abs tol 1

  case "EI09_SWUT_MIL_RslvSqrtChk_05" [baseline]
    model SWC_TRSP, harness SWC_TRSP_Harness_RslvSqrtChk (for SWC_TRSP/SWC_TRSP_100us_sys/RslvChk/RslvSqrtChk)
    input "EI09_SWUT_MIL_RslvSqrtChk_01" from TestCase_TRSP.xlsx, mapped to TRSP_RslvSin, TRSP_RslvCos
    input "EI09_SWUT_MIL_RslvSqrtChk_02" from TestCase_TRSP.xlsx, mapped to TRSP_RslvSin, TRSP_RslvCos
    input "EI09_SWUT_MIL_RslvSqrtChk_03" from TestCase_TRSP.xlsx, mapped to TRSP_RslvSin, TRSP_RslvCos
    input "EI09_SWUT_MIL_RslvSqrtChk_04" from TestCase_TRSP.xlsx, mapped to TRSP_RslvSin, TRSP_RslvCos
    input "EI09_SWUT_MIL_RslvSqrtChk_05" from TestCase_TRSP.xlsx, mapped to TRSP_RslvSin, TRSP_RslvCos (active)
    baseline "EI09_SWUT_MIL_RslvSqrtChk_01"
      TRSP_RslvSqrtChkRslt: abs tol 1
    baseline "EI09_SWUT_MIL_RslvSqrtChk_02"
      TRSP_RslvSqrtChkRslt: abs tol 1
    baseline "EI09_SWUT_MIL_RslvSqrtChk_03"
      TRSP_RslvSqrtChkRslt: abs tol 1
    baseline "EI09_SWUT_MIL_RslvSqrtChk_04"
      TRSP_RslvSqrtChkRslt: abs tol 1
    baseline "EI09_SWUT_MIL_RslvSqrtChk_05"
      TRSP_RslvSqrtChkRslt: abs tol 1

suite "iPhaClc"

  case "EI09_SWUT_MIL_iPhaCalc_01" [baseline]
    model SWC_TRSP, harness SWC_TRSP_Harness_iPhaCalc (for SWC_TRSP/SWC_TRSP_100us_sys/CurrChk/iPhaCalc)
    input "EI09_SWUT_MIL_iPhaCalc_01" from TestCase_TRSP.xlsx, mapped to L2Sampling_IsU_Mon, L2Sampling_IsV_Mon, L2Sampling_IsW_Mon (active)
    baseline "EI09_SWUT_MIL_iPhaCalc_01"
      TRSP_iU: abs tol 1
      TRSP_iV: abs tol 1
      TRSP_iW: abs tol 1

  case "EI09_SWUT_MIL_iPhaCalc_02" [baseline]
    model SWC_TRSP, harness SWC_TRSP_Harness_iPhaCalc (for SWC_TRSP/SWC_TRSP_100us_sys/CurrChk/iPhaCalc)
    parameter set "Parameter Set 1": CAL_TRSP_flgChangPha_b = 1  % base workspace
    input "EI09_SWUT_MIL_iPhaCalc_01" from TestCase_TRSP.xlsx, mapped to L2Sampling_IsU_Mon, L2Sampling_IsV_Mon, L2Sampling_IsW_Mon (active)
    baseline "EI09_SWUT_MIL_iPhaCalc_02"
      TRSP_iU: abs tol 1
      TRSP_iV: abs tol 1
      TRSP_iW: abs tol 1

suite "RslvSigCalc"

  case "EI09_SWUT_MIL_RslvSigCalc_01" [baseline]
    model SWC_TRSP, harness SWC_TRSP_Harness_RslvSigCalc (for SWC_TRSP/SWC_TRSP_100us_sys/RslvChk/RslvSigCalc)
    input "EI09_SWUT_MIL_RslvSigCalc_01" from TestCase_TRSP.xlsx, mapped to L2Sampling_RslvSinP_VADC, L2Sampling_RslvSinN_VADC, L2Sampling_RslvCosP_VADC, L2Sampling_RslvCosN_VADC (active)
    baseline "EI09_SWUT_MIL_RslvSigCalc_01"
      TRSP_RslvSin: abs tol 1
      TRSP_RslvCos: abs tol 1

suite "Debouncer"

  case "EI09_SWRS_MIL_Debouncer_01" [baseline]
    model SWC_TRSP, harness SWC_TRSP_Harness_Debouncer (for SWC_TRSP/SWC_TRSP_1ms_sys/Debouncer)
    input "EI09_SWUT_MIL_Debouncer_01" from TestCase_TRSP.xlsx, mapped to BooleanIN, Rst, CountTrh, DebTrh (active)
    baseline "EI09_SWUT_MIL_Debouncer_01"
      OutLock: abs tol 0.1
      Count: abs tol 0.1
      Deb: abs tol 0.1

  case "EI09_SWRS_MIL_Debouncer_02" [baseline]
    model SWC_TRSP, harness SWC_TRSP_Harness_Debouncer (for SWC_TRSP/SWC_TRSP_1ms_sys/Debouncer)
    input "EI09_SWUT_MIL_Debouncer_02" from TestCase_TRSP.xlsx, mapped to BooleanIN, Rst, CountTrh, DebTrh (active)
    baseline "EI09_SWUT_MIL_Debouncer_02"
      OutLock: abs tol 0.1
      Count: abs tol 0.1
      Deb: abs tol 0.1

  case "EI09_SWRS_MIL_Debouncer_03" [baseline]
    model SWC_TRSP, harness SWC_TRSP_Harness_Debouncer (for SWC_TRSP/SWC_TRSP_1ms_sys/Debouncer)
    input "EI09_SWUT_MIL_Debouncer_03" from TestCase_TRSP.xlsx, mapped to BooleanIN, Rst, CountTrh, DebTrh (active)
    baseline "EI09_SWUT_MIL_Debouncer_03"
      OutLock: abs tol 0.1
      Count: abs tol 0.1
      Deb: abs tol 0.1

  case "EI09_SWRS_MIL_Debouncer_04" [baseline]
    model SWC_TRSP, harness SWC_TRSP_Harness_Debouncer (for SWC_TRSP/SWC_TRSP_1ms_sys/Debouncer)
    input "EI09_SWUT_MIL_Debouncer_04" from TestCase_TRSP.xlsx, mapped to BooleanIN, Rst, CountTrh, DebTrh (active)
    baseline "EI09_SWUT_MIL_Debouncer_04"
      OutLock: abs tol 0.1
      Count: abs tol 0.1
      Deb: abs tol 0.1

  case "EI09_SWRS_MIL_Debouncer_05" [baseline]
    model SWC_TRSP, harness SWC_TRSP_Harness_Debouncer (for SWC_TRSP/SWC_TRSP_1ms_sys/Debouncer)
    input "EI09_SWUT_MIL_Debouncer_05" from TestCase_TRSP.xlsx, mapped to BooleanIN, Rst, CountTrh, DebTrh (active)
    baseline "EI09_SWUT_MIL_Debouncer_05"
      OutLock: abs tol 0.1
      Count: abs tol 0.1
      Deb: abs tol 0.1

suite "Lock"

  case "EI09_SWRS_MIL_Lock_01" [baseline]
    model SWC_TRSP, harness SWC_TRSP_Harness_Lock (for SWC_TRSP/SWC_TRSP_1ms_sys/OfstAgChk/OfstChk/Lock)
    input "EI09_SWUT_MIL_Lock_01" from TestCase_TRSP.xlsx, mapped to BooleanIN, Rst (active)
    input "EI09_SWUT_MIL_Lock_02" from TestCase_TRSP.xlsx, mapped to BooleanIN, Rst
    baseline "EI09_SWUT_MIL_Lock_01"
      OutLock: abs tol 1
    baseline "EI09_SWUT_MIL_Lock_02" (0 of 1 signals compared)

  case "EI09_SWRS_MIL_Lock_02" [baseline]
    model SWC_TRSP, harness SWC_TRSP_Harness_Lock (for SWC_TRSP/SWC_TRSP_1ms_sys/OfstAgChk/OfstChk/Lock)
    input "EI09_SWUT_MIL_Lock_01" from TestCase_TRSP.xlsx, mapped to BooleanIN, Rst
    input "EI09_SWUT_MIL_Lock_02" from TestCase_TRSP.xlsx, mapped to BooleanIN, Rst (active)
    baseline "EI09_SWUT_MIL_Lock_01" (0 of 1 signals compared)
    baseline "EI09_SWUT_MIL_Lock_02"
      OutLock: abs tol 1

suite "OfstRngChk"

  case "EI09_SWRS_MIL_OfstRngChk_01" [baseline]
    model SWC_TRSP, harness SWC_TRSP_Harness_OfstRngChk (for SWC_TRSP/SWC_TRSP_1ms_sys/OfstAgChk/OfstChk/OfstRngChk)
    input "EI09_SWUT_MIL_OfstRngChk_01" from TestCase_TRSP.xlsx, mapped to TRSP_OfstRngChkVal, TRSP_HiTrh, TRSP_LoTrh (active)
    input "EI09_SWUT_MIL_OfstRngChk_02" from TestCase_TRSP.xlsx, mapped to TRSP_OfstRngChkVal, TRSP_HiTrh, TRSP_LoTrh
    input "EI09_SWUT_MIL_OfstRngChk_03" from TestCase_TRSP.xlsx, mapped to TRSP_OfstRngChkVal, TRSP_HiTrh, TRSP_LoTrh
    input "EI09_SWUT_MIL_OfstRngChk_04" from TestCase_TRSP.xlsx, mapped to TRSP_OfstRngChkVal, TRSP_HiTrh, TRSP_LoTrh
    input "EI09_SWUT_MIL_OfstRngChk_05" from TestCase_TRSP.xlsx, mapped to TRSP_OfstRngChkVal, TRSP_HiTrh, TRSP_LoTrh
    baseline "EI09_SWUT_MIL_OfstRngChk_01"
      TRSP_OfstRngChkRslt: abs tol 1
    baseline "EI09_SWUT_MIL_OfstRngChk_02"
      TRSP_OfstRngChkRslt: abs tol 1
    baseline "EI09_SWUT_MIL_OfstRngChk_03"
      TRSP_OfstRngChkRslt: abs tol 1
    baseline "EI09_SWUT_MIL_OfstRngChk_04"
      TRSP_OfstRngChkRslt: abs tol 1
    baseline "EI09_SWUT_MIL_OfstRngChk_05" (0 of 1 signals compared)

  case "EI09_SWRS_MIL_OfstRngChk_02" [baseline]
    model SWC_TRSP, harness SWC_TRSP_Harness_OfstRngChk (for SWC_TRSP/SWC_TRSP_1ms_sys/OfstAgChk/OfstChk/OfstRngChk)
    input "EI09_SWUT_MIL_OfstRngChk_01" from TestCase_TRSP.xlsx, mapped to TRSP_OfstRngChkVal, TRSP_HiTrh, TRSP_LoTrh
    input "EI09_SWUT_MIL_OfstRngChk_02" from TestCase_TRSP.xlsx, mapped to TRSP_OfstRngChkVal, TRSP_HiTrh, TRSP_LoTrh (active)
    input "EI09_SWUT_MIL_OfstRngChk_03" from TestCase_TRSP.xlsx, mapped to TRSP_OfstRngChkVal, TRSP_HiTrh, TRSP_LoTrh
    input "EI09_SWUT_MIL_OfstRngChk_04" from TestCase_TRSP.xlsx, mapped to TRSP_OfstRngChkVal, TRSP_HiTrh, TRSP_LoTrh
    input "EI09_SWUT_MIL_OfstRngChk_05" from TestCase_TRSP.xlsx, mapped to TRSP_OfstRngChkVal, TRSP_HiTrh, TRSP_LoTrh
    baseline "EI09_SWUT_MIL_OfstRngChk_01"
      TRSP_OfstRngChkRslt: abs tol 1
    baseline "EI09_SWUT_MIL_OfstRngChk_02"
      TRSP_OfstRngChkRslt: abs tol 1
    baseline "EI09_SWUT_MIL_OfstRngChk_03"
      TRSP_OfstRngChkRslt: abs tol 1
    baseline "EI09_SWUT_MIL_OfstRngChk_04"
      TRSP_OfstRngChkRslt: abs tol 1
    baseline "EI09_SWUT_MIL_OfstRngChk_05" (0 of 1 signals compared)

  case "EI09_SWRS_MIL_OfstRngChk_03" [baseline]
    model SWC_TRSP, harness SWC_TRSP_Harness_OfstRngChk (for SWC_TRSP/SWC_TRSP_1ms_sys/OfstAgChk/OfstChk/OfstRngChk)
    input "EI09_SWUT_MIL_OfstRngChk_01" from TestCase_TRSP.xlsx, mapped to TRSP_OfstRngChkVal, TRSP_HiTrh, TRSP_LoTrh
    input "EI09_SWUT_MIL_OfstRngChk_02" from TestCase_TRSP.xlsx, mapped to TRSP_OfstRngChkVal, TRSP_HiTrh, TRSP_LoTrh
    input "EI09_SWUT_MIL_OfstRngChk_03" from TestCase_TRSP.xlsx, mapped to TRSP_OfstRngChkVal, TRSP_HiTrh, TRSP_LoTrh (active)
    input "EI09_SWUT_MIL_OfstRngChk_04" from TestCase_TRSP.xlsx, mapped to TRSP_OfstRngChkVal, TRSP_HiTrh, TRSP_LoTrh
    input "EI09_SWUT_MIL_OfstRngChk_05" from TestCase_TRSP.xlsx, mapped to TRSP_OfstRngChkVal, TRSP_HiTrh, TRSP_LoTrh
    baseline "EI09_SWUT_MIL_OfstRngChk_01"
      TRSP_OfstRngChkRslt: abs tol 1
    baseline "EI09_SWUT_MIL_OfstRngChk_02"
      TRSP_OfstRngChkRslt: abs tol 1
    baseline "EI09_SWUT_MIL_OfstRngChk_03"
      TRSP_OfstRngChkRslt: abs tol 1
    baseline "EI09_SWUT_MIL_OfstRngChk_04"
      TRSP_OfstRngChkRslt: abs tol 1
    baseline "EI09_SWUT_MIL_OfstRngChk_05" (0 of 1 signals compared)

  case "EI09_SWRS_MIL_OfstRngChk_04" [baseline]
    model SWC_TRSP, harness SWC_TRSP_Harness_OfstRngChk (for SWC_TRSP/SWC_TRSP_1ms_sys/OfstAgChk/OfstChk/OfstRngChk)
    input "EI09_SWUT_MIL_OfstRngChk_01" from TestCase_TRSP.xlsx, mapped to TRSP_OfstRngChkVal, TRSP_HiTrh, TRSP_LoTrh
    input "EI09_SWUT_MIL_OfstRngChk_02" from TestCase_TRSP.xlsx, mapped to TRSP_OfstRngChkVal, TRSP_HiTrh, TRSP_LoTrh
    input "EI09_SWUT_MIL_OfstRngChk_03" from TestCase_TRSP.xlsx, mapped to TRSP_OfstRngChkVal, TRSP_HiTrh, TRSP_LoTrh
    input "EI09_SWUT_MIL_OfstRngChk_04" from TestCase_TRSP.xlsx, mapped to TRSP_OfstRngChkVal, TRSP_HiTrh, TRSP_LoTrh (active)
    input "EI09_SWUT_MIL_OfstRngChk_05" from TestCase_TRSP.xlsx, mapped to TRSP_OfstRngChkVal, TRSP_HiTrh, TRSP_LoTrh
    baseline "EI09_SWUT_MIL_OfstRngChk_01"
      TRSP_OfstRngChkRslt: abs tol 1
    baseline "EI09_SWUT_MIL_OfstRngChk_02"
      TRSP_OfstRngChkRslt: abs tol 1
    baseline "EI09_SWUT_MIL_OfstRngChk_03"
      TRSP_OfstRngChkRslt: abs tol 1
    baseline "EI09_SWUT_MIL_OfstRngChk_04"
      TRSP_OfstRngChkRslt: abs tol 1
    baseline "EI09_SWUT_MIL_OfstRngChk_05" (0 of 1 signals compared)

  case "EI09_SWRS_MIL_OfstRngChk_05" [baseline]
    model SWC_TRSP, harness SWC_TRSP_Harness_OfstRngChk (for SWC_TRSP/SWC_TRSP_1ms_sys/OfstAgChk/OfstChk/OfstRngChk)
    input "EI09_SWUT_MIL_OfstRngChk_01" from TestCase_TRSP.xlsx, mapped to TRSP_OfstRngChkVal, TRSP_HiTrh, TRSP_LoTrh
    input "EI09_SWUT_MIL_OfstRngChk_02" from TestCase_TRSP.xlsx, mapped to TRSP_OfstRngChkVal, TRSP_HiTrh, TRSP_LoTrh
    input "EI09_SWUT_MIL_OfstRngChk_03" from TestCase_TRSP.xlsx, mapped to TRSP_OfstRngChkVal, TRSP_HiTrh, TRSP_LoTrh
    input "EI09_SWUT_MIL_OfstRngChk_04" from TestCase_TRSP.xlsx, mapped to TRSP_OfstRngChkVal, TRSP_HiTrh, TRSP_LoTrh
    input "EI09_SWUT_MIL_OfstRngChk_05" from TestCase_TRSP.xlsx, mapped to TRSP_OfstRngChkVal, TRSP_HiTrh, TRSP_LoTrh (active)
    baseline "EI09_SWUT_MIL_OfstRngChk_01"
      TRSP_OfstRngChkRslt: abs tol 1
    baseline "EI09_SWUT_MIL_OfstRngChk_02"
      TRSP_OfstRngChkRslt: abs tol 1
    baseline "EI09_SWUT_MIL_OfstRngChk_03"
      TRSP_OfstRngChkRslt: abs tol 1
    baseline "EI09_SWUT_MIL_OfstRngChk_04"
      TRSP_OfstRngChkRslt: abs tol 1
    baseline "EI09_SWUT_MIL_OfstRngChk_05"
      TRSP_OfstRngChkRslt: abs tol 1

suite "OfstChkEnable"

  case "EI09_SWRS_MIL_OfstChkEnable_01" [baseline]
    model SWC_TRSP, harness SWC_TRSP_Harness_OfstChkEnable (for SWC_TRSP/SWC_TRSP_1ms_sys/OfstAgChk/OfstChkEnable)
    input "EI09_SWUT_MIL_OfstChkEnable_01" from TestCase_TRSP.xlsx, mapped to L2Com_ModeReq (active)
    baseline "EI09_SWUT_MIL_OfstChkEnable_01"
      Enable: abs tol 1

  case "EI09_SWRS_MIL_OfstChkEnable_02" [baseline]
    model SWC_TRSP, harness SWC_TRSP_Harness_OfstChkEnable (for SWC_TRSP/SWC_TRSP_1ms_sys/OfstAgChk/OfstChkEnable)
    input "EI09_SWUT_MIL_OfstChkEnable_02" from TestCase_TRSP.xlsx, mapped to L2Com_ModeReq (active)
    baseline "EI09_SWUT_MIL_OfstChkEnable_02"
      Enable: abs tol 1

  case "EI09_SWRS_MIL_OfstChkEnable_03" [baseline]
    model SWC_TRSP, harness SWC_TRSP_Harness_OfstChkEnable (for SWC_TRSP/SWC_TRSP_1ms_sys/OfstAgChk/OfstChkEnable)
    input "EI09_SWUT_MIL_OfstChkEnable_03" from TestCase_TRSP.xlsx, mapped to L2Com_ModeReq (active)
    baseline "EI09_SWUT_MIL_OfstChkEnable_03"
      Enable: abs tol 1

suite "UBR_SBCVoltCalc"

  case "EI09_SWRS_MIL_UBR_SBCVoltCalc_01" [baseline]
    model SWC_TRSP, harness SWC_TRSP_Harness_UBR_SBCVoltCalc (for SWC_TRSP/SWC_TRSP_100us_sys/UBRVoltChk/UBR_SBCVoltCalc)
    input "EI09_SWUT_MIL_UBRSBCVoltCalc_01" from TestCase_TRSP.xlsx, mapped to L2Sampling_UBRWIDE_MON, L2Sampling_UB_SBC_MON (active)
    baseline "EI09_SWUT_MIL_UBRSBCVoltCalc_01"
      TRSP_UBRWIDE: abs tol 1
      TRSP_UB_SBC: abs tol 1

suite "UBRVoltCmpChk"

  case "EI09_SWRS_MIL_UBRVoltCmpChk_01" [baseline]
    model SWC_TRSP, harness SWC_TRSP_Harness_UBRVoltCompChk (for SWC_TRSP/SWC_TRSP_100us_sys/UBRVoltChk/UBRVoltCompChk)
    input "EI09_SWUT_MIL_UBRVoltCompChk_01" from TestCase_TRSP.xlsx, mapped to TRSP_UBRWIDE, TRSP_UB_SBC (active)
    input "EI09_SWUT_MIL_UBRVoltCompChk_02" from TestCase_TRSP.xlsx, mapped to TRSP_UBRWIDE, TRSP_UB_SBC
    input "EI09_SWUT_MIL_UBRVoltCompChk_03" from TestCase_TRSP.xlsx, mapped to TRSP_UBRWIDE, TRSP_UB_SBC
    input "EI09_SWUT_MIL_UBRVoltCompChk_04" from TestCase_TRSP.xlsx, mapped to TRSP_UBRWIDE, TRSP_UB_SBC
    input "EI09_SWUT_MIL_UBRVoltCompChk_05" from TestCase_TRSP.xlsx, mapped to TRSP_UBRWIDE, TRSP_UB_SBC
    baseline "EI09_SWUT_MIL_UBRVoltCompChk_01"
      TRSP_UBRVoltChkRslt: abs tol 1
    baseline "EI09_SWUT_MIL_UBRVoltCompChk_02"
      TRSP_UBRVoltChkRslt: abs tol 1
    baseline "EI09_SWUT_MIL_UBRVoltCompChk_03"
      TRSP_UBRVoltChkRslt: abs tol 1
    baseline "EI09_SWUT_MIL_UBRVoltCompChk_04"
      TRSP_UBRVoltChkRslt: abs tol 1
    baseline "EI09_SWUT_MIL_UBRVoltCompChk_05"
      TRSP_UBRVoltChkRslt: abs tol 1

  case "EI09_SWRS_MIL_UBRVoltCmpChk_02" [baseline]
    model SWC_TRSP, harness SWC_TRSP_Harness_UBRVoltCompChk (for SWC_TRSP/SWC_TRSP_100us_sys/UBRVoltChk/UBRVoltCompChk)
    input "EI09_SWUT_MIL_UBRVoltCompChk_01" from TestCase_TRSP.xlsx, mapped to TRSP_UBRWIDE, TRSP_UB_SBC
    input "EI09_SWUT_MIL_UBRVoltCompChk_02" from TestCase_TRSP.xlsx, mapped to TRSP_UBRWIDE, TRSP_UB_SBC (active)
    input "EI09_SWUT_MIL_UBRVoltCompChk_03" from TestCase_TRSP.xlsx, mapped to TRSP_UBRWIDE, TRSP_UB_SBC
    input "EI09_SWUT_MIL_UBRVoltCompChk_04" from TestCase_TRSP.xlsx, mapped to TRSP_UBRWIDE, TRSP_UB_SBC
    input "EI09_SWUT_MIL_UBRVoltCompChk_05" from TestCase_TRSP.xlsx, mapped to TRSP_UBRWIDE, TRSP_UB_SBC
    baseline "EI09_SWUT_MIL_UBRVoltCompChk_01"
      TRSP_UBRVoltChkRslt: abs tol 1
    baseline "EI09_SWUT_MIL_UBRVoltCompChk_02"
      TRSP_UBRVoltChkRslt: abs tol 1
    baseline "EI09_SWUT_MIL_UBRVoltCompChk_03"
      TRSP_UBRVoltChkRslt: abs tol 1
    baseline "EI09_SWUT_MIL_UBRVoltCompChk_04"
      TRSP_UBRVoltChkRslt: abs tol 1
    baseline "EI09_SWUT_MIL_UBRVoltCompChk_05"
      TRSP_UBRVoltChkRslt: abs tol 1

  case "EI09_SWRS_MIL_UBRVoltCmpChk_03" [baseline]
    model SWC_TRSP, harness SWC_TRSP_Harness_UBRVoltCompChk (for SWC_TRSP/SWC_TRSP_100us_sys/UBRVoltChk/UBRVoltCompChk)
    input "EI09_SWUT_MIL_UBRVoltCompChk_01" from TestCase_TRSP.xlsx, mapped to TRSP_UBRWIDE, TRSP_UB_SBC
    input "EI09_SWUT_MIL_UBRVoltCompChk_02" from TestCase_TRSP.xlsx, mapped to TRSP_UBRWIDE, TRSP_UB_SBC
    input "EI09_SWUT_MIL_UBRVoltCompChk_03" from TestCase_TRSP.xlsx, mapped to TRSP_UBRWIDE, TRSP_UB_SBC (active)
    input "EI09_SWUT_MIL_UBRVoltCompChk_04" from TestCase_TRSP.xlsx, mapped to TRSP_UBRWIDE, TRSP_UB_SBC
    input "EI09_SWUT_MIL_UBRVoltCompChk_05" from TestCase_TRSP.xlsx, mapped to TRSP_UBRWIDE, TRSP_UB_SBC
    baseline "EI09_SWUT_MIL_UBRVoltCompChk_01"
      TRSP_UBRVoltChkRslt: abs tol 1
    baseline "EI09_SWUT_MIL_UBRVoltCompChk_02"
      TRSP_UBRVoltChkRslt: abs tol 1
    baseline "EI09_SWUT_MIL_UBRVoltCompChk_03"
      TRSP_UBRVoltChkRslt: abs tol 1
    baseline "EI09_SWUT_MIL_UBRVoltCompChk_04"
      TRSP_UBRVoltChkRslt: abs tol 1
    baseline "EI09_SWUT_MIL_UBRVoltCompChk_05"
      TRSP_UBRVoltChkRslt: abs tol 1

  case "EI09_SWRS_MIL_UBRVoltCmpChk_04" [baseline]
    model SWC_TRSP, harness SWC_TRSP_Harness_UBRVoltCompChk (for SWC_TRSP/SWC_TRSP_100us_sys/UBRVoltChk/UBRVoltCompChk)
    input "EI09_SWUT_MIL_UBRVoltCompChk_01" from TestCase_TRSP.xlsx, mapped to TRSP_UBRWIDE, TRSP_UB_SBC
    input "EI09_SWUT_MIL_UBRVoltCompChk_02" from TestCase_TRSP.xlsx, mapped to TRSP_UBRWIDE, TRSP_UB_SBC
    input "EI09_SWUT_MIL_UBRVoltCompChk_03" from TestCase_TRSP.xlsx, mapped to TRSP_UBRWIDE, TRSP_UB_SBC
    input "EI09_SWUT_MIL_UBRVoltCompChk_04" from TestCase_TRSP.xlsx, mapped to TRSP_UBRWIDE, TRSP_UB_SBC (active)
    input "EI09_SWUT_MIL_UBRVoltCompChk_05" from TestCase_TRSP.xlsx, mapped to TRSP_UBRWIDE, TRSP_UB_SBC
    baseline "EI09_SWUT_MIL_UBRVoltCompChk_01"
      TRSP_UBRVoltChkRslt: abs tol 1
    baseline "EI09_SWUT_MIL_UBRVoltCompChk_02"
      TRSP_UBRVoltChkRslt: abs tol 1
    baseline "EI09_SWUT_MIL_UBRVoltCompChk_03"
      TRSP_UBRVoltChkRslt: abs tol 1
    baseline "EI09_SWUT_MIL_UBRVoltCompChk_04"
      TRSP_UBRVoltChkRslt: abs tol 1
    baseline "EI09_SWUT_MIL_UBRVoltCompChk_05"
      TRSP_UBRVoltChkRslt: abs tol 1

  case "EI09_SWRS_MIL_UBRVoltCmpChk_05" [baseline]
    model SWC_TRSP, harness SWC_TRSP_Harness_UBRVoltCompChk (for SWC_TRSP/SWC_TRSP_100us_sys/UBRVoltChk/UBRVoltCompChk)
    input "EI09_SWUT_MIL_UBRVoltCompChk_01" from TestCase_TRSP.xlsx, mapped to TRSP_UBRWIDE, TRSP_UB_SBC
    input "EI09_SWUT_MIL_UBRVoltCompChk_02" from TestCase_TRSP.xlsx, mapped to TRSP_UBRWIDE, TRSP_UB_SBC
    input "EI09_SWUT_MIL_UBRVoltCompChk_03" from TestCase_TRSP.xlsx, mapped to TRSP_UBRWIDE, TRSP_UB_SBC
    input "EI09_SWUT_MIL_UBRVoltCompChk_04" from TestCase_TRSP.xlsx, mapped to TRSP_UBRWIDE, TRSP_UB_SBC
    input "EI09_SWUT_MIL_UBRVoltCompChk_05" from TestCase_TRSP.xlsx, mapped to TRSP_UBRWIDE, TRSP_UB_SBC (active)
    baseline "EI09_SWUT_MIL_UBRVoltCompChk_01"
      TRSP_UBRVoltChkRslt: abs tol 1
    baseline "EI09_SWUT_MIL_UBRVoltCompChk_02"
      TRSP_UBRVoltChkRslt: abs tol 1
    baseline "EI09_SWUT_MIL_UBRVoltCompChk_03"
      TRSP_UBRVoltChkRslt: abs tol 1
    baseline "EI09_SWUT_MIL_UBRVoltCompChk_04"
      TRSP_UBRVoltChkRslt: abs tol 1
    baseline "EI09_SWUT_MIL_UBRVoltCompChk_05"
      TRSP_UBRVoltChkRslt: abs tol 1