% Simulink data dictionary SWC_TRSP_DataDictionary.sldd

VAR_TRSP_UCurrRngErr_b = ASAP2.Signal(StorageClass="ExportedGlobal", DataType="boolean", Min=0, Max=1, InitialValue="0")
VAR_TRSP_VCurrRngErr_b = ASAP2.Signal(StorageClass="ExportedGlobal", DataType="boolean", Min=0, Max=1, InitialValue="0")
VAR_TRSP_WCurrRngErr_b = ASAP2.Signal(StorageClass="ExportedGlobal", DataType="boolean", Min=0, Max=1, InitialValue="0")
VAR_TRSP_CurrRngErr_b = ASAP2.Signal(StorageClass="ExportedGlobal", DataType="boolean", Min=0, Max=1, InitialValue="0")
VAR_TRSP_CurrSumErr_b = ASAP2.Signal(StorageClass="ExportedGlobal", DataType="boolean", Min=0, Max=1, InitialValue="0")
VAR_TRSP_RslvSinPRngErr_b = ASAP2.Signal(StorageClass="ExportedGlobal", DataType="boolean", Min=0, Max=1, InitialValue="0")
VAR_TRSP_RslvSinNRngErr_b = ASAP2.Signal(StorageClass="ExportedGlobal", DataType="boolean", Min=0, Max=1, InitialValue="0")
VAR_TRSP_RslvCosPRngErr_b = ASAP2.Signal(StorageClass="ExportedGlobal", DataType="boolean", Min=0, Max=1, InitialValue="0")
VAR_TRSP_RslvCosNRngErr_b = ASAP2.Signal(StorageClass="ExportedGlobal", DataType="boolean", Min=0, Max=1, InitialValue="0")
VAR_TRSP_RslvRngErr_b = ASAP2.Signal(StorageClass="ExportedGlobal", DataType="boolean", Min=0, Max=1, InitialValue="0")
VAR_TRSP_RslvSqrtErr_b = ASAP2.Signal(StorageClass="ExportedGlobal", DataType="boolean", Min=0, Max=1, InitialValue="0")
VAR_TRSP_RslvExciPRngErr_b = ASAP2.Signal(StorageClass="ExportedGlobal", DataType="boolean", Min=0, Max=1, InitialValue="0")
VAR_TRSP_RslvExciNRngErr_b = ASAP2.Signal(StorageClass="ExportedGlobal", DataType="boolean", Min=0, Max=1, InitialValue="0")
VAR_TRSP_RslvExciRngErr_b = ASAP2.Signal(StorageClass="ExportedGlobal", DataType="boolean", Min=0, Max=1, InitialValue="0")
VAR_TRSP_RslvSensVoltRngErr_b = ASAP2.Signal(StorageClass="ExportedGlobal", DataType="boolean", Min=0, Max=1, InitialValue="0")
VAR_TRSP_iPhasSensVoltRngErr_b = ASAP2.Signal(StorageClass="ExportedGlobal", DataType="boolean", Min=0, Max=1, InitialValue="0")
VAR_TRSP_OfstRngErr_b = ASAP2.Signal(StorageClass="ExportedGlobal", DataType="boolean", Min=0, Max=1, InitialValue="0")
VAR_TRSP_UBRVoltRngErr_b = ASAP2.Signal(StorageClass="ExportedGlobal", DataType="boolean", Min=0, Max=1, InitialValue="0")
VAR_TRSP_18VHSVoltRngErr_b = ASAP2.Signal(StorageClass="ExportedGlobal", DataType="boolean", Min=0, Max=1, InitialValue="0")
VAR_TRSP_3V3CPLDVoltRngErr_b = ASAP2.Signal(StorageClass="ExportedGlobal", DataType="boolean", Min=0, Max=1, InitialValue="0")
VAR_TRSP_1V8CPLDVoltRngErr_b = ASAP2.Signal(StorageClass="ExportedGlobal", DataType="boolean", Min=0, Max=1, InitialValue="0")
VAR_TRSP_UCurrRngChkRslt_b = ASAP2.Signal(StorageClass="ExportedGlobal", DataType="boolean", Min=0, Max=1, InitialValue="0")
VAR_TRSP_VCurrRngChkRslt_b = ASAP2.Signal(StorageClass="ExportedGlobal", DataType="boolean", Min=0, Max=1, InitialValue="0")
VAR_TRSP_WCurrRngChkRslt_b = ASAP2.Signal(StorageClass="ExportedGlobal", DataType="boolean", Min=0, Max=1, InitialValue="0")
VAR_TRSP_CurrSumChkRslt_b = ASAP2.Signal(StorageClass="ExportedGlobal", DataType="boolean", Min=0, Max=1, InitialValue="0")
VAR_TRSP_iSum_f32 = ASAP2.Signal(StorageClass="ExportedGlobal", DataType="single", Min=0, Max=1, InitialValue="0")
VAR_TRSP_RslvSinPRngChkRslt_b = ASAP2.Signal(StorageClass="ExportedGlobal", DataType="boolean", Min=0, Max=1, InitialValue="0")
VAR_TRSP_RslvSinNRngChkRslt_b = ASAP2.Signal(StorageClass="ExportedGlobal", DataType="boolean", Min=0, Max=1, InitialValue="0")
VAR_TRSP_RslvCosPRngChkRslt_b = ASAP2.Signal(StorageClass="ExportedGlobal", DataType="boolean", Min=0, Max=1, InitialValue="0")
VAR_TRSP_RslvCosNRngChkRslt_b = ASAP2.Signal(StorageClass="ExportedGlobal", DataType="boolean", Min=0, Max=1, InitialValue="0")
VAR_TRSP_RslvSqrt_f32 = ASAP2.Signal(StorageClass="ExportedGlobal", DataType="single", Min=0, Max=1, InitialValue="0")
VAR_TRSP_RslvSqrtChkRslt_b = ASAP2.Signal(StorageClass="ExportedGlobal", DataType="boolean", Min=0, Max=1, InitialValue="0")
VAR_TRSP_RslvExciPRngChkRslt_b = ASAP2.Signal(StorageClass="ExportedGlobal", DataType="boolean", Min=0, Max=1, InitialValue="0")
VAR_TRSP_RslvExciNRngChkRslt_b = ASAP2.Signal(StorageClass="ExportedGlobal", DataType="boolean", Min=0, Max=1, InitialValue="0")
VAR_TRSP_RslvSensVoltRngChkRslt_b = ASAP2.Signal(StorageClass="ExportedGlobal", DataType="boolean", Min=0, Max=1, InitialValue="0")
VAR_TRSP_iPhasSensVoltRngChkRslt_b = ASAP2.Signal(StorageClass="ExportedGlobal", DataType="boolean", Min=0, Max=1, InitialValue="0")
VAR_TRSP_Diff_UBR_SBC_f32 = ASAP2.Signal(StorageClass="ExportedGlobal", DataType="single", Min=0, Max=1, InitialValue="0")
VAR_TRSP_UBRVoltRngChkRslt_b = ASAP2.Signal(StorageClass="ExportedGlobal", DataType="boolean", Min=0, Max=1, InitialValue="0")
VAR_TRSP_UBRWIDE_f32 = ASAP2.Signal(StorageClass="ExportedGlobal", DataType="single", Min=0, Max=1, InitialValue="0")
VAR_TRSP_UBRNARR_f32 = ASAP2.Signal(StorageClass="ExportedGlobal", DataType="single", Min=0, Max=1, InitialValue="0")
VAR_TRSP_UB_SBC_f32 = ASAP2.Signal(StorageClass="ExportedGlobal", DataType="single", Min=0, Max=1, InitialValue="0")
VAR_TRSP_18VHSVoltRngChkRslt_b = ASAP2.Signal(StorageClass="ExportedGlobal", DataType="boolean", Min=0, Max=1, InitialValue="0")
VAR_TRSP_3V3CPLDVoltRngChkRslt_b = ASAP2.Signal(StorageClass="ExportedGlobal", DataType="boolean", Min=0, Max=1, InitialValue="0")
VAR_TRSP_1V8CPLDVoltRngChkRslt_b = ASAP2.Signal(StorageClass="ExportedGlobal", DataType="boolean", Min=0, Max=1, InitialValue="0")
VAR_TRSP_iU_f32 = ASAP2.Signal(StorageClass="ExportedGlobal", DataType="single", Min=-1200, Max=1200, InitialValue="0")
VAR_TRSP_iV_f32 = ASAP2.Signal(StorageClass="ExportedGlobal", DataType="single", Min=-1200, Max=1200, InitialValue="0")
VAR_TRSP_iW_f32 = ASAP2.Signal(StorageClass="ExportedGlobal", DataType="single", Min=-1200, Max=1200, InitialValue="0")
VAR_TRSP_RslvSin_f32 = ASAP2.Signal(StorageClass="ExportedGlobal", DataType="single", Min=-10000, Max=10000, InitialValue="0")
VAR_TRSP_RslvCos_f32 = ASAP2.Signal(StorageClass="ExportedGlobal", DataType="single", Min=-10000, Max=10000, InitialValue="0")
VAR_TRSP_OfstRngChkRslt_b = ASAP2.Signal(StorageClass="ExportedGlobal", DataType="boolean", Min=0, Max=1, InitialValue="0")
VAR_TRSP_TrqSetPRngChkRslt_b = ASAP2.Signal(StorageClass="ExportedGlobal", DataType="boolean", Min=0, Max=1, InitialValue="0")
VAR_TRSP_TrqSetPRngErr_b = ASAP2.Signal(StorageClass="ExportedGlobal", DataType="boolean", Min=0, Max=1, InitialValue="0")
VAR_L2Sampling_IsU_Mon_f32 = ASAP2.Signal(StorageClass="ExportedGlobal", DataType="single", Min=-30000, Max=0, InitialValue="0")
VAR_L2Sampling_IsV_Mon_f32 = ASAP2.Signal(StorageClass="ExportedGlobal", DataType="single", Min=0, Max=30000, InitialValue="0")
VAR_L2Sampling_IsW_Mon_f32 = ASAP2.Signal(StorageClass="ExportedGlobal", DataType="single", Min=0, Max=30000, InitialValue="0")
VAR_L2Sampling_RslvSinP_VADC_u16 = ASAP2.Signal(StorageClass="ExportedGlobal", DataType="uint16", Min=0, Max=1024, Dimensions=[1 32], InitialValue="0")
VAR_L2Sampling_RslvSinN_VADC_u16 = ASAP2.Signal(StorageClass="ExportedGlobal", DataType="uint16", Min=0, Max=1024, Dimensions=[1 32], InitialValue="0")
VAR_L2Sampling_RslvCosP_VADC_u16 = ASAP2.Signal(StorageClass="ExportedGlobal", DataType="uint16", Min=0, Max=1024, Dimensions=[1 32], InitialValue="0")
VAR_L2Sampling_RslvCosN_VADC_u16 = ASAP2.Signal(StorageClass="ExportedGlobal", DataType="uint16", Min=0, Max=1024, Dimensions=[1 32], InitialValue="0")
VAR_L2Sampling_ExciBackP_u16 = ASAP2.Signal(StorageClass="ExportedGlobal", DataType="uint16", Min=0, Max=1024, InitialValue="0")
VAR_L2Sampling_ExciBackN_u16 = ASAP2.Signal(StorageClass="ExportedGlobal", DataType="uint16", Min=0, Max=1024, InitialValue="0")
VAR_L2Sampling_Exci18VLS_MON_u16 = ASAP2.Signal(StorageClass="ExportedGlobal", DataType="uint16", Min=0, Max=4095, InitialValue="0")
VAR_L2Sampling_LEM5V_MON_u16 = ASAP2.Signal(StorageClass="ExportedGlobal", DataType="uint16", Min=0, Max=4095, InitialValue="0")
VAR_NvM_AngAutoClbOffset_f32 = ASAP2.Signal(StorageClass="ExportedGlobal", DataType="single", Min=0, Max=360, InitialValue="0")
VAR_L2Com_ModeReq_u16 = ASAP2.Signal(StorageClass="ExportedGlobal", DataType="uint16", Min=0, Max=15, InitialValue="0")
VAR_L2Com_TrqSetP_f32 = ASAP2.Signal(StorageClass="ExportedGlobal", DataType="single", Min=-500, Max=500, InitialValue="0")
VAR_L2Sampling_RslvSin_f32 = ASAP2.Signal(StorageClass="ExportedGlobal", DataType="single", Min=-6000, Max=6000, InitialValue="0")
VAR_L2Sampling_RslvCos_f32 = ASAP2.Signal(StorageClass="ExportedGlobal", DataType="single", Min=-6000, Max=6000, InitialValue="0")
VAR_L2Sampling_RslvSinP_VADC_Max1_u16 = ASAP2.Signal(StorageClass="ExportedGlobal", DataType="uint16", Min=0, Max=1024, InitialValue="0")
VAR_L2Sampling_RslvSinP_VADC_Min1_u16 = ASAP2.Signal(StorageClass="ExportedGlobal", DataType="uint16", Min=0, Max=1024, InitialValue="0")
VAR_L2Sampling_RslvSinN_VADC_Max1_u16 = ASAP2.Signal(StorageClass="ExportedGlobal", DataType="uint16", Min=0, Max=1024, InitialValue="0")
VAR_L2Sampling_RslvSinN_VADC_Min1_u16 = ASAP2.Signal(StorageClass="ExportedGlobal", DataType="uint16", Min=0, Max=1024, InitialValue="0")
VAR_L2Sampling_RslvCosP_VADC_Max1_u16 = ASAP2.Signal(StorageClass="ExportedGlobal", DataType="uint16", Min=0, Max=1024, InitialValue="0")
VAR_L2Sampling_RslvCosP_VADC_Min1_u16 = ASAP2.Signal(StorageClass="ExportedGlobal", DataType="uint16", Min=0, Max=1024, InitialValue="0")
VAR_L2Sampling_RslvCosN_VADC_Max1_u16 = ASAP2.Signal(StorageClass="ExportedGlobal", DataType="uint16", Min=0, Max=1024, InitialValue="0")
VAR_L2Sampling_RslvCosN_VADC_Min1_u16 = ASAP2.Signal(StorageClass="ExportedGlobal", DataType="uint16", Min=0, Max=1024, InitialValue="0")
VAR_L2Sampling_UBRWIDE_MON_u16 = ASAP2.Signal(StorageClass="ExportedGlobal", DataType="uint16", Min=0, Max=4095, InitialValue="0")
VAR_L2Sampling_UBRNARR_MON_u16 = ASAP2.Signal(StorageClass="ExportedGlobal", DataType="uint16", Min=0, Max=4095, InitialValue="0")
VAR_L2Sampling_UB_SBC_MON_u16 = ASAP2.Signal(StorageClass="ExportedGlobal", DataType="uint16", Min=0, Max=4095, InitialValue="0")
VAR_L2Sampling_18VHS_MON_u16 = ASAP2.Signal(StorageClass="ExportedGlobal", DataType="uint16", Min=0, Max=4095, InitialValue="0")
VAR_L2Sampling_3V3CPLD_MON_u16 = ASAP2.Signal(StorageClass="ExportedGlobal", DataType="uint16", Min=0, Max=4095, InitialValue="0")
VAR_L2Sampling_1V8CPLD_MON_u16 = ASAP2.Signal(StorageClass="ExportedGlobal", DataType="uint16", Min=0, Max=4095, InitialValue="0")
VAR_TRSP_AgRtr_f32 = ASAP2.Signal(StorageClass="ExportedGlobal", DataType="single", Min=0, Max=360, InitialValue="0")
GLB_TRSP_CircAge_f32 = iEDS_Parameter.Parameter(360, DoubleProperty=0, Int32Property=int32(0), LogicalProperty=false, OnOffStringProperty="off", ColorStringProperty="red", StorageClass="Define", DataType="single")
GLB_TRSP_MotorPole_u8 = iEDS_Parameter.Parameter(4, DoubleProperty=0, Int32Property=int32(0), LogicalProperty=false, OnOffStringProperty="off", ColorStringProperty="red", StorageClass="Define", DataType="uint8")
GLB_TRSP_Sixty_f32 = iEDS_Parameter.Parameter(60, DoubleProperty=0, Int32Property=int32(0), LogicalProperty=false, OnOffStringProperty="off", ColorStringProperty="red", StorageClass="Define", DataType="single")
CAL_TRSP_CurrRngErrRst_b = iEDS_Parameter.Parameter(0, DoubleProperty=0, Int32Property=int32(0), LogicalProperty=false, OnOffStringProperty="off", ColorStringProperty="red", StorageClass="iEDS_Parameter", DataType="boolean", Min=0, Max=1)
CAL_TRSP_CurrRngDebTrh_s16 = iEDS_Parameter.Parameter(500, DoubleProperty=0, Int32Property=int32(0), LogicalProperty=false, OnOffStringProperty="off", ColorStringProperty="red", StorageClass="iEDS_Parameter", DataType="int16", Min=-3000, Max=3000)
CAL_TRSP_CurrRngCountTrh_s16 = iEDS_Parameter.Parameter(1000, DoubleProperty=0, Int32Property=int32(0), LogicalProperty=false, OnOffStringProperty="off", ColorStringProperty="red", StorageClass="iEDS_Parameter", DataType="int16", Min=-3000, Max=3000)
CAL_TRSP_CurrSumErrRst_b = iEDS_Parameter.Parameter(0, DoubleProperty=0, Int32Property=int32(0), LogicalProperty=false, OnOffStringProperty="off", ColorStringProperty="red", StorageClass="iEDS_Parameter", DataType="boolean", Min=0, Max=1)
CAL_TRSP_CurrSumDebTrh_s16 = iEDS_Parameter.Parameter(500, DoubleProperty=0, Int32Property=int32(0), LogicalProperty=false, OnOffStringProperty="off", ColorStringProperty="red", StorageClass="iEDS_Parameter", DataType="int16", Min=0, Max=2000)
CAL_TRSP_CurrSumCountTrh_s16 = iEDS_Parameter.Parameter(1000, DoubleProperty=0, Int32Property=int32(0), LogicalProperty=false, OnOffStringProperty="off", ColorStringProperty="red", StorageClass="iEDS_Parameter", DataType="int16", Min=0, Max=2000)
CAL_TRSP_RslvRngErrRst_b = iEDS_Parameter.Parameter(0, DoubleProperty=0, Int32Property=int32(0), LogicalProperty=false, OnOffStringProperty="off", ColorStringProperty="red", StorageClass="iEDS_Parameter", DataType="boolean", Min=0, Max=1)
CAL_TRSP_RslvRngDebTrh_s16 = iEDS_Parameter.Parameter(500, DoubleProperty=0, Int32Property=int32(0), LogicalProperty=false, OnOffStringProperty="off", ColorStringProperty="red", StorageClass="iEDS_Parameter", DataType="int16", Min=0, Max=2000)
CAL_TRSP_RslvRngCountTrh_s16 = iEDS_Parameter.Parameter(1000, DoubleProperty=0, Int32Property=int32(0), LogicalProperty=false, OnOffStringProperty="off", ColorStringProperty="red", StorageClass="iEDS_Parameter", DataType="int16", Min=0, Max=2000)
CAL_TRSP_RslvSqrtErrRst_b = iEDS_Parameter.Parameter(0, DoubleProperty=0, Int32Property=int32(0), LogicalProperty=false, OnOffStringProperty="off", ColorStringProperty="red", StorageClass="iEDS_Parameter", DataType="boolean", Min=0, Max=1)
CAL_TRSP_RslvSqrtDebTrh_s16 = iEDS_Parameter.Parameter(500, DoubleProperty=0, Int32Property=int32(0), LogicalProperty=false, OnOffStringProperty="off", ColorStringProperty="red", StorageClass="iEDS_Parameter", DataType="int16", Min=0, Max=2000)
CAL_TRSP_RslvSqrtCountTrh_s16 = iEDS_Parameter.Parameter(1000, DoubleProperty=0, Int32Property=int32(0), LogicalProperty=false, OnOffStringProperty="off", ColorStringProperty="red", StorageClass="iEDS_Parameter", DataType="int16", Min=0, Max=2000)
CAL_TRSP_RslvExciErrRst_b = iEDS_Parameter.Parameter(0, DoubleProperty=0, Int32Property=int32(0), LogicalProperty=false, OnOffStringProperty="off", ColorStringProperty="red", StorageClass="iEDS_Parameter", DataType="boolean", Min=0, Max=1)
CAL_TRSP_RslvExciDebTrh_s16 = iEDS_Parameter.Parameter(500, DoubleProperty=0, Int32Property=int32(0), LogicalProperty=false, OnOffStringProperty="off", ColorStringProperty="red", StorageClass="iEDS_Parameter", DataType="int16", Min=0, Max=2000)
CAL_TRSP_RslvExciCountTrh_s16 = iEDS_Parameter.Parameter(1000, DoubleProperty=0, Int32Property=int32(0), LogicalProperty=false, OnOffStringProperty="off", ColorStringProperty="red", StorageClass="iEDS_Parameter", DataType="int16", Min=0, Max=2000)
CAL_TRSP_RslvSensVoltErrRst_b = iEDS_Parameter.Parameter(0, DoubleProperty=0, Int32Property=int32(0), LogicalProperty=false, OnOffStringProperty="off", ColorStringProperty="red", StorageClass="iEDS_Parameter", DataType="boolean", Min=0, Max=1)
CAL_TRSP_RslvSensVoltDebTrh_s16 = iEDS_Parameter.Parameter(500, DoubleProperty=0, Int32Property=int32(0), LogicalProperty=false, OnOffStringProperty="off", ColorStringProperty="red", StorageClass="iEDS_Parameter", DataType="int16", Min=0, Max=2000)
CAL_TRSP_RslvSensVoltCountTrh_s16 = iEDS_Parameter.Parameter(1000, DoubleProperty=0, Int32Property=int32(0), LogicalProperty=false, OnOffStringProperty="off", ColorStringProperty="red", StorageClass="iEDS_Parameter", DataType="int16", Min=0, Max=2000)
CAL_TRSP_iPhasSensVoltErrRst_b = iEDS_Parameter.Parameter(0, DoubleProperty=0, Int32Property=int32(0), LogicalProperty=false, OnOffStringProperty="off", ColorStringProperty="red", StorageClass="iEDS_Parameter", DataType="boolean", Min=0, Max=1)
CAL_TRSP_iPhasSensVoltDebTrh_s16 = iEDS_Parameter.Parameter(500, DoubleProperty=0, Int32Property=int32(0), LogicalProperty=false, OnOffStringProperty="off", ColorStringProperty="red", StorageClass="iEDS_Parameter", DataType="int16", Min=0, Max=2000)
CAL_TRSP_iPhasSensVoltCountTrh_s16 = iEDS_Parameter.Parameter(1000, DoubleProperty=0, Int32Property=int32(0), LogicalProperty=false, OnOffStringProperty="off", ColorStringProperty="red", StorageClass="iEDS_Parameter", DataType="int16", Min=0, Max=2000)
CAL_TRSP_ReqTrqErrRst_b = iEDS_Parameter.Parameter(0, DoubleProperty=0, Int32Property=int32(0), LogicalProperty=false, OnOffStringProperty="off", ColorStringProperty="red", StorageClass="iEDS_Parameter", DataType="boolean", Min=0, Max=1)
CAL_TRSP_ReqTrqDebTrh_s16 = iEDS_Parameter.Parameter(5, DoubleProperty=0, Int32Property=int32(0), LogicalProperty=false, OnOffStringProperty="off", ColorStringProperty="red", StorageClass="iEDS_Parameter", DataType="int16", Min=0, Max=20)
CAL_TRSP_ReqTrqCountTrh_s16 = iEDS_Parameter.Parameter(10, DoubleProperty=0, Int32Property=int32(0), LogicalProperty=false, OnOffStringProperty="off", ColorStringProperty="red", StorageClass="iEDS_Parameter", DataType="int16", Min=0, Max=20)
CAL_TRSP_UBRVoltErrRst_b = iEDS_Parameter.Parameter(0, DoubleProperty=0, Int32Property=int32(0), LogicalProperty=false, OnOffStringProperty="off", ColorStringProperty="red", StorageClass="iEDS_Parameter", DataType="boolean", Min=0, Max=1)
CAL_TRSP_UBRVoltDebTrh_s16 = iEDS_Parameter.Parameter(500, DoubleProperty=0, Int32Property=int32(0), LogicalProperty=false, OnOffStringProperty="off", ColorStringProperty="red", StorageClass="iEDS_Parameter", DataType="int16", Min=0, Max=2000)
CAL_TRSP_UBRVoltCountTrh_s16 = iEDS_Parameter.Parameter(1000, DoubleProperty=0, Int32Property=int32(0), LogicalProperty=false, OnOffStringProperty="off", ColorStringProperty="red", StorageClass="iEDS_Parameter", DataType="int16", Min=0, Max=2000)
CAL_TRSP_18VHSVoltErrRst_b = iEDS_Parameter.Parameter(0, DoubleProperty=0, Int32Property=int32(0), LogicalProperty=false, OnOffStringProperty="off", ColorStringProperty="red", StorageClass="iEDS_Parameter", DataType="boolean", Min=0, Max=1)
CAL_TRSP_18VHSVoltDebTrh_s16 = iEDS_Parameter.Parameter(500, DoubleProperty=0, Int32Property=int32(0), LogicalProperty=false, OnOffStringProperty="off", ColorStringProperty="red", StorageClass="iEDS_Parameter", DataType="int16", Min=0, Max=2000)
CAL_TRSP_18VHSVoltCountTrh_s16 = iEDS_Parameter.Parameter(1000, DoubleProperty=0, Int32Property=int32(0), LogicalProperty=false, OnOffStringProperty="off", ColorStringProperty="red", StorageClass="iEDS_Parameter", DataType="int16", Min=0, Max=2000)
CAL_TRSP_3V3CPLDVoltErrRst_b = iEDS_Parameter.Parameter(0, DoubleProperty=0, Int32Property=int32(0), LogicalProperty=false, OnOffStringProperty="off", ColorStringProperty="red", StorageClass="iEDS_Parameter", DataType="boolean", Min=0, Max=1)
CAL_TRSP_3V3CPLDVoltDebTrh_s16 = iEDS_Parameter.Parameter(500, DoubleProperty=0, Int32Property=int32(0), LogicalProperty=false, OnOffStringProperty="off", ColorStringProperty="red", StorageClass="iEDS_Parameter", DataType="int16", Min=0, Max=2000)
CAL_TRSP_3V3CPLDVoltCountTrh_s16 = iEDS_Parameter.Parameter(1000, DoubleProperty=0, Int32Property=int32(0), LogicalProperty=false, OnOffStringProperty="off", ColorStringProperty="red", StorageClass="iEDS_Parameter", DataType="int16", Min=0, Max=2000)
CAL_TRSP_1V8CPLDVoltErrRst_b = iEDS_Parameter.Parameter(0, DoubleProperty=0, Int32Property=int32(0), LogicalProperty=false, OnOffStringProperty="off", ColorStringProperty="red", StorageClass="iEDS_Parameter", DataType="boolean", Min=0, Max=1)
CAL_TRSP_1V8CPLDVoltDebTrh_s16 = iEDS_Parameter.Parameter(500, DoubleProperty=0, Int32Property=int32(0), LogicalProperty=false, OnOffStringProperty="off", ColorStringProperty="red", StorageClass="iEDS_Parameter", DataType="int16", Min=0, Max=2000)
CAL_TRSP_1V8CPLDVoltCountTrh_s16 = iEDS_Parameter.Parameter(1000, DoubleProperty=0, Int32Property=int32(0), LogicalProperty=false, OnOffStringProperty="off", ColorStringProperty="red", StorageClass="iEDS_Parameter", DataType="int16", Min=0, Max=2000)
CAL_TRSP_UCurrRngHiLim_f32 = iEDS_Parameter.Parameter(-2000, DoubleProperty=0, Int32Property=int32(0), LogicalProperty=false, OnOffStringProperty="off", ColorStringProperty="red", StorageClass="iEDS_Parameter", DataType="single", Min=-30000, Max=0)
CAL_TRSP_UCurrRngLoLim_f32 = iEDS_Parameter.Parameter(-21000, DoubleProperty=0, Int32Property=int32(0), LogicalProperty=false, OnOffStringProperty="off", ColorStringProperty="red", StorageClass="iEDS_Parameter", DataType="single", Min=-30000, Max=0)
CAL_TRSP_VCurrRngHiLim_f32 = iEDS_Parameter.Parameter(21000, DoubleProperty=0, Int32Property=int32(0), LogicalProperty=false, OnOffStringProperty="off", ColorStringProperty="red", StorageClass="iEDS_Parameter", DataType="single", Min=0, Max=30000)
CAL_TRSP_VCurrRngLoLim_f32 = iEDS_Parameter.Parameter(2000, DoubleProperty=0, Int32Property=int32(0), LogicalProperty=false, OnOffStringProperty="off", ColorStringProperty="red", StorageClass="iEDS_Parameter", DataType="single", Min=0, Max=30000)
CAL_TRSP_WCurrRngHiLim_f32 = iEDS_Parameter.Parameter(21000, DoubleProperty=0, Int32Property=int32(0), LogicalProperty=false, OnOffStringProperty="off", ColorStringProperty="red", StorageClass="iEDS_Parameter", DataType="single", Min=0, Max=30000)
CAL_TRSP_WCurrRngLoLim_f32 = iEDS_Parameter.Parameter(2000, DoubleProperty=0, Int32Property=int32(0), LogicalProperty=false, OnOffStringProperty="off", ColorStringProperty="red", StorageClass="iEDS_Parameter", DataType="single", Min=0, Max=30000)
CAL_TRSP_CurrSumLim_f32 = iEDS_Parameter.Parameter(30, DoubleProperty=0, Int32Property=int32(0), LogicalProperty=false, OnOffStringProperty="off", ColorStringProperty="red", StorageClass="iEDS_Parameter", DataType="single", Min=0, Max=1000)
CAL_TRSP_RslvRngSinPHiLim_u16 = iEDS_Parameter.Parameter(650, DoubleProperty=0, Int32Property=int32(0), LogicalProperty=false, OnOffStringProperty="off", ColorStringProperty="red", StorageClass="iEDS_Parameter", DataType="uint16", Min=0, Max=4095)
CAL_TRSP_RslvRngSinPLoLim_u16 = iEDS_Parameter.Parameter(350, DoubleProperty=0, Int32Property=int32(0), LogicalProperty=false, OnOffStringProperty="off", ColorStringProperty="red", StorageClass="iEDS_Parameter", DataType="uint16", Min=0, Max=4095)
CAL_TRSP_RslvRngSinNHiLim_u16 = iEDS_Parameter.Parameter(650, DoubleProperty=0, Int32Property=int32(0), LogicalProperty=false, OnOffStringProperty="off", ColorStringProperty="red", StorageClass="iEDS_Parameter", DataType="uint16", Min=0, Max=4095)
CAL_TRSP_RslvRngSinNLoLim_u16 = iEDS_Parameter.Parameter(350, DoubleProperty=0, Int32Property=int32(0), LogicalProperty=false, OnOffStringProperty="off", ColorStringProperty="red", StorageClass="iEDS_Parameter", DataType="uint16", Min=0, Max=4095)
CAL_TRSP_RslvRngCosPHiLim_u16 = iEDS_Parameter.Parameter(650, DoubleProperty=0, Int32Property=int32(0), LogicalProperty=false, OnOffStringProperty="off", ColorStringProperty="red", StorageClass="iEDS_Parameter", DataType="uint16", Min=0, Max=4095)
CAL_TRSP_RslvRngCosPLoLim_u16 = iEDS_Parameter.Parameter(350, DoubleProperty=0, Int32Property=int32(0), LogicalProperty=false, OnOffStringProperty="off", ColorStringProperty="red", StorageClass="iEDS_Parameter", DataType="uint16", Min=0, Max=4095)
CAL_TRSP_RslvRngCosNHiLim_u16 = iEDS_Parameter.Parameter(650, DoubleProperty=0, Int32Property=int32(0), LogicalProperty=false, OnOffStringProperty="off", ColorStringProperty="red", StorageClass="iEDS_Parameter", DataType="uint16", Min=0, Max=4095)
CAL_TRSP_RslvRngCosNLoLim_u16 = iEDS_Parameter.Parameter(350, DoubleProperty=0, Int32Property=int32(0), LogicalProperty=false, OnOffStringProperty="off", ColorStringProperty="red", StorageClass="iEDS_Parameter", DataType="uint16", Min=0, Max=4095)
CAL_TRSP_RslvMaxSele_u8 = iEDS_Parameter.Parameter(8, DoubleProperty=0, Int32Property=int32(0), LogicalProperty=false, OnOffStringProperty="off", ColorStringProperty="red", StorageClass="iEDS_Parameter", DataType="uint8", Min=0, Max=32)
CAL_TRSP_RslvMinSele_u8 = iEDS_Parameter.Parameter(24, DoubleProperty=0, Int32Property=int32(0), LogicalProperty=false, OnOffStringProperty="off", ColorStringProperty="red", StorageClass="iEDS_Parameter", DataType="uint8", Min=0, Max=32)
CAL_TRSP_RslvSqrtHiLim_u16 = iEDS_Parameter.Parameter(4500, DoubleProperty=0, Int32Property=int32(0), LogicalProperty=false, OnOffStringProperty="off", ColorStringProperty="red", StorageClass="iEDS_Parameter", DataType="uint16", Min=0, Max=30000)
CAL_TRSP_RslvSqrtLoLim_u16 = iEDS_Parameter.Parameter(1500, DoubleProperty=0, Int32Property=int32(0), LogicalProperty=false, OnOffStringProperty="off", ColorStringProperty="red", StorageClass="iEDS_Parameter", DataType="uint16", Min=0, Max=30000)
CAL_TRSP_RslvRngExciHiLim_u16 = iEDS_Parameter.Parameter(2500, DoubleProperty=0, Int32Property=int32(0), LogicalProperty=false, OnOffStringProperty="off", ColorStringProperty="red", StorageClass="iEDS_Parameter", DataType="uint16", Min=0, Max=4096)
CAL_TRSP_RslvRngExciLoLim_u16 = iEDS_Parameter.Parameter(800, DoubleProperty=0, Int32Property=int32(0), LogicalProperty=false, OnOffStringProperty="off", ColorStringProperty="red", StorageClass="iEDS_Parameter", DataType="uint16", Min=0, Max=4096)
CAL_TRSP_RslvSensVoltHiLim_u16 = iEDS_Parameter.Parameter(2376, DoubleProperty=0, Int32Property=int32(0), LogicalProperty=false, OnOffStringProperty="off", ColorStringProperty="red", StorageClass="iEDS_Parameter", DataType="uint16", Min=0, Max=4096)
CAL_TRSP_RslvSensVoltLoLim_u16 = iEDS_Parameter.Parameter(1720, DoubleProperty=0, Int32Property=int32(0), LogicalProperty=false, OnOffStringProperty="off", ColorStringProperty="red", StorageClass="iEDS_Parameter", DataType="uint16", Min=0, Max=4096)
CAL_TRSP_iPhasSensVoltHiLim_u16 = iEDS_Parameter.Parameter(4096, DoubleProperty=0, Int32Property=int32(0), LogicalProperty=false, OnOffStringProperty="off", ColorStringProperty="red", StorageClass="iEDS_Parameter", DataType="uint16", Min=0, Max=4096)
CAL_TRSP_iPhasSensVoltLoLim_u16 = iEDS_Parameter.Parameter(4014, DoubleProperty=0, Int32Property=int32(0), LogicalProperty=false, OnOffStringProperty="off", ColorStringProperty="red", StorageClass="iEDS_Parameter", DataType="uint16", Min=0, Max=4096)
CAL_TRSP_Diff_UBR_SBCLim_f32 = iEDS_Parameter.Parameter(3, DoubleProperty=0, Int32Property=int32(0), LogicalProperty=false, OnOffStringProperty="off", ColorStringProperty="red", StorageClass="iEDS_Parameter", DataType="single", Min=0, Max=20)
CAL_TRSP_UBRWIDECnvFac_f32 = iEDS_Parameter.Parameter(0.00714, DoubleProperty=0, Int32Property=int32(0), LogicalProperty=false, OnOffStringProperty="off", ColorStringProperty="red", StorageClass="iEDS_Parameter", DataType="single", Min=-1, Max=1)
CAL_TRSP_UB_SBCCnvFac_f32 = iEDS_Parameter.Parameter(0.0069, DoubleProperty=0, Int32Property=int32(0), LogicalProperty=false, OnOffStringProperty="off", ColorStringProperty="red", StorageClass="iEDS_Parameter", DataType="single", Min=-1, Max=1)
CAL_TRSP_18VHSVoltHiLim_u16 = iEDS_Parameter.Parameter(3000, DoubleProperty=0, Int32Property=int32(0), LogicalProperty=false, OnOffStringProperty="off", ColorStringProperty="red", StorageClass="iEDS_Parameter", DataType="uint16", Min=0, Max=4096)
CAL_TRSP_18VHSVoltLoLim_u16 = iEDS_Parameter.Parameter(2000, DoubleProperty=0, Int32Property=int32(0), LogicalProperty=false, OnOffStringProperty="off", ColorStringProperty="red", StorageClass="iEDS_Parameter", DataType="uint16", Min=0, Max=4096)
CAL_TRSP_3V3CPLDVoltHiLim_u16 = iEDS_Parameter.Parameter(3000, DoubleProperty=0, Int32Property=int32(0), LogicalProperty=false, OnOffStringProperty="off", ColorStringProperty="red", StorageClass="iEDS_Parameter", DataType="uint16", Min=0, Max=4096)
CAL_TRSP_3V3CPLDVoltLoLim_u16 = iEDS_Parameter.Parameter(2000, DoubleProperty=0, Int32Property=int32(0), LogicalProperty=false, OnOffStringProperty="off", ColorStringProperty="red", StorageClass="iEDS_Parameter", DataType="uint16", Min=0, Max=4096)
CAL_TRSP_1V8CPLDVoltHiLim_u16 = iEDS_Parameter.Parameter(2000, DoubleProperty=0, Int32Property=int32(0), LogicalProperty=false, OnOffStringProperty="off", ColorStringProperty="red", StorageClass="iEDS_Parameter", DataType="uint16", Min=0, Max=4096)
CAL_TRSP_1V8CPLDVoltLoLim_u16 = iEDS_Parameter.Parameter(1000, DoubleProperty=0, Int32Property=int32(0), LogicalProperty=false, OnOffStringProperty="off", ColorStringProperty="red", StorageClass="iEDS_Parameter", DataType="uint16", Min=0, Max=4096)
CAL_TRSP_iPhaUOffset_f32 = iEDS_Parameter.Parameter(-10600, DoubleProperty=0, Int32Property=int32(0), LogicalProperty=false, OnOffStringProperty="off", ColorStringProperty="red", StorageClass="iEDS_Parameter", DataType="single", Min=-30000, Max=0)
CAL_TRSP_iPhaVOffset_f32 = iEDS_Parameter.Parameter(10610, DoubleProperty=0, Int32Property=int32(0), LogicalProperty=false, OnOffStringProperty="off", ColorStringProperty="red", StorageClass="iEDS_Parameter", DataType="single", Min=0, Max=30000)
CAL_TRSP_iPhaWOffset_f32 = iEDS_Parameter.Parameter(10780, DoubleProperty=0, Int32Property=int32(0), LogicalProperty=false, OnOffStringProperty="off", ColorStringProperty="red", StorageClass="iEDS_Parameter", DataType="single", Min=0, Max=30000)
CAL_TRSP_iUCnvFac_f32 = iEDS_Parameter.Parameter(-0.0916, DoubleProperty=0, Int32Property=int32(0), LogicalProperty=false, OnOffStringProperty="off", ColorStringProperty="red", StorageClass="iEDS_Parameter", DataType="single", Min=-1, Max=0)
CAL_TRSP_iVCnvFac_f32 = iEDS_Parameter.Parameter(0.0924, DoubleProperty=0, Int32Property=int32(0), LogicalProperty=false, OnOffStringProperty="off", ColorStringProperty="red", StorageClass="iEDS_Parameter", DataType="single", Min=0, Max=1)
CAL_TRSP_iWCnvFac_f32 = iEDS_Parameter.Parameter(0.0916, DoubleProperty=0, Int32Property=int32(0), LogicalProperty=false, OnOffStringProperty="off", ColorStringProperty="red", StorageClass="iEDS_Parameter", DataType="single", Min=0, Max=1)
CAL_TRSP_flgChangPha_b = iEDS_Parameter.Parameter(0, DoubleProperty=0, Int32Property=int32(0), LogicalProperty=false, OnOffStringProperty="off", ColorStringProperty="red", StorageClass="iEDS_Parameter", DataType="boolean", Min=0, Max=1)
CAL_TRSP_OfstRngHiLim_f32 = iEDS_Parameter.Parameter(360, DoubleProperty=0, Int32Property=int32(0), LogicalProperty=false, OnOffStringProperty="off", ColorStringProperty="red", StorageClass="iEDS_Parameter", DataType="single", Min=-1, Max=361)
CAL_TRSP_OfstRngLoLim_f32 = iEDS_Parameter.Parameter(0, DoubleProperty=0, Int32Property=int32(0), LogicalProperty=false, OnOffStringProperty="off", ColorStringProperty="red", StorageClass="iEDS_Parameter", DataType="single", Min=-1, Max=361)
CAL_TRSP_TorqueCtlMode_u8 = iEDS_Parameter.Parameter(8, DoubleProperty=0, Int32Property=int32(0), LogicalProperty=false, OnOffStringProperty="off", ColorStringProperty="red", StorageClass="iEDS_Parameter", DataType="uint8", Min=0, Max=255)
CAL_TRSP_SpeedCtlMode_u8 = iEDS_Parameter.Parameter(7, DoubleProperty=0, Int32Property=int32(0), LogicalProperty=false, OnOffStringProperty="off", ColorStringProperty="red", StorageClass="iEDS_Parameter", DataType="uint8", Min=0, Max=255)
CAL_TRSP_OfstErrRst_b = iEDS_Parameter.Parameter(0, DoubleProperty=0, Int32Property=int32(0), LogicalProperty=false, OnOffStringProperty="off", ColorStringProperty="red", StorageClass="iEDS_Parameter", DataType="boolean", Min=0, Max=1)
CAL_TRSP_ReqTrqHiLim_f32 = iEDS_Parameter.Parameter(350, DoubleProperty=0, Int32Property=int32(0), LogicalProperty=false, OnOffStringProperty="off", ColorStringProperty="red", StorageClass="iEDS_Parameter", DataType="single", Min=-500, Max=500)
CAL_TRSP_ReqTrqLoLim_f32 = iEDS_Parameter.Parameter(-350, DoubleProperty=0, Int32Property=int32(0), LogicalProperty=false, OnOffStringProperty="off", ColorStringProperty="red", StorageClass="iEDS_Parameter", DataType="single", Min=-500, Max=500)
CAL_TRSP_AgTimecompCtl_u8 = iEDS_Parameter.Parameter(0, DoubleProperty=0, Int32Property=int32(0), LogicalProperty=false, OnOffStringProperty="off", ColorStringProperty="red", StorageClass="iEDS_Parameter", DataType="uint8")
float64 = Simulink.AliasType(BaseType="double")
float32 = Simulink.AliasType(BaseType="single")
sint64 = Simulink.AliasType(BaseType="int64")
sint32 = Simulink.AliasType(BaseType="int32")
sint16 = Simulink.AliasType(BaseType="int16")
sint8 = Simulink.AliasType(BaseType="int8")
uint64 = Simulink.AliasType(BaseType="uint64")
uint32 = Simulink.AliasType(BaseType="uint32")
uint16 = Simulink.AliasType(BaseType="uint16")
uint8 = Simulink.AliasType(BaseType="uint8")
boolean = Simulink.AliasType(BaseType="boolean")